# Grasshopper definition 180616_BentoScope_Madrid.gh (Grasshopper 0.9.76)
# plug-ins: Python Interpreter, Firefly.X, Human, gHowl, LunchBox

# ---- group: manual color space calibration for dock / Sample White
pt = Point(<point referenced from the Rhino model>)

# ---- group: manual color space calibration for dock / Sample Black
pt_2 = Point(<point referenced from the Rhino model>)

# ---- group: manual color space calibration for dock / Sample Blue
pt_3 = Point(<point referenced from the Rhino model>)  # disabled

# ---- group: manual color space calibration for dock / Sample Green
pt_4 = Point(<point referenced from the Rhino model>)  # disabled

# ---- group: manual color space calibration for dock / Sample Red
pt_5 = Point(<point referenced from the Rhino model>)

# ---- group: manual color space calibration for dock / Sample Yellow
pt_6 = Point(<point referenced from the Rhino model>)  # disabled

# ----
pdecon = Deconstruct(Point=pt)  # -> XComponent, YComponent, ZComponent
pdecon_2 = Deconstruct(Point=pt_2)  # -> XComponent, YComponent, ZComponent
pdecon_3 = Deconstruct(Point=pt_5)  # -> XComponent, YComponent, ZComponent
pdecon_4 = Deconstruct(Point=pt_6)  # -> XComponent, YComponent, ZComponent
pdecon_5 = Deconstruct(Point=pt_3)  # -> XComponent, YComponent, ZComponent
pdecon_6 = Deconstruct(Point=pt_4)  # -> XComponent, YComponent, ZComponent

# ---- group: mesh, flat
mesh = Mesh([<mesh referenced from the Rhino model> x6])

# ----
volume = Volume(Geometry=mesh)  # -> Volume, Centroid
pdecon_7 = Deconstruct(Point=volume.Centroid)  # -> XComponent, YComponent, ZComponent
pt_7 = ConstructPoint(XCoordinate=pdecon_7.XComponent, YCoordinate=pdecon_7.YComponent, ZCoordinate=0)
scale = Scale(Geometry=mesh, Center=pt_7, Factor=Slider(0.97, range=0..1))  # -> Geometry, Transform
mesh_2 = Mesh(scale.Geometry)

# ---- group: module meshes lego ref: -1
# Building Type Mesh
mesh_3 = Mesh(<mesh referenced from the Rhino model>)

# ---- group: module meshes lego ref: 0 to 5
mesh_4 = Mesh([<mesh referenced from the Rhino model> x6])

# ---- group: module meshes lego ref: 0 to 5 - with hight test
mesh_5 = Mesh([<mesh referenced from the Rhino model> x6])

# ----
frgb = ColourRGBF(Alpha=1, Red=pdecon.XComponent, Green=pdecon.YComponent, Blue=pdecon.ZComponent)
frgb_2 = ColourRGBF(Alpha=1, Red=pdecon_2.XComponent, Green=pdecon_2.YComponent, Blue=pdecon_2.ZComponent)
frgb_3 = ColourRGBF(Alpha=1, Red=pdecon_3.XComponent, Green=pdecon_3.YComponent, Blue=pdecon_3.ZComponent)
frgb_4 = ColourRGBF(Alpha=1, Red=pdecon_4.XComponent, Green=pdecon_4.YComponent, Blue=pdecon_4.ZComponent)
frgb_5 = ColourRGBF(Alpha=1, Red=pdecon_5.XComponent, Green=pdecon_5.YComponent, Blue=pdecon_5.ZComponent)
frgb_6 = ColourRGBF(Alpha=1, Red=pdecon_6.XComponent, Green=pdecon_6.YComponent, Blue=pdecon_6.ZComponent)

# ---- group: GH Profiler List_David Rutten_Jung
gh_profiler_list = VBScript()  # -> out; disabled
# ---------- gh_profiler_list: VB ----------
    If (_form IsNot Nothing) Then Return

    _form = New Form()
    _form.StartPosition = FormStartPosition.Manual
    _form.ShowInTaskbar = False
    _form.FormBorderStyle = FormBorderStyle.SizableToolWindow
    _form.Text = "Component List"
    AddHandler _form.FormClosing, AddressOf FormClosing

    _list = New ListView()
    _list.View = View.Details
    _list.AllowColumnReorder = False
    _list.MultiSelect = False
    _list.Columns.Add("Component", 200)
    _list.Columns.Add("Runtime", 80)
    _list.Dock = DockStyle.Fill
    AddHandler _list.ItemActivate, AddressOf ItemActivate
    _form.Controls.Add(_list)

    Grasshopper.GUI.GH_WindowsFormUtil.CenterFormOnCursor(_form, True)
    _form.Show(Instances.DocumentEditor)
    Instances.DocumentEditor.FormShepard.RegisterForm(_form)

    If (_handler) Then Return
    AddHandler GrasshopperDocument.SolutionEnd, AddressOf DocumentSolutionEnd
# ---------- gh_profiler_list: VB additional code ----------
  Private _form As Form
  Private _list As ListView
  Private _handler As Boolean = False

  Private Sub FormClosing(sender As Object, e As EventArgs)
    If (_form Is Nothing) Then Return
    RemoveHandler _form.FormClosing, AddressOf FormClosing
    RemoveHandler _list.ItemActivate, AddressOf ItemActivate

    _form = Nothing
    _list = Nothing
  End Sub
  Private Sub ItemActivate(sender As Object, e As EventArgs)
    Try
      Dim item As ListViewItem = _list.SelectedItems(0)
      Dim target As RectangleF = TryCast(item.Tag, IGH_DocumentObject).Attributes.Bounds
      Dim view As New Grasshopper.GUI.Canvas.GH_NamedView(Instances.ActiveCanvas.Viewport.ScreenPort, target)
      view.SetToViewport(Instances.ActiveCanvas, 350)
    Catch
    End Try
  End Sub

  Private Sub DocumentSolutionEnd(sender As Object, e As GH_SolutionEventArgs)
    If (_form Is Nothing) Then Return
    _list.Items.Clear()

    Dim doc As GH_Document = e.Document
    If (doc Is Nothing) Then Return
    If (doc.ObjectCount = 0) Then Return

    Dim times As Int64()
    Dim objects As IGH_DocumentObject()
    ReDim times(doc.ObjectCount - 1)
    ReDim objects(doc.ObjectCount - 1)
    For i As Int32 = 0 To doc.ObjectCount - 1
      Dim obj As IGH_ActiveObject = TryCast(doc.Objects(i), IGH_ActiveObject)
      If (obj Is Nothing) Then
        times(i) = 0
        objects(i) = doc.Objects(i)
        Continue For
      End If

      times(i) = obj.ProcessorTime.Ticks
      objects(i) = obj
    Next
    Array.Sort(times, objects)

    For i As Int32 = doc.ObjectCount - 1 To 0 Step -1
      If (times(i) < TimeSpan.TicksPerMillisecond) Then Continue For
      Dim item As New ListViewItem(objects(i).Name)
      item.Tag = objects(i)
      item.SubItems.Add(String.Format("{0:0} ms", New TimeSpan(times(i)).TotalMilliseconds))
      _list.Items.Add(item)
    Next
    _list.Invalidate()
  End Sub
# ---------- end gh_profiler_list ----------

# ----
merge = Merge(Data1=frgb, Data2=frgb_2, Data3=frgb_3, Data4=frgb_4, Data5=frgb_5, Data6=frgb_6)

# ---- group: mesh coloring
mesh_6 = Mesh(<mesh referenced from the Rhino model>)
res_color = ColourSwatch(SwatchColor=RGB(251, 255, 122))
res_gray = ColourSwatch(SwatchColor=RGB(227, 227, 227))
sidewalk = ColourSwatch(SwatchColor=RGB(107, 107, 107))
bikelane = ColourSwatch(SwatchColor=RGB(86, 135, 87))
off_gray = ColourSwatch(SwatchColor=RGB(171, 171, 171))
offcolor = ColourSwatch(SwatchColor=RGB(255, 122, 122))
parking = ColourSwatch(SwatchColor=RGB(196, 156, 100))
blank = ColourSwatch(SwatchColor=RGB(110, 110, 110))
park = ColourSwatch(SwatchColor=RGB(165, 201, 44))
road = ColourSwatch(SwatchColor=RGB(64, 64, 64))
text = ColourSwatch(SwatchColor=RGB(0, 0, 0))
res_warm = ColourSwatch(SwatchColor=RGB(255, 251, 230))
text_new = ColourSwatch(SwatchColor=RGB(64, 64, 64))
off_cold = ColourSwatch(SwatchColor=RGB(230, 242, 255))
mcol = MeshColours(Mesh=mesh_6, Colours=off_cold)
# -2 means static context
# -1 means empty site
# please manually replace -1
# to building types 0 to 5
# 0 means RL
# 1 means RM
# 2 means RS
# 3 means OL
# 4 means OM
# 5 means OS
mesh_7 = Mesh(mcol)

# ---- group: Relative Filepath
vb = VBScript()  # -> out, A
# ---------- vb: VB ----------
    Dim gh_d As GH_Document = owner.OnPingDocument()

    If gh_d.IsFilePathDefined Then
      Print("A path is defined.")
      A = gh_d.FilePath
    Else
      Print("No path defined.")
    End If
# ---------- end vb ----------
panel = Panel(vb.out)
panel_2 = Panel(vb.A)
split = TextSplit(Text=panel_2, Separators="\")
shift = ShiftList(List=split, Shift=-1, Wrap=False)
txt = Text(flatten("Data\180615_Camera Capture_Madrid_table2.PNG"))
txt_2 = Text(flatten(shift))
join = TextJoin(Text=flatten([txt_2, txt]), Join="\")
# Reference Color
path = FilePath(join)
panel_3 = Panel(path)

# ---- group: All Manual Reference Colors
col = Colour(merge)

# ----
mesh_8 = Mesh(mesh_2)

# ---- group: heatmap transparent
number_slider = Slider(0.8, range=0..1)

# ---- group: all ref colors
col_2 = Colour(col)

# ---- group: Walkable distance
index = Slider(500, range=1..1500)

# ---- group: right click -> Slow(1s)
video_stream = WebCamVideoStream()  # disabled

# ----
pushtempstep = Button()

# ---- group: AI Step (manual)
aisteptest = Slider(24, range=-1..24)

# ----
slider1 = Slider(0.5, range=0..1)
slider2 = Slider(0, range=0..1)
list = ValueList({"Small": 440, "Large": 1760}, selected="Small")
subtraction = Subtraction(A="1", B=number_slider)

# ---- group: manual or CV
list_2 = ValueList({"manual": 0, "CV": 1}, selected="manual")

# ---- group: Tuo's heatmap transparency
num = Number(subtraction)

# ---- group: ref color pop area
crv = Curve(<curve referenced from the Rhino model>)

# ----
path_2 = FilePath(path)

# ---- group: all rotations
panel_4 = Panel("270,270,270,270,270,270,270,270,270,270,270,270,270,270,270,270,270,270,270,270,270,270,270,270,270,270,270,270,270,270,270,270,180,180,180,180,180,180,180,180,180,180,180,180,180,180,180,180,180,180,180,180,180,180,180,180,180,180,180,180,180,180,180,180,90,90,90,90,90,90,90,90,90,90,90,90,90,90,90,90,90,90,90,90,90,90,90,90,90,90,90,90,90,90,90,90,0,0,0,0,0,0,0,0,0,0,0,0,0,0,0,0,0,0,0,0,0,0,0,0,0,0,0,0,0,0,0,0")

# ---- group: all color code quarts (no rotation)
# Decode Piece ID
panel_5 = Panel("2,0,0,0\t2,1,0,0\t2,0,1,0\t2,0,0,1\t2,1,1,0\t2,1,0,1\t2,0,1,1\t2,1,1,1\t3,0,0,0\t3,1,0,0\t3,0,1,0\t3,0,0,1\t3,1,1,0\t3,1,0,1\t3,0,1,1\t3,1,1,1\t4,0,0,0\t4,1,0,0\t4,0,1,0\t4,0,0,1\t4,1,1,0\t4,1,0,1\t4,0,1,1\t4,1,1,1\t5,0,0,0\t5,1,0,0\t5,0,1,0\t5,0,0,1\t5,1,1,0\t5,1,0,1\t5,0,1,1\t5,1,1,1")

# ----
# Input Parameters
gridextent_x = Slider(16, range=2..48)
gridextent_y = Slider(16, range=2..48)
toggle1 = BooleanToggle(False)
toggle2 = BooleanToggle(True)
toggle4 = BooleanToggle(False)
toggle3 = BooleanToggle(False)

_0_reslux = Slider(5, range=1..25)
_1_resmed = Slider(4, range=1..25)
_3_comhq = Slider(3, range=1..25)
_4_commed = Slider(6, range=1..25)
# CityMatrix CV
_5_rescw = Slider(1, range=1..25)
_2_resmu = Slider(2, range=1..25)

set1 = Button()
set2 = Button()

# ---- group: Density Array - Initial - set1
panel_6 = Panel("""20
10
5
5
5
5""")

# ---- group: Density Array - running - set 2
panel_7 = Panel("""30
30
30
30
30
30""")

# ----
load_bitmap = LoadBitmap(FilePathToImageLocation=path_2)

# ---- group: Int Grid X Extent
number_slider_2 = Slider(16, range=1..20)

# ---- group: Int Grid Y Extent
number_slider_3 = Slider(16, range=1..20)

# ---- group: Pts Sample Grid Corner
pt_8 = Point([<point referenced from the Rhino model> x4])

# ---- group: color calibration dock / ref color pop area
crv_2 = Curve(<curve referenced from the Rhino model>)  # disabled

# ---- group: dock position ref pts
# Dock Sampling
pt_9 = Point([<point referenced from the Rhino model> x4])

# ----
pline = PolyLine(Vertices=pt_8, Closed=False)

# ---- group: Sample Toggle
pt_10 = Point(<point referenced from the Rhino model>)

# ---- group: Sample Other
# Decode Slider Value
pt_11 = Point(<point referenced from the Rhino model>)

# ---- group: color ids
int = Integer("0")
int_2 = Integer("1")
int_3 = Integer("2")
panel_8 = Panel("3")  # disabled
int_4 = Integer(panel_8)  # disabled
panel_9 = Panel("4")  # disabled
int_5 = Integer(panel_9)  # disabled
panel_10 = Panel("5")  # disabled
# Grid Sampling
int_6 = Integer(panel_10)  # disabled

# ---- group: slider postion ref lines
# 3 Level Slider Sampling
crv_3 = Curve(reparameterize(graft([<curve referenced from the Rhino model> x5])))

# ---- group: Sample Others
# Decode Slider Value
pt_12 = Point([<point referenced from the Rhino model> x3])

# ---- group: Sample Toggle
pt_13 = Point(<point referenced from the Rhino model>)

# ---- group: Sample Others
pt_14 = Point([<point referenced from the Rhino model> x3])

# ---- group: Color Space Calibration sliders / ref color pop area
crv_4 = Curve([<curve referenced from the Rhino model> x2])  # disabled

# ---- group: Sample Toggle
pt_15 = Point(<point referenced from the Rhino model>)

# ---- group: slider position ref pts
# Slider Sampling
pt_16 = Point([<point referenced from the Rhino model> x2])

# Slider 2 Sampling
pt_17 = Point([<point referenced from the Rhino model> x2])

# ---- group: Color Space Calibration sliders / ref color pop area
crv_5 = Curve(<curve referenced from the Rhino model>)  # disabled

crv_6 = Curve(<curve referenced from the Rhino model>)  # disabled

# ---- group: live feed of webcam
data = Data(video_stream)

# ---- group: toggle 1 position ref pt
pt_18 = Point(<point referenced from the Rhino model>)

# ---- group: Sample Other
pt_19 = Point(<point referenced from the Rhino model>)

# ---- group: Sample Toggle
pt_20 = Point(<point referenced from the Rhino model>)

# ---- group: Color Space Calibration sliders / ref color pop area
crv_7 = Curve(<curve referenced from the Rhino model>)  # disabled

# ----
pdecon_8 = Deconstruct(Point=pt_20)  # -> XComponent, YComponent, ZComponent
pdecon_9 = Deconstruct(Point=pt_19)  # -> XComponent, YComponent, ZComponent
split_2 = TextSplit(Text=panel_4, Separators=",")

# ---- group: all color code quarts (with rotation)
panel_11 = Panel("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")

# ----
preview = CustomPreview(Geometry=pline, Shader=ColourSwatch(SwatchColor=RGB(255, 0, 230)))
pdecon_10 = Deconstruct(Point=pt_13)  # -> XComponent, YComponent, ZComponent
pdecon_11 = Deconstruct(Point=pt_12)  # -> XComponent, YComponent, ZComponent
pdecon_12 = Deconstruct(Point=pt_15)  # -> XComponent, YComponent, ZComponent
pdecon_13 = Deconstruct(Point=pt_14)  # -> XComponent, YComponent, ZComponent
merge_2 = Merge(Data1=int, Data2=int_2, Data3=int_3, Data4=int_4, Data5=int_5, Data6=int_6)

# ---- group: manual text city
panel_12 = Panel("""g,g,g,r,g,g,g,g,r,g,g,g,g,r,g,g
g,g,g,r,g,g,g,g,r,g,g,g,g,r,g,g
g,g,g,r,g,g,g,g,r,g,g,g,g,r,g,g
r,r,r,r,r,r,r,r,r,r,r,r,r,r,r,r
g,g,g,r,0,0,0,0,r,1,1,1,2,r,g,g
g,g,g,r,0,g,g,0,r,1,g,g,2,r,g,g
g,g,g,r,0,g,g,0,r,1,g,g,2,r,g,g
g,g,g,r,0,0,0,0,r,1,1,1,2,r,g,g
r,r,r,r,r,r,r,r,r,r,r,r,r,r,r,r
g,g,g,r,3,3,3,3,r,4,4,4,5,r,g,g
g,g,g,r,3,g,g,3,r,4,g,g,5,r,g,g
g,g,g,r,3,g,g,3,r,4,g,g,5,r,g,g
g,g,g,r,3,3,3,3,r,4,4,4,5,r,g,g
r,r,r,r,r,r,r,r,r,r,r,r,r,r,r,r
g,g,g,r,g,g,g,g,r,g,g,g,g,r,g,g
g,g,g,r,g,g,g,g,r,g,g,g,g,r,g,g""")

panel_13 = Panel("""b,r,b,b,b,b,r,b,b,b,b,r,b,b,b,b
r,r,r,r,r,r,r,r,r,r,r,r,r,r,r,r
b,r,b,b,b,b,r,b,b,b,b,r,b,b,b,b
b,r,b,g,g,b,r,b,g,g,b,r,b,g,g,b
b,r,b,g,g,b,r,b,g,g,b,r,b,g,g,b
b,r,b,b,b,b,r,b,b,b,b,r,b,b,b,b
r,r,r,r,r,r,r,r,r,r,r,r,r,r,r,r
b,r,b,b,b,b,r,4,4,4,4,r,3,3,3,3
b,r,b,g,g,b,r,4,g,g,4,r,3,g,g,3
b,r,b,g,g,b,r,4,g,g,4,r,3,g,g,3
b,r,b,b,b,b,r,4,4,4,4,r,3,3,3,3
r,r,r,r,r,r,r,r,r,r,r,r,r,r,r,r
b,r,2,2,2,2,r,1,1,1,1,r,0,0,0,0
b,r,2,g,g,2,r,1,g,g,1,r,0,g,g,0
b,r,2,g,g,2,r,1,g,g,1,r,0,g,g,0
b,r,2,2,2,2,r,1,1,1,1,r,0,0,0,0""")

# ---- group: startFlag
startflag = Button()
panel_14 = Panel(startflag)

# ----
pdecon_14 = Deconstruct(Point=pt_20)  # -> XComponent, YComponent, ZComponent
pdecon_15 = Deconstruct(Point=pt_19)  # -> XComponent, YComponent, ZComponent
frgb_7 = ColourRGBF(Alpha=1, Red=pdecon_8.XComponent, Green=pdecon_8.YComponent, Blue=pdecon_8.ZComponent)
frgb_8 = ColourRGBF(Alpha=1, Red=pdecon_9.XComponent, Green=pdecon_9.YComponent, Blue=pdecon_9.ZComponent)
multiplication = Multiplication(A=number_slider_3, B=2)
merge_3 = Merge(Data1=_0_reslux, Data2=_1_resmed, Data3=_2_resmu, Data4=_3_comhq, Data5=_4_commed, Data6=_5_rescw)
multiplication_2 = Multiplication(A=number_slider_2, B=2)
frgb_9 = ColourRGBF(Alpha=1, Red=pdecon_10.XComponent, Green=pdecon_10.YComponent, Blue=pdecon_10.ZComponent)
frgb_10 = ColourRGBF(Alpha=1, Red=pdecon_11.XComponent, Green=pdecon_11.YComponent, Blue=pdecon_11.ZComponent)
frgb_11 = ColourRGBF(Alpha=1, Red=pdecon_12.XComponent, Green=pdecon_12.YComponent, Blue=pdecon_12.ZComponent)
frgb_12 = ColourRGBF(Alpha=1, Red=pdecon_13.XComponent, Green=pdecon_13.YComponent, Blue=pdecon_13.ZComponent)

# ---- group: All Colors IDs
int_7 = Integer(merge_2)

# ----
frgb_13 = ColourRGBF(Alpha=1, Red=pdecon_14.XComponent, Green=pdecon_14.YComponent, Blue=pdecon_14.ZComponent)
frgb_14 = ColourRGBF(Alpha=1, Red=pdecon_15.XComponent, Green=pdecon_15.YComponent, Blue=pdecon_15.ZComponent)

# ---- group: all rotations reference
txt_3 = Text(split_2)

# ----
merge_4 = Merge(Data1=frgb_7, Data2=frgb_8)

# ---- group: webcam stream
data_2 = Data(data)

bmp = BitmapToModify(data_2)

bmp_2 = BitmapToModify(data_2)

bmp_3 = BitmapToModify(data_2)

bmp_4 = BitmapToModify(data_2)

# Toggle 1
bmp_5 = BitmapToModify(data_2)

# ----
sample = BitmapSampler(BitmapToModify=bmp_5, PointToSample=pt_18, BitmapToModify_2=bmp_5, PointToSample_2=pt_18, bitmap_filter=0)  # -> SampledImageData, SampledImageData_2
sample_2 = BitmapSampler(BitmapToModify=bmp, PointToSample=pt_9, BitmapToModify_2=bmp, PointToSample_2=pt_9, bitmap_filter=0)  # -> SampledImageData, SampledImageData_2
merge_5 = Merge(Data1=frgb_11, Data2=frgb_12)
merge_6 = Merge(Data1=frgb_9, Data2=frgb_10)
col_3 = Colour(sample.SampledImageData_2)
col_4 = Colour(sample_2.SampledImageData_2)
pline_2 = PolyLine(Vertices=pt_16, Closed=False)  # -> reparameterize(Polyline)
pline_3 = PolyLine(Vertices=pt_17, Closed=False)  # -> reparameterize(Polyline)
merge_7 = Merge(Data1=frgb_13, Data2=frgb_14)
perspective = Perspective(pt=pt_8, int_2=multiplication_2, int=multiplication)
panel_15 = Panel(txt_3)

# ---- group: tab
panel_16 = Panel("\t")

# ----
split_3 = TextSplit(Text=panel_11, Separators=panel_16)
divide = DivideCurve(Curve=crv_3, Count=Slider(1, range=1..99), Kinks=False)  # -> Points, Tangents, Parameters
divide_2 = DivideCurve(Curve=pline_2, Count=Slider(14, range=9..99), Kinks=False)  # -> Points, Tangents, Parameters
divide_3 = DivideCurve(Curve=pline_3, Count=Slider(21, range=9..99), Kinks=False)  # -> Points, Tangents, Parameters

# ---- group: All Manual Reference Colors
col_5 = Colour(merge_4)

# ---- group: gridExtent_y
int_8 = Integer(gridextent_y)

# ---- group: floor num for each type
int_9 = Integer(merge_3)

# ---- group: gridExtent_x
int_10 = Integer(gridextent_x)

# ---- group: toggle1
bool = Boolean(toggle1)

# ---- group: toggle2
bool_2 = Boolean(toggle2)

# ---- group: toggle3
bool_3 = Boolean(toggle3)

# ---- group: toggle4
bool_4 = Boolean(toggle4)

# ---- group: All Manual Reference Colors
col_6 = Colour(merge_6)

col_7 = Colour(merge_5)

# ----
preview_2 = CustomPreview(Geometry=pline_2, Shader=ColourSwatch(SwatchColor=RGB(255, 0, 230)))
preview_3 = CustomPreview(Geometry=pline_3, Shader=ColourSwatch(SwatchColor=RGB(255, 0, 230)))

# ---- group: All Manual Reference Colors
col_8 = Colour(merge_7)

# ---- group: manual color space calibration for grid / Sample White
pt_21 = Point(<point referenced from the Rhino model>)

# ---- group: manual color space calibration for grid / Sample Black
pt_22 = Point(<point referenced from the Rhino model>)

# ---- group: manual color space calibration for grid / Sample Yellow
pt_23 = Point(<point referenced from the Rhino model>)  # disabled

# ---- group: manual color space calibration for grid / Sample Blue
pt_24 = Point(<point referenced from the Rhino model>)  # disabled

# ---- group: manual color space calibration for grid / Sample Green
pt_25 = Point(<point referenced from the Rhino model>)  # disabled

# ---- group: manual color space calibration for grid / Sample Red
pt_26 = Point(<point referenced from the Rhino model>)

# ---- group: all color quarts reference
txt_4 = Text(split_3)

# ----
lng = ListLength(List=txt_4)

# ---- group: Position Calibration / CityMatrix CV Calibration
mesh_9 = MeshFromImage(Bmp=data_2, Sx=Domain(0, 1), Sy=Domain(0, 1), Z=0, C=True)  # disabled

# ----
pdecon_16 = Deconstruct(Point=pt_21)  # -> XComponent, YComponent, ZComponent
pdecon_17 = Deconstruct(Point=pt_22)  # -> XComponent, YComponent, ZComponent
pdecon_18 = Deconstruct(Point=pt_26)  # -> XComponent, YComponent, ZComponent
pdecon_19 = Deconstruct(Point=pt_23)  # -> XComponent, YComponent, ZComponent
pdecon_20 = Deconstruct(Point=pt_24)  # -> XComponent, YComponent, ZComponent
pdecon_21 = Deconstruct(Point=pt_25)  # -> XComponent, YComponent, ZComponent
# Decode Dock ID
cp = ClosestPoint(Point=col_4, Cloud=col_2)  # -> ClosestPoint, CPIndex, Distance

# ---- group: x
series = Series(Start=0, Step=1, Count=number_slider_2)

# ---- group: y
series_2 = Series(Start=0, Step=1, Count=number_slider_3)

# ---- group: slider and toggle ref colors
col_9 = Colour(col_5)

col_10 = Colour(col_6)

col_11 = Colour(col_7)

# ----
division = Division(A=lng, B="4")

# ---- group: webcam stream
bmp_6 = BitmapToModify(data_2)

# ---- group: slider sample pts
pt_27 = Point(divide.Points)

# ----
line = LineSDL(Start=pt_27, Direction=Vector(1, 0, 0), Length=0.005)
frgb_15 = ColourRGBF(Alpha=1, Red=pdecon_16.XComponent, Green=pdecon_16.YComponent, Blue=pdecon_16.ZComponent)
frgb_16 = ColourRGBF(Alpha=1, Red=pdecon_17.XComponent, Green=pdecon_17.YComponent, Blue=pdecon_17.ZComponent)
frgb_17 = ColourRGBF(Alpha=1, Red=pdecon_18.XComponent, Green=pdecon_18.YComponent, Blue=pdecon_18.ZComponent)
frgb_18 = ColourRGBF(Alpha=1, Red=pdecon_19.XComponent, Green=pdecon_19.YComponent, Blue=pdecon_19.ZComponent)
frgb_19 = ColourRGBF(Alpha=1, Red=pdecon_20.XComponent, Green=pdecon_20.YComponent, Blue=pdecon_20.ZComponent)
frgb_20 = ColourRGBF(Alpha=1, Red=pdecon_21.XComponent, Green=pdecon_21.YComponent, Blue=pdecon_21.ZComponent)

# ---- group: slider sample pts
pt_28 = Point(divide_2.Points)

# ----
line_2 = LineSDL(Start=pt_28, Direction=Vector(1, 0, 0), Length=0.005)

# ---- group: slider sample pts
pt_29 = Point(divide_3.Points)

# ----
line_3 = LineSDL(Start=pt_29, Direction=Vector(1, 0, 0), Length=0.005)

# ---- group: slider and toggle ref colors
col_12 = Colour(col_8)

# ----
cp_2 = ClosestPoint(Point=graft(col_3), Cloud=col_12)  # -> ClosestPoint, CPIndex, Distance
pshift = ShiftPaths(Data=cp_2.CPIndex, Offset=-1)

# ---- group: color ID
int_11 = Integer(pshift)

# ----
item = ListItem(List=int_7, Index=cp.CPIndex, Wrap=False)
sample_3 = BitmapSampler(BitmapToModify=bmp_2, PointToSample=pt_27, BitmapToModify_2=bmp_2, PointToSample_2=pt_27, bitmap_filter=0)  # -> SampledImageData, SampledImageData_2
panel_17 = Panel(txt_4)
sample_4 = BitmapSampler(BitmapToModify=bmp_3, PointToSample=pt_28, BitmapToModify_2=bmp_3, PointToSample_2=pt_28, bitmap_filter=0)  # -> SampledImageData, SampledImageData_2
sample_5 = BitmapSampler(BitmapToModify=bmp_4, PointToSample=pt_29, BitmapToModify_2=bmp_4, PointToSample_2=pt_29, bitmap_filter=0)  # -> SampledImageData, SampledImageData_2
multiplication_3 = Multiplication(A=series_2, B=4)
series_3 = Series(Start=0, Step=1, Count=division)
multiplication_4 = Multiplication(A=series, B=2)
merge_8 = Merge(Data1=frgb_15, Data2=frgb_16, Data3=frgb_17, Data4=frgb_18, Data5=frgb_19, Data6=frgb_20)
equals = Equality(FirstNumber=int_11, SecondNumber="0")  # -> Equality, Inequality

# ---- group: keystoned grid pts
pt_30 = Point(perspective)

# ---- group: color code of each smaple pt
int_12 = Integer(item)

# ----
rev = ReverseList(List=int_12)
txt_5 = Text(rev)
join_2 = TextJoin(Text=txt_5, Join=",")
pshift_2 = ShiftPaths(Data=series_3, Offset=-1)
multiplication_5 = Multiplication(A=division, B="4")
pshift_3 = ShiftPaths(Data=sample_3.SampledImageData_2, Offset=-1)
pshift_4 = ShiftPaths(Data=sample_4.SampledImageData_2, Offset=-1)
pshift_5 = ShiftPaths(Data=sample_5.SampledImageData_2, Offset=-1)
multiplication_6 = Multiplication(A=multiplication_3, B=number_slider_2)
pshift_6 = ShiftPaths(Data=pt_30, Offset=-1)

# ---- group: all sample pts
pt_31 = Point(pshift_6)

# ----
sample_6 = BitmapSampler(BitmapToModify=bmp_6, PointToSample=pt_31, BitmapToModify_2=bmp_6, PointToSample_2=pt_31, bitmap_filter=0)  # -> SampledImageData, SampledImageData_2

# ---- group: All Manual Reference Colors
col_13 = Colour(merge_8)

# ---- group: toggle 1 value
bool_5 = Boolean(equals.Equality)

# ---- group: color code quart text data
txt_6 = Text(join_2)

# ----
panel_18 = Panel(txt_6)

# ---- group: sampled pts color
col_14 = Colour(pshift_3)

# ----
cp_3 = ClosestPoint(Point=graft(col_14), Cloud=col_9)  # -> ClosestPoint, CPIndex, Distance
pshift_7 = ShiftPaths(Data=cp_3.CPIndex, Offset=-1)

# ---- group: color IDs
int_13 = Integer(pshift_7)

# ----
dispatch = Dispatch(List=pt_27, DispatchPattern=int_13)  # -> ListA, ListB
pdecon_22 = Deconstruct(Point=dispatch.ListB)  # -> XComponent, YComponent, ZComponent
lng_2 = ListLength(List=dispatch.ListB)
ma = MassAddition(Input=pdecon_22.XComponent)  # -> Result, PartialResults
ma_2 = MassAddition(Input=pdecon_22.YComponent)  # -> Result, PartialResults
division_2 = Division(A=ma.Result, B=lng_2)
division_3 = Division(A=ma_2.Result, B=lng_2)
pt_32 = ConstructPoint(XCoordinate=division_2, YCoordinate=division_3, ZCoordinate=0)

# ---- group: average slide block pt
pt_33 = Point(pt_32)

# ----
crv_cp = CurveClosestPoint(Point=pt_33, Curve=crv_3)  # -> Point, Parameter, Distance
repeat = RepeatData(Data=pshift_2, Length=multiplication_5)

# ---- group: sampled pts color
col_15 = Colour(pshift_4)

# ----
cp_4 = ClosestPoint(Point=graft(col_15), Cloud=col_10)  # -> ClosestPoint, CPIndex, Distance
pshift_8 = ShiftPaths(Data=cp_4.CPIndex, Offset=-1)

# ---- group: color IDs
int_14 = Integer(pshift_8)

# ----
dispatch_2 = Dispatch(List=pt_28, DispatchPattern=int_14)  # -> ListA, ListB
pdecon_23 = Deconstruct(Point=dispatch_2.ListB)  # -> XComponent, YComponent, ZComponent
lng_3 = ListLength(List=dispatch_2.ListB)
ma_3 = MassAddition(Input=pdecon_23.XComponent)  # -> Result, PartialResults
ma_4 = MassAddition(Input=pdecon_23.YComponent)  # -> Result, PartialResults
division_4 = Division(A=ma_3.Result, B=lng_3)
division_5 = Division(A=ma_4.Result, B=lng_3)
pt_34 = ConstructPoint(XCoordinate=division_4, YCoordinate=division_5, ZCoordinate=0)

# ---- group: average slide block pt
pt_35 = Point(pt_34)

# ----
crv_cp_2 = CurveClosestPoint(Point=pt_35, Curve=pline_2)  # -> Point, Parameter, Distance

# ---- group: sampled pts color
col_16 = Colour(pshift_5)

# ----
# Decode Slider Value
cp_5 = ClosestPoint(Point=graft(col_16), Cloud=col_11)  # -> ClosestPoint, CPIndex, Distance
pshift_9 = ShiftPaths(Data=cp_5.CPIndex, Offset=-1)

# ---- group: color IDs
int_15 = Integer(pshift_9)

# ----
dispatch_3 = Dispatch(List=pt_29, DispatchPattern=int_15)  # -> ListA, ListB
pdecon_24 = Deconstruct(Point=dispatch_3.ListB)  # -> XComponent, YComponent, ZComponent
lng_4 = ListLength(List=dispatch_3.ListB)
ma_5 = MassAddition(Input=pdecon_24.XComponent)  # -> Result, PartialResults
ma_6 = MassAddition(Input=pdecon_24.YComponent)  # -> Result, PartialResults
division_6 = Division(A=ma_5.Result, B=lng_4)
division_7 = Division(A=ma_6.Result, B=lng_4)
pt_36 = ConstructPoint(XCoordinate=division_6, YCoordinate=division_7, ZCoordinate=0)

# ---- group: average slide block pt
pt_37 = Point(pt_36)

# ----
crv_cp_3 = CurveClosestPoint(Point=pt_37, Curve=pline_3)  # -> Point, Parameter, Distance
addition = Addition(A=multiplication_4, B=graft(multiplication_6))

# ---- group: module id data (manual)
txt_7 = Text(panel_13)

# ----
pshift_10 = ShiftPaths(Data=crv_cp.Parameter, Offset=-1)
pshift_11 = ShiftPaths(Data=crv_cp_2.Parameter, Offset=-1)
pshift_12 = ShiftPaths(Data=crv_cp_3.Parameter, Offset=-1)
pshift_13 = ShiftPaths(Data=repeat, Offset=-1)

# ---- group: all color quart ids reference
int_16 = Integer(pshift_13)

# ---- group: all sample color
col_17 = Colour(sample_6.SampledImageData_2)

# ----
pshift_14 = ShiftPaths(Data=addition, Offset=-1)

# ---- group: all ref colors
col_18 = Colour(col_13)

# ----
multiplication_7 = Multiplication(A=set2, B=2)
multiplication_8 = Multiplication(A=number_slider_2, B=2)
keysearch = KeyValueSearch(Keys=txt_4, Values=panel_15, Search=graft(txt_6))
keysearch_2 = KeyValueSearch(Keys=txt_4, Values=int_16, Search=graft(txt_6))
item_2 = ListItem(List=col_9, Index=int_13, Wrap=True)
panel_19 = Panel(int_16)
item_3 = ListItem(List=col_10, Index=int_14, Wrap=True)
item_4 = ListItem(List=col_11, Index=int_15, Wrap=True)
addition_2 = Addition(A=set1, B=multiplication_7)

# ---- group: slider read 0-1
num_2 = Number(pshift_10)

# ----
panel_20 = Panel(num_2)

# ---- group: slider read 0-1
num_3 = Number(pshift_11)

# ----
panel_21 = Panel(num_3)

# ---- group: slider read 0-1
num_4 = Number(pshift_12)

# ----
panel_22 = Panel(num_4)
addition_3 = Addition(A=pshift_14, B=multiplication_8)
preview_4 = CustomPreview(Geometry=pt_27, Shader=item_2)
addition_4 = Addition(A=pshift_14, B=1)
preview_5 = CustomPreview(Geometry=pt_28, Shader=item_3)
preview_6 = CustomPreview(Geometry=pt_29, Shader=item_4)
nullrep = ReplaceNulls(Items=keysearch, Replacements="0")  # -> Items, Count
nullrep_2 = ReplaceNulls(Items=num_2, Replacements=0)  # -> Items, Count
nullrep_3 = ReplaceNulls(Items=keysearch_2, Replacements="-1")  # -> Items, Count
nullrep_4 = ReplaceNulls(Items=num_3, Replacements=0)  # -> Items, Count
nullrep_5 = ReplaceNulls(Items=num_4, Replacements=0)  # -> Items, Count
panel_23 = Panel(addition_2)

# ---- group: Color Space Calibration sliders / all ref colors
col_19 = Colour(col_12)  # disabled

# ----
panel_24 = Panel("""2
1
1
1
1
1""")
addition_5 = Addition(A=addition_3, B=1)
pshift_15 = ShiftPaths(Data=nullrep_2.Items, Offset=-1)
item_5 = ListItem(List=pshift_15, Index=2, Wrap=False)
item_6 = ListItem(List=pshift_15, Index=3, Wrap=False)
item_7 = ListItem(List=pshift_15, Index=0, Wrap=False)
item_8 = ListItem(List=pshift_15, Index=1, Wrap=False)
item_9 = ListItem(List=pshift_15, Index=4, Wrap=False)

# ---- group: max id
int_17 = Integer("9")

# ----
pshift_16 = ShiftPaths(Data=nullrep_3.Items, Offset=-1)

# ---- group: slider1
num_5 = Number(nullrep_4.Items)

# ---- group: slider2
num_6 = Number(nullrep_5.Items)

# ---- group: 3LevelSlider1
num_7 = Number(item_7)

# ---- group: 3LevelSlider2
num_8 = Number(item_8)

# ---- group: 3LevelSlider3
num_9 = Number(item_5)

# ---- group: 3LevelSlider4
num_10 = Number(item_6)

# ---- group: 3LevelSlider5
num_11 = Number(item_9)

# ----
cp_6 = ClosestPoint(Point=col_17, Cloud=col_18)  # -> ClosestPoint, CPIndex, Distance
pshift_17 = ShiftPaths(Data=nullrep.Items, Offset=-1)
set1_2 = Integer(panel_6)
set2_2 = Integer(panel_7)

# ---- group: set number
integer = Integer(panel_23)

# ---- group: Color Space Calibration sliders / all ref colors
col_20 = Colour(col_9)  # disabled

# ---- group: max id
int_18 = Integer("7")

# ----
panel_25 = Panel("""1
1
1
1
1
1""")

# ---- group: Color Space Calibration sliders / all ref colors
col_21 = Colour(col_11)  # disabled

# ---- group: all sample color
col_22 = Colour(sample_6.SampledImageData_2)  # disabled

# ---- group: all ref colors
col_23 = Colour(col_18)  # disabled

# ---- group: Color Space Calibration sliders / all ref colors
col_24 = Colour(col_10)  # disabled

# ----
item_10 = ListItem(List=int_7, Index=cp_6.CPIndex, Wrap=False)
panel_26 = Panel("""10
10
10
10
10
10""")

# ---- group: color calibration dock / all ref colors
col_25 = Colour(col_2)  # disabled

# ---- group: dock id
int_19 = Integer(pshift_16)

# ---- group: dock rotation
int_20 = Integer("0")

# ---- group: color code of each smaple pt
int_21 = Integer(item_10)

# ---- group: Color Space Calibration sliders / all ref colors
col_26 = Colour(col_21)  # disabled

# ----
panel_27 = Panel("""15
15
15
15
15
15""")

# ---- group: sample pts
item_11 = ListItem(List=pt_31, Index=addition_3, Wrap=False)
item_12 = ListItem(List=pt_31, Index=pshift_14, Wrap=False)
item_13 = ListItem(List=pt_31, Index=addition_5, Wrap=False)
item_14 = ListItem(List=pt_31, Index=addition_4, Wrap=False)

# ----
repeat_2 = RepeatData(Data=Slider(0, range=0..360), Length=256)
panel_28 = Panel("""30
30
30
30
30
30""")

# ---- group: all 0
pshift_18 = ShiftPaths(Data=repeat_2, Offset=-1)

# ----
panel_29 = Panel("""29
30
30
30
30
30""")

# ---- group: color calibration dock / all ref colors
col_27 = Colour(col_25)  # disabled

# ---- group: floor height
panel_30 = Panel("3.5")

# ---- group: x
int_22 = Integer([0, 1, 2, 3, 4, 5, 6, 7, 8, 9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])

# ---- group: y
int_23 = Integer([0, 0, 0, 0, 0, 0, 0, 0, 0, 0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])

# ---- group: rotation
int_24 = Integer(pshift_18)

# ----
panel_31 = Panel(int_22)
panel_32 = Panel(int_23)
panel_33 = Panel(int_24)

# ---- group: color codes
item_15 = ListItem(List=int_21, Index=pshift_14, Wrap=False)
item_16 = ListItem(List=int_21, Index=addition_3, Wrap=False)
item_17 = ListItem(List=int_21, Index=addition_5, Wrap=False)
item_18 = ListItem(List=int_21, Index=addition_4, Wrap=False)

# ----
# Densities
# Initial
panel_34 = Panel("""10
25
5
15
5
5""")
nullrep_6 = ReplaceNulls(Items=int_20, Replacements=0)  # -> Items, Count
nullrep_7 = ReplaceNulls(Items=bool_5, Replacements=False)  # -> Items, Count

# ---- group: 3LevelSlider5
num_12 = Number(num_11)

# ---- group: 3LevelSlider4
num_13 = Number(num_10)

# ---- group: 3LevelSlider3
num_14 = Number(num_9)

# ---- group: 3LevelSlider1
num_15 = Number(num_7)

# ---- group: 3LevelSlider2
num_16 = Number(num_8)

# ----
merge_9 = Merge(Data1=graft(item_15), Data2=graft(item_16), Data3=graft(item_17), Data4=graft(item_18))

# ---- group: color code quarts
int_25 = Integer(merge_9)

# ----
rev_2 = ReverseList(List=int_25)
txt_8 = Text(rev_2)
join_3 = TextJoin(Text=txt_8, Join=",")
pshift_19 = ShiftPaths(Data=join_3, Offset=-1)

# ---- group: color code quart texts data
txt_9 = Text(pshift_19)

# ----
panel_35 = Panel(txt_9)
keysearch_3 = KeyValueSearch(Keys=txt_4, Values=panel_15, Search=graft(txt_9))
nullrep_8 = ReplaceNulls(Items=keysearch_3, Replacements="0")  # -> Items, Count
keysearch_4 = KeyValueSearch(Keys=txt_4, Values=int_16, Search=graft(txt_9))
pshift_20 = ShiftPaths(Data=nullrep_8.Items, Offset=-1)
nullrep_9 = ReplaceNulls(Items=keysearch_4, Replacements="-1")  # -> Items, Count
pshift_21 = ShiftPaths(Data=pshift_20, Offset=-1)
pshift_22 = ShiftPaths(Data=nullrep_9.Items, Offset=-1)
pshift_23 = ShiftPaths(Data=pshift_22, Offset=-1)

# ---- group: all rotation data
int_26 = Integer(pshift_21)

# ---- group: all piece ids raw
int_27 = Integer(pshift_23)

# ----
limitmaxid = LimitMaxID(int_2=int_27, int=int_17)

# ---- group: all piece ids
int_28 = Integer(limitmaxid)

# ---- group: rotation
int_29 = Integer(int_26)

# ----
panel_36 = Panel(int_28)

# ---- group: module id (CV)
int_30 = Integer(int_28)

# ----
panel_37 = Panel(int_30)
nullrep_10 = ReplaceNulls(Items=int_19, Replacements=-1)  # -> Items, Count
nullrep_11 = ReplaceNulls(Items=num_5, Replacements=0)  # -> Items, Count

# ---- group: dock rotation
int_31 = Integer(nullrep_6.Items)

# ---- group: scale control
num_17 = Number(1000)
division_8 = Division(A=list, B=num_17)

# ----
panel_38 = Panel("""r,r,r,r,r,r,r,r,r,r,r,r,r,r,r,r
r,0,0,0,r,0,0,0,r,1,1,1,r,2,2,2
r,0,g,0,r,0,g,0,r,1,e,1,r,2,e,2
r,0,0,0,r,0,0,0,r,1,1,1,r,2,2,2
r,r,r,r,r,r,r,r,r,r,r,r,r,r,r,r
r,0,0,0,r,0,0,0,r,1,1,1,r,2,2,2
r,0,g,0,r,0,g,0,r,1,e,1,r,2,e,2
r,0,0,0,r,0,0,0,r,1,1,1,r,2,2,2
r,r,r,r,r,r,r,r,r,r,r,r,r,r,r,r
r,3,3,3,r,3,3,3,r,4,4,4,r,5,5,5
r,3,e,3,r,3,e,3,r,4,g,4,r,5,g,5
r,3,3,3,r,3,3,3,r,4,4,4,r,5,5,5
r,r,r,r,r,r,r,r,r,r,r,r,r,r,r,r
r,3,3,3,r,3,3,3,r,4,4,4,r,5,5,5
r,3,e,3,r,3,e,3,r,4,g,4,r,5,g,5
r,3,3,3,r,3,3,3,r,4,4,4,r,5,5,5""")
panel_39 = Panel("""b,r,b,b,b,b,r,b,b,b,b,r,b,b,b,b
r,r,r,r,r,r,r,r,r,r,r,r,r,r,r,r
b,r,b,b,b,b,r,b,b,b,b,r,b,b,b,b
b,r,b,g,g,b,r,b,g,g,b,r,b,g,g,b
b,r,b,g,g,b,r,b,g,g,b,r,b,g,g,b
b,r,b,b,b,b,r,b,b,b,b,r,b,b,b,b
r,r,r,r,r,r,r,r,r,r,r,r,r,r,r,r
b,r,b,b,b,b,r,4,4,4,4,r,3,3,3,3
b,r,b,g,g,b,r,4,g,g,4,r,3,g,g,3
b,r,b,g,g,b,r,4,g,g,4,r,3,g,g,3
b,r,b,b,b,b,r,4,4,4,4,r,3,3,3,3
r,r,r,r,r,r,r,r,r,r,r,r,r,r,r,r
b,r,2,2,2,2,r,1,1,1,1,r,0,0,0,0
b,r,2,g,g,2,r,1,g,g,1,r,0,g,g,0
b,r,2,g,g,2,r,1,g,g,1,r,0,g,g,0
b,r,2,2,2,2,r,1,1,1,1,r,0,0,0,0""")
# Building Heights
panel_40 = Panel("""e,e,e,e,g,g,g,g,0,0,1,2,3,3,4,5
e,e,e,e,g,g,g,g,0,0,1,2,3,3,4,5
e,e,e,e,g,g,g,g,0,0,1,2,3,3,4,5
e,e,e,e,g,g,g,g,0,0,1,2,3,3,4,5
0,0,1,2,3,3,4,5,e,e,e,e,g,g,g,g
0,0,1,2,3,3,4,5,e,e,e,e,g,g,g,g
0,0,1,2,3,3,4,5,e,e,e,e,g,g,g,g
0,0,1,2,3,3,4,5,e,e,e,e,g,g,g,g
e,e,e,e,g,g,g,g,0,0,1,2,3,3,4,5
e,e,e,e,g,g,g,g,0,0,1,2,3,3,4,5
e,e,e,e,g,g,g,g,0,0,1,2,3,3,4,5
e,e,e,e,g,g,g,g,0,0,1,2,3,3,4,5
0,0,1,2,3,3,4,5,e,e,e,e,g,g,g,g
0,0,1,2,3,3,4,5,e,e,e,e,g,g,g,g
0,0,1,2,3,3,4,5,e,e,e,e,g,g,g,g
0,0,1,2,3,3,4,5,e,e,e,e,g,g,g,g""")
python = PythonScript(opt=division_8, grid_s=panel_38, grid_r=panel_39, grid_l=panel_40)  # -> out, grid
# ---------- python: Python ----------
if opt > 1:
    grid = grid_l
elif opt < 1:
    grid = grid_s
else:
    grid = grid_r
# ---------- end python ----------

# ---- group: manual text city
panel_41 = Panel(python.grid)

# ---- group: module id data (manual)
txt_10 = Text(panel_41)

# ----
rep = ReplaceText(Text=txt_10, Find="e", Replace="-1", RecursiveReplace=False)
rep_2 = ReplaceText(Text=rep, Find="r", Replace="6", RecursiveReplace=False)
rep_3 = ReplaceText(Text=rep_2, Find="g", Replace="7", RecursiveReplace=False)
rep_4 = ReplaceText(Text=rep_3, Find="b", Replace="0", RecursiveReplace=False)
panel_42 = Panel(rep_4)

# ---- group: module id data
txt_11 = Text(rep_4)

# ----
split_4 = TextSplit(Text=txt_11)
cull = CullPattern(List=split_4, CullPattern=[True, False])
join_4 = TextJoin(Text=cull, Join=",")
split_5 = TextSplit(Text=join_4, Separators=",")
pshift_24 = ShiftPaths(Data=split_5, Offset=-2)

# ---- group: all piece ids raw
int_32 = Integer(pshift_24)

# ----
limitmaxid_2 = LimitMaxID(int_2=int_32, int=int_18)

# ---- group: module id (manual)
# Grid Base Data
int_33 = Integer(limitmaxid_2)

# ----
panel_43 = Panel(int_33)
nullrep_12 = ReplaceNulls(Items=num_6, Replacements=0)  # -> Items, Count
# CityMatrix
# 
# "Ryan" Yan Zhang <ryanz@mit.edu>
# MIT Media Lab, Changing Place Group
# September. 2016
# Densities
# Running
panel_44 = Panel("""30
1
1
1
1
1""")

# ---- group: module id (CV partial masked to manual)
int_34 = Integer(int_30)

# ---- group: module id (manual)
int_35 = Integer(int_33)

# ---- group: module id (CV)
int_36 = Integer(int_30)

# ---- group: toggle1
bool_6 = Boolean(nullrep_7.Items)

# ---- group: temp overide
panel_45 = Panel("1.0")

# ---- group: dockID
int_37 = Integer(nullrep_10.Items)

# ---- group: slider1
num_18 = Number(nullrep_11.Items)

# ---- group: slider2
num_19 = Number(nullrep_12.Items)

# ----
filter = StreamFilter(Gate=list_2, Stream0="1.0", Stream1=num_12)
filter_2 = StreamFilter(Gate=list_2, Stream0="1.0", Stream1=num_13)
filter_3 = StreamFilter(Gate=list_2, Stream0="1.0", Stream1=num_14)
filter_4 = StreamFilter(Gate=list_2, Stream0="1.0", Stream1=num_16)
filter_5 = StreamFilter(Gate=list_2, Stream0="1.0", Stream1=num_15)
filter_6 = StreamFilter(Gate=list_2, Stream0="0", Stream1=int_31)
filter_7 = StreamFilter(Gate=list_2, Stream0=Toggle(True), Stream1=bool_6)
filter_8 = StreamFilter(Gate=list_2, Stream0=int_35, Stream1=int_36)
filter_9 = StreamFilter(Gate=list_2, Stream0=slider1, Stream1=num_18)
filter_10 = StreamFilter(Gate=list_2, Stream0="-1", Stream1=int_37)
filter_11 = StreamFilter(Gate=list_2, Stream0=slider2, Stream1=num_19)

# ---- group: gridExtent_x
int_38 = Integer(int_10)

# ---- group: gridExtent_y
int_39 = Integer(int_8)

# ---- group: module id
int_40 = Integer(filter_8)

# ---- group: x
int_41 = Integer(int_22)

# ---- group: y
int_42 = Integer(int_23)

# ---- group: rotation
int_43 = Integer(int_24)

# ---- group: slider2
num_20 = Number(filter_11)

# ---- group: dockID
int_44 = Integer(filter_10)

int_45 = Integer(int_44)

# ---- group: toggle1
bool_7 = Boolean(panel_45)

# ---- group: slider1
num_21 = Number(filter_9)

num_22 = Number(num_21)

# ----
record_density_slider_set = RecordDensitySliderSet(int=int_45, num=num_22, integer=integer, set1=set1_2, set2=set2_2)

# ---- group: floor num for each type
int_46 = Integer(record_density_slider_set)

# ----
panel_46 = Panel(int_46)

multiplication_9 = Multiplication(A=int_46, B=panel_30)

# ---- group: building height for each type
num_23 = Number(multiplication_9)

# ----
nullrep_13 = ReplaceNulls(Items=int_46, Replacements=1)  # -> Items, Count

# ---- group: floor num for each type
int_47 = Integer(nullrep_13.Items)

# ---- group: dock rotation
int_48 = Integer(filter_6)

# ---- group: 3LevelSlider3
num_24 = Number(panel_45)

# ---- group: 3LevelSlider4
num_25 = Number(panel_45)

# ---- group: 3LevelSlider1
num_26 = Number(panel_45)

# ---- group: 3LevelSlider2
num_27 = Number(panel_45)

# ---- group: 3LevelSlider5
num_28 = Number(panel_45)

# ----
_3levelsliderstoweights_py = PythonScript(s0=num_26, s1=num_27, s2=num_24, s3=num_25, s4=num_28)  # -> out, weights
# ---------- _3levelsliderstoweights_py: Python ----------
if s0==0.0 and s1==0.0 and s2==0.0 and s3==0.0 and s4==0.0:
    weights = [0.0, 0.0, 0.0, 0.0, 0.0]
else:
    ts = [s0, s1, s2, s3, s4]
    tTotal = 0.0
    for t in ts:
        tTotal = tTotal + t
    print 'tTotal = ' + str(tTotal)
    weights = list(map(lambda x: x/tTotal, ts))
    print 'weights = ' + str(weights)
# ---------- end _3levelsliderstoweights_py ----------

# ---- group: toggle3
bool_8 = Boolean(bool_3)

# ---- group: toggle2
bool_9 = Boolean(bool_2)

# ---- group: toggle4
bool_10 = Boolean(bool_4)

# ----
togglestoweights_py = PythonScript()  # -> out, a, weights; disabled
# ---------- togglestoweights_py: Python ----------
if not bool0 and not bool1 and not bool2 and not bool3 and not bool4:
    weights = [0.0, 0.0, 0.0, 0.0, 0.0]
else:
    bools = [bool0, bool1, bool2, bool3, bool4]
    ts = list(map(lambda x: float(x), bools))
    tTotal = 0.0
    for t in ts:
        tTotal = tTotal + t
    print 'tTotal = ' + str(tTotal)
    weights = list(map(lambda x: x/tTotal, ts))
    print 'weights = ' + str(weights)
# ---------- end togglestoweights_py ----------
pshift_25 = ShiftPaths(Data=_3levelsliderstoweights_py.weights, Offset=-1)

# ---- group: AI weights
num_29 = Number(pshift_25)

# ----
panel_47 = Panel(num_29)

# ---- group: module id
int_49 = Integer(int_40)

# ---- group: Toggle 1
# AI Step Control
bool_11 = Boolean(bool_7)

# ---- group: works, no memory leak
initsticky_py = PythonScript()  # -> out, a
# ---------- initsticky_py: Python ----------
import scriptcontext as sc
import time

sc.sticky["count"] = -1
sc.sticky["bool"] = False

print(time.time())
sc.sticky["prevTime"] = time.time()


a = True
# ---------- end initsticky_py ----------
stickycount_py = PythonScript(x=bool_11, push=pushtempstep, tempStep=aisteptest, initiated=initsticky_py.a)  # -> out, a; inputs push: Boolean, tempStep: Int32
# ---------- stickycount_py: Python ----------
import scriptcontext as sc
import time

if initiated and not x == sc.sticky["bool"] :
    if time.time() - sc.sticky["prevTime"] >= 0.5 :
        sc.sticky["count"] = sc.sticky["count"] + 1
    sc.sticky["prevTime"] = time.time()

if push:
    print(push)
    sc.sticky["count"] = tempStep

sc.sticky["bool"] = x

print(sc.sticky["count"])
print(sc.sticky["prevTime"])
print(sc.sticky["bool"])
print(time.time())

a = sc.sticky["count"]
# ---------- end stickycount_py ----------

# ---- group: floor num for each type
int_50 = Integer(int_46)

# Human Interation @ Lego - Outside
int_51 = Integer(int_46)

# ----
number_slider_4 = Slider(17, range=0..100)  # disabled
# mid
number_slider_5 = Slider(55, range=0..100)  # disabled
number_slider_6 = Slider(51, range=0..100)  # disabled
number_slider_7 = Slider(46, range=0..100)  # disabled
# old
number_slider_8 = Slider(23, range=0..100)  # disabled
number_slider_9 = Slider(69, range=0..100)  # disabled
equals_2 = Equality(FirstNumber=int_49, SecondNumber="0")  # -> Equality, Inequality
equals_3 = Equality(FirstNumber=int_49, SecondNumber="1")  # -> Equality, Inequality
equals_4 = Equality(FirstNumber=int_49, SecondNumber="3")  # -> Equality, Inequality
equals_5 = Equality(FirstNumber=int_49, SecondNumber="2")  # -> Equality, Inequality
equals_6 = Equality(FirstNumber=int_49, SecondNumber="4")  # -> Equality, Inequality
equals_7 = Equality(FirstNumber=int_49, SecondNumber="5")  # -> Equality, Inequality
# Dashboard
number_slider_10 = Slider(0.4, range=0..1)
# young
number_slider_11 = Slider(200, range=0..500)  # disabled
number_slider_12 = Slider(120, range=0..500)  # disabled
number_slider_13 = Slider(75, range=0..500)  # disabled
item_19 = ListItem(List=int_50, Index="0", Wrap=False)
item_20 = ListItem(List=int_50, Index="2", Wrap=False)
item_21 = ListItem(List=int_50, Index="1", Wrap=False)
item_22 = ListItem(List=int_50, Index="3", Wrap=False)
item_23 = ListItem(List=int_50, Index="4", Wrap=False)
item_24 = ListItem(List=int_50, Index="5", Wrap=False)

# ---- group: ppl per flr
# id5
# id3
# id4
# id0
# id2
# id1
# young
# mid
# old
panel_48 = Panel("0")
panel_49 = Panel("18")
panel_50 = Panel("28")
panel_51 = Panel("63")
panel_52 = Panel("52")
panel_53 = Panel("87")
panel_54 = Panel("156")
num_30 = Number([panel_48, "0", "0", "0"])
num_31 = Number(["0", "0", "0", "0"])
num_32 = Number(["0", "0", "0", "0"])

# ----
int_52 = Integer(equals_2.Equality)
int_53 = Integer(equals_3.Equality)
int_54 = Integer(equals_4.Equality)
int_55 = Integer(equals_5.Equality)
int_56 = Integer(equals_6.Equality)
int_57 = Integer(equals_7.Equality)
min = Minimum(A=stickycount_py.a, B="24")
ma_7 = MassAddition(Input=int_52)  # -> Result, PartialResults
ma_8 = MassAddition(Input=int_53)  # -> Result, PartialResults
ma_9 = MassAddition(Input=int_54)  # -> Result, PartialResults
ma_10 = MassAddition(Input=int_55)  # -> Result, PartialResults
ma_11 = MassAddition(Input=int_56)  # -> Result, PartialResults

# ---- group: building id 0 fl #
int_58 = Integer(item_19)

# ---- group: building id 2 fl #
int_59 = Integer(item_20)

# ---- group: building id 1 fl #
int_60 = Integer(item_21)

# ----
ma_12 = MassAddition(Input=int_57)  # -> Result, PartialResults

# ---- group: building id 3 fl #
int_61 = Integer(item_22)

# ----
pt_38 = ConstructPoint(XCoordinate=Slider(0, range=0..10), YCoordinate=Slider(0, range=-30..0), ZCoordinate=Slider(5.1, range=0..10))

# ---- group: building id 4 fl #
int_62 = Integer(item_23)

# ---- group: building id 5 fl #
int_63 = Integer(item_24)

# ---- group: AI Step (manual)
int_64 = Integer(aisteptest)

# ----
panel_55 = Panel(int_64)

# ---- group: AI Step (CV)
int_65 = Integer(min)

# ----
panel_56 = Panel(int_65)

# ---- group: range
B = DomainEnd(number_slider_11)  # disabled

# ----
int_66 = Integer(ma_7.Result)
panel_57 = Panel(int_66)
int_67 = Integer(ma_8.Result)
panel_58 = Panel(int_67)
int_68 = Integer(ma_9.Result)
panel_59 = Panel(int_68)
int_69 = Integer(ma_10.Result)
panel_60 = Panel(int_69)
filter_12 = StreamFilter(Gate=list_2, Stream0=int_64, Stream1=int_65)
int_70 = Integer(ma_11.Result)
panel_61 = Panel(int_70)

# ---- group: range
B_2 = DomainEnd(number_slider_12)  # disabled

B_3 = DomainEnd(number_slider_13)  # disabled

# ----
int_71 = Integer(ma_12.Result)
panel_62 = Panel(int_71)
xy = XYPlane(Origin=pt_38)

# ---- group: AI Step
int_72 = Integer(filter_12)

# ----
panel_63 = Panel(int_72)
dom = ConstructDomain(DomainStart=0, DomainEnd=B)  # disabled
dom_2 = ConstructDomain(DomainStart=0, DomainEnd=B_2)  # disabled
dom_3 = ConstructDomain(DomainStart=0, DomainEnd=B_3)  # disabled

# ---- group: Micro-unit Building #
int_73 = Integer(int_69)

# ---- group: Luxury Building #
int_74 = Integer(int_66)

# ---- group: Regular residential Building #
int_75 = Integer(int_67)

# ---- group: Head Quater Building #
int_76 = Integer(int_68)

# ---- group: Regular Office Building #
int_77 = Integer(int_70)

# ---- group: Co-working Building #
int_78 = Integer(int_71)

# ---- group: parking cell #
parking_cell = Slider(0, range=0..50)

# ---- group: AI Step from Python Server
int_79 = Integer(int_72)

# ----
panel_64 = Panel(int_79)

# ---- group: multipe for ppls
number_slider_14 = Slider(0.2, range=-0.01..2)

# ----
multiplication_10 = Multiplication(A=num_30, B=number_slider_14)
multiplication_11 = Multiplication(A=num_31, B=number_slider_14)
multiplication_12 = Multiplication(A=num_32, B=number_slider_14)
num_33 = Number(multiplication_10)
num_34 = Number(multiplication_11)
num_35 = Number(multiplication_12)

# ---- group: AI Step
int_80 = Integer(int_79)

# ----
panel_65 = Panel(int_80)

# ---- group: park cell #
park_cell = Slider(150, range=0..150)

# ----
multiplication_13 = Multiplication(A="28", B=division_8)
multiplication_14 = Multiplication(A="18", B=division_8)
multiplication_15 = Multiplication(A="63", B=division_8)
multiplication_16 = Multiplication(A="52", B=division_8)
multiplication_17 = Multiplication(A="156", B=division_8)
multiplication_18 = Multiplication(A="87", B=division_8)
round = Round(Number=multiplication_13)  # -> Nearest, Floor, Ceiling
round_2 = Round(Number=multiplication_15)  # -> Nearest, Floor, Ceiling
round_3 = Round(Number=multiplication_16)  # -> Nearest, Floor, Ceiling
round_4 = Round(Number=multiplication_14)  # -> Nearest, Floor, Ceiling
round_5 = Round(Number=multiplication_17)  # -> Nearest, Floor, Ceiling
round_6 = Round(Number=multiplication_18)  # -> Nearest, Floor, Ceiling

# ---- group: ppl per flr
panel_66 = Panel(round_4.Nearest)
panel_67 = Panel(round.Nearest)
panel_68 = Panel(round_2.Nearest)
panel_69 = Panel(round_3.Nearest)
panel_70 = Panel(round_6.Nearest)
panel_71 = Panel(round_5.Nearest)

# ---- group: reduce ratio
number_slider_15 = Slider(0, range=0..1)  # disabled

# ----
number_slider_16 = Slider(52, range=0..100)  # disabled
number_slider_17 = Slider(0.2, range=0..1)  # disabled
number_slider_18 = Slider(59, range=0..100)  # disabled
number_slider_19 = Slider(0.2, range=0..1)  # disabled
number_slider_20 = Slider(72, range=0..100)  # disabled
number_slider_21 = Slider(0.2, range=0..1)  # disabled
merge_10 = Merge(Data1=panel_66, Data2=panel_67, Data3=panel_68, Data4=panel_69, Data5=panel_70, Data6=panel_71)

# ---- group: how many floors in total
multiplication_19 = Multiplication(A=int_62, B=int_77)
multiplication_20 = Multiplication(A=int_60, B=int_75)
multiplication_21 = Multiplication(A=int_63, B=int_78)
multiplication_22 = Multiplication(A=int_59, B=int_73)
multiplication_23 = Multiplication(A=int_61, B=int_76)
multiplication_24 = Multiplication(A=int_58, B=int_74)

# ----
multiplication_25 = Multiplication(A=panel_70, B=multiplication_19)
multiplication_26 = Multiplication(A=panel_67, B=multiplication_20)
multiplication_27 = Multiplication(A=panel_68, B=multiplication_22)
multiplication_28 = Multiplication(A=panel_71, B=multiplication_21)
multiplication_29 = Multiplication(A=panel_69, B=multiplication_23)
multiplication_30 = Multiplication(A=panel_66, B=multiplication_24)

# ---- group: # ppl per flr
num_36 = Number(merge_10)

# ----
mid_mid_career = ColourSwatch(SwatchColor=RGB(255, 208, 0))  # disabled
mln_young = ColourSwatch(SwatchColor=RGB(0, 166, 255))  # disabled
exc_elderly = ColourSwatch(SwatchColor=RGB(255, 0, 0))  # disabled

# ---- group: Regular Office ppl #
int_81 = Integer(multiplication_25)

# ---- group: dot shape
number_slider_22 = Slider(9, range=0..10)  # disabled
number_slider_23 = Slider(3, range=0..10)  # disabled
polygon = Polygon(Plane=PlaneXY(0, 0, 0), Radius=number_slider_23, Segments=number_slider_22, FilletRadius=0)  # -> Polygon, Length; disabled
boundary = BoundarySurfaces(Edges=polygon.Polygon)  # disabled
mesh_10 = Mesh(boundary)  # disabled

# ----
mesh_11 = Mesh(mesh_10)  # disabled
mesh_12 = Mesh(mesh_10)  # disabled
mesh_13 = Mesh(mesh_10)  # disabled

# ---- group: Head Quater ppl #
int_82 = Integer(multiplication_29)

# ---- group: Co-working ppl #
int_83 = Integer(multiplication_28)

# ---- group: Micro-unit ppl #
int_84 = Integer(multiplication_27)

# ---- group: Luxury ppl #
int_85 = Integer(multiplication_30)

# ---- group: Regular residential ppl #
int_86 = Integer(multiplication_26)

# ----
panel_72 = Panel("0.0 To 400000.0")  # disabled
res_warm_2 = ColourSwatch(SwatchColor=RGB(255, 246, 204))
off_cold_2 = ColourSwatch(SwatchColor=RGB(204, 229, 255))

# ---- group: Dashboard Text Color
color = ColourSwatch(SwatchColor=RGB(201, 201, 201))
col_28 = Colour(color)

# ----
ma_13 = MassAddition(Input=[int_83, int_81, int_82])  # -> Result, PartialResults
ma_14 = MassAddition(Input=[int_84, int_86, int_85])  # -> Result, PartialResults

# ---- group: total working ppl #
int_87 = Integer(ma_13.Result)

# ---- group: total residential ppl #
int_88 = Integer(ma_14.Result)

# ----
addition_6 = Addition(A=int_88, B=int_87)

# ---- group: total ppl #
int_89 = Integer(addition_6)  # disabled

# ----
remap = RemapNumbers(Value=int_89, Source=panel_72, Target=Domain(0, 1))  # -> Mapped, Clipped; disabled

# ---- group: Dashboard Text Size 2
size = Slider(13.5, range=0..100)
num_37 = Number(size)

# ---- group: Dashboard Text Size 1
size_2 = Slider(15, range=0..100)
num_38 = Number(size_2)

# ----
max = Maximum(A=remap.Mapped, B=0)  # disabled
min_2 = Minimum(A=max, B=1)  # disabled
mid_mid_career_2 = ColourSwatch(SwatchColor=RGB(255, 208, 0))
_0 = Slider(0, range=0..1)

# ---- group: total ppl #
int_90 = Integer(addition_6)

# ----
# Bar Diagram
mln_young_2 = ColourSwatch(SwatchColor=RGB(0, 166, 255))
exc_elderly_2 = ColourSwatch(SwatchColor=RGB(255, 0, 0))

# ---- group: gridExtent_x
int_91 = Integer(int_38)  # disabled

# ---- group: v sep ln length
number_slider_24 = Slider(16, range=10..20)

# ---- group: gh ref pt start
pt_39 = Point(<point referenced from the Rhino model>)

# ---- group: gh ref pt end
pt_40 = Point(<point referenced from the Rhino model>)

# ---- group: bar diagram ppl range
domain = Domain("0 to 75000")

# ----
number_slider_25 = Slider(0.5, range=0..1)  # disabled
subtraction_2 = Subtraction(A=int_91, B=1)  # disabled
pdecon_25 = Deconstruct(Point=pt_40)  # -> XComponent, YComponent, ZComponent
pdecon_26 = Deconstruct(Point=pt_39)  # -> XComponent, YComponent, ZComponent
panel_73 = Panel(",\"popDensity\":")  # disabled
txt_12 = Text(min_2)  # disabled
panel_74 = Panel(int_90)
int_92 = Integer(int_41)  # disabled
neg = Negative(Value=number_slider_24)
graft = GraftTree(Tree=_0, IncludeEmptyLists=True, IncludeNullItems=True)
txt_13 = Text(num_21)  # disabled
subtraction_3 = Subtraction(A=subtraction_2, B=int_92)  # disabled
merge_11 = Merge(Data1=mln_young_2, Data2=mid_mid_career_2, Data3=exc_elderly_2)
Y = UnitY(Factor=number_slider_24)
Y_2 = UnitY(Factor=neg)
# Send to Unity (json, UDP)
panel_75 = Panel("{\"grid\":[")  # disabled
panel_76 = Panel("],\"objects\":{")  # disabled
panel_77 = Panel("}")  # disabled
panel_78 = Panel("{\"type\":")  # disabled
panel_79 = Panel(",\"x\":")  # disabled
panel_80 = Panel(",\"y\":")  # disabled
txt_14 = Text(int_42)  # disabled
panel_81 = Panel(",\"rot\":")  # disabled
txt_15 = Text(int_43)  # disabled
panel_82 = Panel("}")  # disabled
panel_83 = Panel(",")  # disabled
panel_84 = Panel("\"slider1\":")  # disabled
panel_85 = Panel(",\"toggle2\":")  # disabled
panel_86 = Panel(",\"toggle3\":")  # disabled
panel_87 = Panel(",\"toggle4\":")  # disabled
panel_88 = Panel(",\"dockID\":")  # disabled
txt_16 = Text(int_44)  # disabled
panel_89 = Panel(",\"density\":[")  # disabled
txt_17 = Text(int_40)  # disabled
txt_18 = Text(subtraction_3)  # disabled
panel_90 = Panel(",\"toggle1\":")  # disabled
int_93 = Integer(bool_8)  # disabled
panel_91 = Panel(",\"dockRotation\":")  # disabled
txt_19 = Text(int_48)  # disabled
panel_92 = Panel(",\"IDMax\":15")  # disabled
panel_93 = Panel("],\"pop_young\":0,\"pop_mid\":0,\"pop_old\":0")  # disabled
panel_94 = Panel("}")  # disabled
int_94 = Integer(bool_7)  # disabled
int_95 = Integer(bool_8)  # disabled
txt_20 = Text(number_slider_25)  # disabled
int_96 = Integer(bool_9)  # disabled

ttl_min = Slider(60, range=0..100)
type_min = Slider(20, range=0..100)

txt_21 = Text(int_46)  # disabled
panel_95 = Panel(",")  # disabled
nullrep_14 = ReplaceNulls(Items=int_88, Replacements=0)  # -> Items, Count
txt_22 = Text(int_94)  # disabled
txt_23 = Text(int_96)  # disabled
txt_24 = Text(int_93)  # disabled
txt_25 = Text(int_95)  # disabled
nullrep_15 = ReplaceNulls(Items=int_85, Replacements=0)  # -> Items, Count
nullrep_16 = ReplaceNulls(Items=int_84, Replacements=0)  # -> Items, Count
nullrep_17 = ReplaceNulls(Items=int_86, Replacements=0)  # -> Items, Count
max_2 = Maximum(A=nullrep_14.Items, B=ttl_min)
lng_5 = ListLength(List=txt_17)  # disabled
repeat_3 = RepeatData(Data=panel_81, Length=lng_5)  # disabled
repeat_4 = RepeatData(Data=panel_82, Length=lng_5)  # disabled
repeat_5 = RepeatData(Data=panel_80, Length=lng_5)  # disabled
repeat_6 = RepeatData(Data=panel_79, Length=lng_5)  # disabled
repeat_7 = RepeatData(Data=panel_78, Length=lng_5)  # disabled
join_5 = TextJoin(Text=txt_21, Join=panel_95)  # disabled
max_3 = Maximum(A=nullrep_15.Items, B=type_min)
max_4 = Maximum(A=nullrep_17.Items, B=type_min)
max_5 = Maximum(A=nullrep_16.Items, B=type_min)
pshift_26 = ShiftPaths(Data=repeat_3, Offset=-1)  # disabled
pshift_27 = ShiftPaths(Data=repeat_4, Offset=-1)  # disabled
pshift_28 = ShiftPaths(Data=repeat_6, Offset=-1)  # disabled
pshift_29 = ShiftPaths(Data=repeat_5, Offset=-1)  # disabled
pshift_30 = ShiftPaths(Data=repeat_7, Offset=-1)  # disabled

# ---- group: R
int_97 = Integer(max_2)

# ----
neg_2 = Negative(Value=number_slider_24)

# ---- group: RL
int_98 = Integer(max_3)

# ---- group: RM
int_99 = Integer(max_4)

# ---- group: RS
int_100 = Integer(max_5)

# ----
addition_7 = Addition(A=int_100, B=int_99)
addition_8 = Addition(A=addition_7, B=int_98)
merge_12 = Merge(Data1=graft, Data2=int_100, Data3=addition_7, Data4=addition_8)
# Population Matrix - New
pt_41 = Point(<point referenced from the Rhino model>)
col_29 = Colour(res_warm_2)
merge_13 = Merge(
    Data1=graft(pshift_30),
    Data2=graft(txt_17),
    Data3=graft(pshift_28),
    Data4=graft(txt_18),
    Data5=graft(pshift_29),
    Data6=graft(txt_14),
    Data7=graft(pshift_26),
    Data8=graft(txt_15),
    Data9=graft(pshift_27))  # disabled
sort = SortList(Keys=flatten(merge_12))  # -> Keys, ValuesA

# ---- group: 0-1
remap_2 = RemapNumbers(Value=flatten(sort.Keys), Source=domain, Target=Domain(0, 1))  # -> Mapped, Clipped

# ---- group: ttl h len
subtraction_4 = Subtraction(A=pdecon_25.XComponent, B=pdecon_26.XComponent)

# ----
pt_42 = Point(<point referenced from the Rhino model>)
num_39 = Number(num_38)
pt_43 = Point(<point referenced from the Rhino model>)
num_40 = Number(num_38)
col_30 = Colour(res_warm_2)
pt_44 = Point(<point referenced from the Rhino model>)
num_41 = Number(num_38)
col_31 = Colour(res_warm_2)
division_9 = Division(A=neg_2, B=2)
col_32 = Colour(res_warm_2)
division_10 = Division(A=number_slider_24, B=2)
number_slider_26 = Slider(2.5, range=0..10)  # disabled
panel_96 = Panel("35000")  # disabled

# ---- group: RL
tag = TextTag3D(Location=pt_43, Text=int_98, Size=num_40, Colour=col_31, Justification=7)

# ----
join_6 = TextJoin(Text=merge_13)  # disabled

# ---- group: RS
tag_2 = TextTag3D(Location=pt_42, Text=int_100, Size=num_39, Colour=col_30, Justification=7)

# ---- group: RM
tag_3 = TextTag3D(Location=pt_44, Text=int_99, Size=num_41, Colour=col_32, Justification=7)

# ----
nullrep_18 = ReplaceNulls(Items=int_87, Replacements=0)  # -> Items, Count
multiplication_31 = Multiplication(A=remap_2.Mapped, B=subtraction_4)
Y_3 = UnitY(Factor=division_9)
Y_4 = UnitY(Factor=division_10)
multiplication_32 = Multiplication(A=panel_96, B=number_slider_26)  # disabled
nullrep_19 = ReplaceNulls(Items=int_82, Replacements=0)  # -> Items, Count
pshift_31 = ShiftPaths(Data=join_6, Offset=-1)  # disabled
nullrep_20 = ReplaceNulls(Items=int_83, Replacements=0)  # -> Items, Count
max_6 = Maximum(A=nullrep_18.Items, B=ttl_min)
nullrep_21 = ReplaceNulls(Items=int_81, Replacements=0)  # -> Items, Count
addition_9 = Addition(A=pdecon_26.XComponent, B=multiplication_31)

# ---- group: O
int_101 = Integer(max_6)

# ----
max_7 = Maximum(A=nullrep_20.Items, B=type_min)
max_8 = Maximum(A=nullrep_19.Items, B=type_min)

# ---- group: intersections
crossings = Point([Point(156.25, 281.25, 0), Point(468.75, 281.25, 0), Point(718.75, 281.25, 0), Point(156.25, 656.25, 0), Point(468.75, 656.25, 0), Point(718.75, 656.25, 0), Point(906.25, 906.25, 0), Point(718.75, 906.25, 0), Point(468.75, 906.25, 0), Point(156.25, 906.25, 0), Point(906.25, 281.25, 0), Point(906.25, 656.25, 0), Point(906.25, 781.25, 0), Point(906.25, 531.25, 0), Point(906.25, 156.25, 0)])  # disabled

# ----
max_9 = Maximum(A=nullrep_21.Items, B=type_min)

# ---- group: all road pieces
pt_45 = Point([Point(906.25, 156.25, 0), Point(906.25, 531.25, 0), Point(906.25, 781.25, 0), Point(906.25, 656.25, 0), Point(906.25, 281.25, 0), Point(156.25, 906.25, 0)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])  # disabled

# ---- group: total ppl #
int_102 = Integer(int_90)  # disabled

# ----
number_slider_27 = Slider(700, range=700..35000)  # disabled
txt_26 = Text(pshift_31)  # disabled
panel_97 = Panel(txt_26)  # disabled
join_7 = TextJoin(Text=txt_26, Join=panel_83)  # disabled
txt_27 = Text(join_7)  # disabled
panel_98 = Panel("-0.8")  # disabled

# ---- group: traffic mode is PEV
bool_12 = Boolean(bool_7)  # disabled

# ---- group: OL
int_103 = Integer(max_8)

# ---- group: OM
int_104 = Integer(max_9)

# ---- group: OS
int_105 = Integer(max_7)

# ----
addition_10 = Addition(A=int_105, B=int_104)
addition_11 = Addition(A=addition_10, B=int_103)
merge_14 = Merge(Data1=graft, Data2=int_105, Data3=addition_10, Data4=addition_11)
sort_2 = SortList(Keys=flatten(merge_14))  # -> Keys, ValuesA

# ---- group: 0-1
remap_3 = RemapNumbers(Value=flatten(sort_2.Keys), Source=domain, Target=Domain(0, 1))  # -> Mapped, Clipped

# ----
multiplication_33 = Multiplication(A=remap_3.Mapped, B=subtraction_4)
addition_12 = Addition(A=pdecon_26.XComponent, B=multiplication_33)
pt_46 = ConstructPoint(XCoordinate=addition_12, YCoordinate=pdecon_26.YComponent, ZCoordinate=0)
move = Move(Geometry=pt_46, Motion=Y_3)  # -> Geometry, Transform
shift_2 = ShiftList(List=move.Geometry, Shift=-1, Wrap=False)
pt_47 = Point(<point referenced from the Rhino model>)
col_33 = Colour(off_cold_2)
pt_48 = ConstructPoint(XCoordinate=addition_9, YCoordinate=pdecon_26.YComponent, ZCoordinate=0)
move_2 = Move(Geometry=pt_48, Motion=Y_4)  # -> Geometry, Transform
shift_3 = ShiftList(List=move_2.Geometry, Shift=-1, Wrap=False)
merge_15 = Merge(
    Data1=panel_75,
    Data2=txt_27,
    Data3=panel_76,
    Data4=panel_84,
    Data5=txt_20,
    Data6=panel_90,
    Data7=txt_22,
    Data8=panel_85,
    Data9=txt_23,
    Data10=panel_86,
    Data11=txt_24,
    Data12=panel_87,
    Data13=txt_25,
    Data14=panel_88,
    Data15=txt_16,
    Data16=panel_91,
    Data17=txt_19,
    Data18=panel_92,
    Data19=panel_73,
    Data20=txt_12,
    Data21=panel_89,
    Data22=join_5,
    Data23=panel_93,
    Data24=panel_94,
    Data25=panel_77)  # disabled
shift_4 = ShiftList(List=move.Geometry, Shift=1, Wrap=False)
shift_5 = ShiftList(List=move_2.Geometry, Shift=1, Wrap=False)
pt_49 = Point(<point referenced from the Rhino model>)
num_42 = Number(num_38)
pt_50 = Point(<point referenced from the Rhino model>)
num_43 = Number(num_38)
col_34 = Colour(off_cold_2)
pt_51 = Point(<point referenced from the Rhino model>)
num_44 = Number(num_38)
col_35 = Colour(off_cold_2)
col_36 = Colour(off_cold_2)

# ---- group: lower v sep ln
line_4 = LineSDL(Start=pt_46, Direction=Y_2, Length=number_slider_24)

# ---- group: h sep ln
ln = Line(StartPoint=pt_39, EndPoint=pt_40)

# ---- group: OL
tag_4 = TextTag3D(Location=pt_50, Text=int_103, Size=num_43, Colour=col_35, Justification=7)

# ---- group: OS
tag_5 = TextTag3D(Location=pt_49, Text=int_105, Size=num_42, Colour=col_34, Justification=7)

# ---- group: OM
tag_6 = TextTag3D(Location=pt_51, Text=int_104, Size=num_44, Colour=col_36, Justification=7)

# ----
multiplication_34 = Multiplication(A=bool_12, B=panel_98)  # disabled
ln_2 = Line(StartPoint=shift_2, EndPoint=shift_4)
ln_3 = Line(StartPoint=shift_3, EndPoint=shift_5)
neg_3 = Negative(Value=number_slider_24)

# ---- group: upper v sep ln
line_5 = LineSDL(Start=pt_48, Direction=Y, Length=number_slider_24)

# ----
neg_4 = Negative(Value=number_slider_24)
join_8 = TextJoin(Text=merge_15)  # disabled
division_11 = Division(A=neg_3, B=6)
division_12 = Division(A=neg_4, B=6)
sort_pt = SortPoints(Points=flatten(pt_46))  # -> Points, Indices
panel_99 = Panel("127.0.0.1")  # disabled
panel_100 = Panel("7002")  # disabled

# ---- group: Dashboard Text Size 3
size_3 = Slider(12, range=0..100)
num_45 = Number(size_3)

# ----
num_46 = Number(num_45)

# ---- group: residential total
tag_7 = TextTag3D(Location=pt_41, Text=int_97, Size=num_46, Colour=col_29, Justification=7)

# ----
num_47 = Number(num_45)

# ---- group: office total
tag_8 = TextTag3D(Location=pt_47, Text=int_101, Size=num_47, Colour=col_33, Justification=7)

# ----
Y_5 = UnitY(Factor=division_11)
Y_6 = UnitY(Factor=division_12)
pt_52 = Point(<point referenced from the Rhino model>)
int_106 = Integer(int_59)
pt_53 = Point(<point referenced from the Rhino model>)
int_107 = Integer(int_58)
pt_54 = Point(<point referenced from the Rhino model>)
int_108 = Integer(int_60)
col_37 = Colour(res_warm_2)
col_38 = Colour(res_warm_2)
num_48 = Number(num_45)
num_49 = Number(num_45)
col_39 = Colour(res_warm_2)
num_50 = Number(num_45)
division_13 = Division(A=number_slider_24, B=3)
division_14 = Division(A=number_slider_24, B=3)
sort_pt_2 = SortPoints(Points=flatten(pt_48))  # -> Points, Indices

# ---- group: json data to send
txt_28 = Text(join_8)  # disabled

# ----
panel_101 = Panel(txt_28)  # disabled

# ---- group: 2
tag_9 = TextTag3D(Location=pt_52, Text=int_106, Size=num_48, Colour=col_37, Justification=7)

# ---- group: 0
tag_10 = TextTag3D(Location=pt_53, Text=int_107, Size=num_49, Colour=col_38, Justification=7)

# ---- group: 1
tag_11 = TextTag3D(Location=pt_54, Text=int_108, Size=num_50, Colour=col_39, Justification=7)

# ----
move_3 = Move(Geometry=ln_2, Motion=Y_5)  # -> Geometry, Transform
move_4 = Move(Geometry=ln_3, Motion=Y_6)  # -> Geometry, Transform

# ---- group: balance two colors
number_slider_28 = Slider(0.8, range=0..1)  # disabled

# ----
Y_7 = UnitY(Factor=division_13)
Y_8 = UnitY(Factor=division_14)
subtraction_5 = Subtraction(A=1, B=number_slider_28)  # disabled
road_2 = ColourSwatch(SwatchColor=RGB(64, 64, 64))  # disabled

# ---- group: last pt O
item_25 = ListItem(List=sort_pt.Points, Index=-1, Wrap=True)

# ---- group: last pt R
item_26 = ListItem(List=sort_pt_2.Points, Index=-1, Wrap=True)

# ----
extr = Extrude(Base=move_3.Geometry, Direction=Y_7)
extr_2 = Extrude(Base=move_4.Geometry, Direction=Y_8)
udp = UDPSender(Address=panel_99, Port=panel_100, Pattern=0, Data=txt_28)  # disabled
pt_55 = Point(<point referenced from the Rhino model>)
int_109 = Integer(int_63)
pt_56 = Point(<point referenced from the Rhino model>)
int_110 = Integer(int_61)
pt_57 = Point(<point referenced from the Rhino model>)
int_111 = Integer(int_62)
col_40 = Colour(off_cold_2)
col_41 = Colour(off_cold_2)
num_51 = Number(num_45)
num_52 = Number(num_45)
col_42 = Colour(off_cold_2)
num_53 = Number(num_45)
neg_5 = Negative(Value=number_slider_24)
division_15 = Division(A=neg_5, B=1.5)
mesh_14 = Mesh(extr)
Y_9 = UnitY(Factor=division_15)
move_5 = Move(Geometry=item_25, Motion=Y_9)  # -> Geometry, Transform
mesh_15 = Mesh(extr_2)
division_16 = Division(A=number_slider_24, B=1.5)
Y_10 = UnitY(Factor=division_16)
move_6 = Move(Geometry=item_26, Motion=Y_10)  # -> Geometry, Transform
argb = SplitARGB(Colour=road_2, IntegerChannels=True)  # -> Alpha, Red, Green, Blue; disabled

# ---- group: 5
tag_12 = TextTag3D(Location=pt_55, Text=int_109, Size=num_51, Colour=col_40, Justification=7)

# ---- group: 3
tag_13 = TextTag3D(Location=pt_56, Text=int_110, Size=num_52, Colour=col_41, Justification=7)

# ---- group: 4
tag_14 = TextTag3D(Location=pt_57, Text=int_111, Size=num_53, Colour=col_42, Justification=7)

# ----
mspray = MeshSpray(Mesh=graft(mesh_14), Points=Point(0, 0, 0), Colours=graft(merge_11), SprayMode=0)
mspray_2 = MeshSpray(Mesh=graft(mesh_15), Points=Point(0, 0, 0), Colours=graft(merge_11), SprayMode=0)
X = UnitX(Factor=5)
move_7 = Move(Geometry=move_5.Geometry, Motion=X)  # -> Geometry, Transform
X_2 = UnitX(Factor=5)
move_8 = Move(Geometry=move_6.Geometry, Motion=X_2)  # -> Geometry, Transform
vec = VectorXYZ(XComponent=argb.Red, YComponent=argb.Green, ZComponent=argb.Blue)  # -> Vector, Length; disabled
pshift_32 = ShiftPaths(Data=mspray, Offset=-1)
pshift_33 = ShiftPaths(Data=mspray_2, Offset=-1)

# ---- group: all sep lns
crv_8 = Curve([ln, line_5, line_4])

# ----
pt_58 = Point(move_7.Geometry)
num_54 = Number(num_37)
pt_59 = Point(move_8.Geometry)
num_55 = Number(num_37)
col_43 = Colour(off_cold_2)
col_44 = Colour(res_warm_2)
multiplication_35 = Multiplication(A=vec.Vector, B=subtraction_5)  # disabled

# ---- group: work
mesh_16 = Mesh(pshift_32)

tag_15 = TextTag3D(Location=pt_58, Text="work", Size=num_54, Colour=col_43, Justification=4)

# ---- group: live
tag_16 = TextTag3D(Location=pt_59, Text="live", Size=num_55, Colour=col_44, Justification=4)

mesh_17 = Mesh(pshift_33)

# ----
preview_7 = CustomPreview(Geometry=crv_8, Shader=col_28)

# ---- group: json data to send
# Send to CityIO Server
# (json, internet, Yasushi)
txt_29 = Text(txt_28)  # disabled

# ----
dam = DataDam(DataA=txt_29, BufferDelay=10000000, BufferMode=2)  # disabled
panel_102 = Panel("table/update/citymatrix")  # disabled
panel_103 = Panel("https://cityio.media.mit.edu")  # disabled
send_table_data = PythonScript(url=panel_103, path=panel_102, jsonString=dam)  # -> out; disabled
# ---------- send_table_data: Python ----------
import System 
import System.Net 
import System.Uri
import System.IO
import System.Text.Encoding
import json


def postTable(url,stringData,debug=False):
    webclient = System.Net.WebClient()
    webclient.Headers['Content-type'] = 'text/plain'
    
    if debug:
        
        # simple validation before we send
        try:
            json.loads(stringData)
        except:
            print 'invalid string, revise your string data'
            return
        
        # this will block your process
        data = System.Text.Encoding.Default.GetBytes(stringData)
        webclient.UploadData(url,'POST',data)
        
    else:
        data = System.Text.Encoding.Default.GetBytes(stringData)
        webclient.UploadDataAsync(url,'POST',data)

endpoint = System.Uri('{}/{}'.format(url,path))



postTable(endpoint,jsonString,False)
# rhino crashes using async callbacks,
# so try the following if something is wrong
# postData(endpoint,jsonString,debug=True)
# ---------- end send_table_data ----------
panel_104 = Panel(send_table_data)  # disabled

# ---- group: place holder
series_4 = Series(Start=0, Step=0.003921568627, Count=256)

# ---- group: place holder / solar value new
num_56 = Number(series_4)

# ---- group: place holder / traffic value new
num_57 = Number(series_4)

# ---- group: place holder / waiting time value new
num_58 = Number(series_4)

# ---- group: place holder / solar value
num_59 = Number(num_56)

# ---- group: place holder / traffic value
num_60 = Number(num_57)

# ---- group: place holder / waiting time value
num_61 = Number(num_58)

# ----
panel_105 = Panel("""-0.2
0.0
0.2
-0.4
0.0
0.4""")

# ---- group: type / module id
int_112 = Integer(int_40)

int_113 = Integer(int_40)

# ---- group: module id
int_114 = Integer(int_40)

# ---- group: shrink
cell_shrink = Slider(1, range=0.75..1)

# ----
move_z = Slider(6.5, range=0..30)
move_z_2 = Slider(5.5, range=0..10)
move_z_3 = Slider(6.5, range=0..10)

# ---- group: shrink
cell_shrink_2 = Slider(0.98, range=0.75..1)

# ---- group: gridExtent_x
int_115 = Integer(int_38)

# ---- group: shrink
num_62 = Number(cell_shrink_2)

# ---- group: gridExtent_y
int_116 = Integer(int_39)

# ---- group: rotation
int_117 = Integer(int_43)

# ---- group: module id
int_118 = Integer(int_40)

# ---- group: y
int_119 = Integer(int_42)

# ---- group: x
int_120 = Integer(int_41)

# ---- group: toggle1
bool_13 = Boolean(Toggle(True))

# ---- group: colortizer orgin
# LEGO Grid System
pt_60 = Point(<point referenced from the Rhino model>)

# ---- group: table size ref pt
pt_61 = Point(<point referenced from the Rhino model>)

# ----
number_slider_29 = Slider(-560, range=-1000..1000)  # disabled
num_63 = Number(1)  # disabled
vec_2 = VectorXYZ(XComponent=num_63, YComponent=num_63, ZComponent=0)  # -> Vector, Length; disabled
amp = Amplitude(Vector=vec_2.Vector, Amplitude=number_slider_29)  # disabled
move_9 = Move(Geometry=pt_61, Motion=amp)  # -> Geometry, Transform; disabled

# ---- group: floor num for each type
int_121 = Integer(int_46)

# ---- group: colortizer orgin
pt_62 = Point(pt_60)

# ---- group: # ppl per flr
num_64 = Number(num_36)

# ---- group: gridExtent_x
# Energy/Cost Efficiency Formular:
# Sum of (Nearest N Building Population/Distance to that building)
int_122 = Integer(int_38)

# ---- group: gridExtent_y
int_123 = Integer(int_39)

# ---- group: x
int_124 = Integer(int_41)

# ---- group: y
int_125 = Integer(int_42)

# ---- group: shrink
num_65 = Number(cell_shrink)

# ---- group: gridExtent_x
# Traffic Heatmap - Machine Learning Server
int_126 = Integer(int_38)  # disabled

# ---- group: gridExtent_y
int_127 = Integer(int_39)  # disabled

# ---- group: colortizer orgin
pt_63 = Point(pt_60)

# ---- group: shrink
num_66 = Number(num_62)

# ---- group: x
num_67 = Number(int_41)

# ---- group: y
num_68 = Number(int_42)

# ---- group: traffic value
num_69 = Number(num_60)  # disabled

# ---- group: waiting time value
num_70 = Number(num_61)  # disabled

# ---- group: gridExtent_x
# Solar Access Heatmap - Machine Learning Server
int_128 = Integer(int_38)

# ---- group: gridExtent_y
int_129 = Integer(int_39)

# ---- group: colortizer orgin
pt_64 = Point(pt_60)

# ---- group: shrink
num_71 = Number(num_62)

# ---- group: x
num_72 = Number(int_41)

# ---- group: y
num_73 = Number(int_42)

# ---- group: solar value
num_74 = Number(num_59)

# ----
Z = UnitZ(Factor=20)  # disabled
# Dashboard
# Dock
panel_106 = Panel("Residential")

# ---- group: dockID
int_130 = Integer(int_44)

# ---- group: dockRotation
int_131 = Integer(int_48)

# ----
swatch = ColourSwatch(SwatchColor=RGB(255, 255, 255))  # disabled
panel_107 = Panel("C:\Users\RYAN\Documents\GitHub\CityMatrix\Map\Amenities Maps\Amenities_Trans.png")  # disabled
panel_108 = Panel("C:\Users\RYAN\Documents\GitHub\CityMatrix\Map\Amenities Maps\Amenities_85Alpha.png")  # disabled
# C:\Users\RYAN\Documents\GitHub\CityMatrix\Map\HAMBURG RS 1600pxl.jpg
panel_109 = Panel("0.0")  # disabled
xy_2 = XYPlane(Origin=pt_60)
dist = Distance(PointA=pt_60, PointB=pt_61)

# ---- group: crv with arrow - cell to change
crv_9 = Curve([<curve referenced from the Rhino model> x6])

# ---- group: crvs with arrow - density value suggested
crv_10 = Curve([<curve referenced from the Rhino model> x6])

# ---- group: cell change arrow crv
crv_11 = Curve()

# ---- group: square crvs to highlight
# AI Suggestion Highlighter
crv_12 = Curve([<curve referenced from the Rhino model> x7])

# ---- group: rect crvs - no off set
crv_13 = Curve()

# ---- group: module meshes lego ref: -1
mesh_18 = Mesh(mesh_3)

# ---- group: module meshes lego ref: 0 to 5
mesh_19 = Mesh(mesh_4)

# ----
multiplication_36 = Multiplication(A=int_121, B=num_64)
neg_6 = Negative(Value=int_131)
panel_110 = Panel("16")  # disabled
subtraction_6 = Subtraction(A=panel_110, B=num_67)
division_17 = Division(A=dist, B=int_115)

# ---- group: influence range - distance limit
number_slider_30 = Slider(200, range=0..1000)

# ----
txt_30 = Text(["Large Unit", "Medium Unit", "Small Unit", "Large Unit", "Medium Unit", "Small Unit"])

# ---- group: infulence range - # nearest
range_count = Slider(49, range=1..130)

# ----
movetoorgin = MoveToOrgin(G=mesh_18, num=num_62)
movetoorgin_2 = MoveToOrgin(G=mesh_19, num=num_62)
txt_31 = Text([panel_106, "Residential", "Residential", "Office", "Office", "Office"])
movetoorgin_3 = MoveToOrgin(G=mesh_8, num=num_62)

# ---- group: base cplane
pln = Plane(xy_2)

# ----
# Google Map @ Lego
planesrf = PlaneSurface(Plane=pln, XSize=Domain(0, 1000), YSize=Domain(-1000, 0))  # disabled
move_10 = Move(Geometry=planesrf, Motion=Z)  # -> Geometry, Transform; disabled

# ---- group: road check matrix
python_2 = PythonScript(xe=int_115, ye=int_116, x=int_120, y=int_119, id=int_118)  # -> out, m; inputs x: list, y: list, id: list
# ---------- python_2: Python ----------
"""
CityMatrix

written by "Ryan" Yan Zhang <ryanz@mit.edu>
for MIT Media Lab, Changing Place Group
April.6th.2016
"""

import rhinoscriptsyntax as rs

m = [[-1 for n in range(xe)] for n in range(ye)]

#for n in range(len(id)):
#    if id[n] == 7:
#        m[y[n]][x[n]] = 6
#    else:
#        m[y[n]][x[n]] = id[n]

for n in range(len(id)):
    m[y[n]][x[n]] = id[n]

for n in range(ye):
    print m[n]
# ---------- end python_2 ----------

python_3 = PythonScript(xe=int_115, ye=int_116, x=int_120, y=int_119, id=int_118)  # -> out, m; inputs x: list, y: list, id: list; same code as python_2

# ---- group: sidewalk check matrix
python_4 = PythonScript(xe=int_115, ye=int_116, x=int_120, y=int_119, id=int_118)  # -> out, m; inputs x: list, y: list, id: list; same code as python_2

# ----
number_slider_31 = Slider(14, range=0..100)
item_27 = ListItem(List=txt_30, Index=int_130, Wrap=False)

# ---- group: private car / road quator 0s
mesh_20 = Mesh([<mesh referenced from the Rhino model> x4])
pt_65 = Point(<point referenced from the Rhino model>)

# ----
item_28 = ListItem(List=txt_31, Index=int_130, Wrap=False)

# ---- group: private car / center line quator 0s
mesh_21 = Mesh([<mesh referenced from the Rhino model> x4])
pt_66 = Point(<point referenced from the Rhino model>)

# ---- group: private car / sidewalk quator 0s
mesh_22 = Mesh([<mesh referenced from the Rhino model> x4])
pt_67 = Point(<point referenced from the Rhino model>)

# ----
pt_68 = Point(<point referenced from the Rhino model>)

# ---- group: # ppl per building
num_75 = Number(multiplication_36)

# ----
panel_111 = Panel(num_75)
swatch_2 = ColourSwatch(SwatchColor=RGB(255, 255, 255))

# ---- group: cell size
num_76 = Number(division_17)

num_77 = Number(num_76)

num_78 = Number(num_76)

num_79 = Number(num_76)

# ----
modulecenter = ModuleCenter(pt=pt_60, num=num_76, int_2=int_120, int=int_119)  # -> pt_5, transform_2

# ---- group: module center
pt_69 = Point(modulecenter.pt_5)

pt_70 = Point(pt_69)  # disabled

# ----
offset = Offset(Curve=crv_12, Distance=Slider(15, range=0..100), Plane=PlaneXY(0, 0, 0), Corners=1)
vec2pt = Vector2Pt(PointA=Point(0, 0, 0), PointB=pt_68, Unitize=False)  # -> Vector, Length

# ---- group: private car / road quator 1s
mesh_23 = Mesh([<mesh referenced from the Rhino model> x4])
pt_71 = Point(<point referenced from the Rhino model>)

# ---- group: private car
scale_nu = ScaleNU(Geometry=mesh_20, Plane=pt_65, ScaleX=num_62, ScaleY=num_62, ScaleZ=1)  # -> Geometry, Transform
scale_nu_2 = ScaleNU(Geometry=mesh_23, Plane=pt_71, ScaleX=num_62, ScaleY=num_62, ScaleZ=1)  # -> Geometry, Transform

# ---- group: private car / center line quator 1s
mesh_24 = Mesh([<mesh referenced from the Rhino model> x4])
pt_72 = Point(<point referenced from the Rhino model>)

# ---- group: private car
scale_nu_3 = ScaleNU(Geometry=mesh_21, Plane=pt_66, ScaleX=num_62, ScaleY=num_62, ScaleZ=1)  # -> Geometry, Transform
scale_nu_4 = ScaleNU(Geometry=mesh_24, Plane=pt_72, ScaleX=num_62, ScaleY=num_62, ScaleZ=1)  # -> Geometry, Transform

# ---- group: road check list
python_5 = PythonScript(xe=int_115, ye=int_116, x=int_120, y=int_119, id=int_118, m=python_2.m)  # -> out, rdType; inputs x: list, y: list, id: list, m: list
# ---------- python_5: Python ----------
"""
CityMatrix

written by "Ryan" Yan Zhang <ryanz@mit.edu>
for MIT Media Lab, Changing Place Group
April.6th.2016
"""

import rhinoscriptsyntax as rs

rdType = []

for n in range(len(id)):
    
    code = []
    
    if id[n]==6:
        
        # 0: check x, y+1
        if y[n]+1>ye-1:
            code.append(1)
        else:
            if m[y[n]+1][x[n]]==6:
                code.append(1)
            else:
                code.append(0)
        
        # 1: check x+1, y
        if x[n]+1>xe-1:
            code.append(1)
        else:
            if m[y[n]][x[n]+1]==6:
                code.append(1)
            else:
                code.append(0)
        
        # 2: check x, y-1
        if y[n]-1<0:
            code.append(1)
        else:
            if m[y[n]-1][x[n]]==6:
                code.append(1)
            else:
                code.append(0)
        
        # 3: check x-1, y
        if x[n]-1<0:
            code.append(1)
        else:
            if m[y[n]][x[n]-1]==6:
                code.append(1)
            else:
                code.append(0)
    
    else:
        
        code = [0,0,0,0]
    
    print code
    rdType.append(code)
# ---------- end python_5 ----------

python_6 = PythonScript(xe=int_115, ye=int_116, x=int_120, y=int_119, id=int_118, m=python_3.m)  # -> out, rdType; inputs x: list, y: list, id: list, m: list; same code as python_5

# ---- group: x
num_80 = Number(subtraction_6)
# ---- group: y
num_81 = Number(num_68)

# ---- group: traffic value
num_82 = Number(num_69)  # disabled

# ---- group: waiting time value
num_83 = Number(num_70)  # disabled

# ---- group: private car / sidewalk quator 1s
mesh_25 = Mesh([<mesh referenced from the Rhino model> x4])
pt_73 = Point(<point referenced from the Rhino model>)

# ---- group: private car
scale_nu_5 = ScaleNU(Geometry=mesh_22, Plane=pt_67, ScaleX=num_62, ScaleY=num_62, ScaleZ=1)  # -> Geometry, Transform
scale_nu_6 = ScaleNU(Geometry=mesh_25, Plane=pt_73, ScaleX=num_62, ScaleY=num_62, ScaleZ=1)  # -> Geometry, Transform

# ---- group: x
num_84 = Number(num_72)

# ---- group: y
num_85 = Number(num_73)

# ---- group: solar value
num_86 = Number(num_74)

# ---- group: sidewalk check list
python_7 = PythonScript(xe=int_115, ye=int_116, x=int_120, y=int_119, id=int_118, m=python_4.m)  # -> out, rdType; inputs x: list, y: list, id: list, m: list; same code as python_5

# ----
pt_74 = Point(<point referenced from the Rhino model>)
pt_75 = Point(<point referenced from the Rhino model>)
crv_14 = Curve(offset)

# ---- group: connected and offset ref crvs
crv_15 = Curve(crv_13)

# ---- group: unit name
tag_17 = TextTag3D(Location=pt_74, Text=item_27, Size=number_slider_31, Colour=swatch_2, Justification=5)

# ---- group: module meshes lego at orgin
mesh_26 = Mesh(movetoorgin)

mesh_27 = Mesh(movetoorgin_2)

# ----
item_29 = ListItem(List=mesh_27, Index=int_130, Wrap=False)
rotate = Rotate(Geometry=item_29, Angle=degrees(int_131), Plane=PlaneXY(0, 0, 0))  # -> Geometry, Transform
move_11 = Move(Geometry=rotate.Geometry, Motion=vec2pt.Vector)  # -> Geometry, Transform

# ---- group: res/off
tag_18 = TextTag3D(Location=pt_75, Text=item_28, Size=number_slider_31, Colour=swatch_2, Justification=5)

# ----
mesh_28 = Mesh(movetoorgin_3)
pshift_34 = ShiftPaths(Data=crv_14, Offset=-1)
lng_6 = ListLength(List=pshift_34)
larger = LargerThan(FirstNumber=lng_6, SecondNumber=1)  # -> LargerThan, OrEqualTo

# ---- group: PEV / road quator 0s
mesh_29 = Mesh([<mesh referenced from the Rhino model> x4])
pt_76 = Point(<point referenced from the Rhino model>)

# ---- group: PEV / center line quator 0s
mesh_30 = Mesh(mesh_21)
pt_77 = Point(pt_66)

# ---- group: PEV / sidewalk quator 0s
mesh_31 = Mesh([<mesh referenced from the Rhino model> x4])
pt_78 = Point(<point referenced from the Rhino model>)

# ----
Z_2 = UnitZ(Factor=move_z)
Z_3 = UnitZ(Factor=move_z_2)
Z_4 = UnitZ(Factor=move_z_3)

# ---- group: dock lego modules
mesh_32 = Mesh(move_11.Geometry)

# ----
larger_2 = LargerThan(FirstNumber=int_118, SecondNumber="0")  # -> LargerThan, OrEqualTo
smaller = SmallerThan(FirstNumber=int_118, SecondNumber="5")  # -> SmallerThan, OrEqualTo
larger_3 = LargerThan(FirstNumber=int_118, SecondNumber="0")  # -> LargerThan, OrEqualTo
smaller_2 = SmallerThan(FirstNumber=int_118, SecondNumber="5")  # -> SmallerThan, OrEqualTo
runion = RegionUnion(Curves=pshift_34)

# ---- group: PEV / road quator 1s
mesh_33 = Mesh([<mesh referenced from the Rhino model> x4])
pt_79 = Point(<point referenced from the Rhino model>)

# ---- group: PEV
scale_nu_7 = ScaleNU(Geometry=mesh_29, Plane=pt_76, ScaleX=num_62, ScaleY=num_62, ScaleZ=1)  # -> Geometry, Transform
scale_nu_8 = ScaleNU(Geometry=mesh_33, Plane=pt_79, ScaleX=num_62, ScaleY=num_62, ScaleZ=1)  # -> Geometry, Transform

# ---- group: PEV / center line quator 1s
mesh_34 = Mesh(mesh_24)
pt_80 = Point(pt_72)

# ---- group: PEV
scale_nu_9 = ScaleNU(Geometry=mesh_30, Plane=pt_77, ScaleX=num_62, ScaleY=num_62, ScaleZ=1)  # -> Geometry, Transform
scale_nu_10 = ScaleNU(Geometry=mesh_34, Plane=pt_80, ScaleX=num_62, ScaleY=num_62, ScaleZ=1)  # -> Geometry, Transform

# ---- group: PEV / sidewalk quator 1s
mesh_35 = Mesh([<mesh referenced from the Rhino model> x4])
pt_81 = Point(<point referenced from the Rhino model>)

# ---- group: PEV
scale_nu_11 = ScaleNU(Geometry=mesh_31, Plane=pt_78, ScaleX=num_62, ScaleY=num_62, ScaleZ=1)  # -> Geometry, Transform
scale_nu_12 = ScaleNU(Geometry=mesh_35, Plane=pt_81, ScaleX=num_62, ScaleY=num_62, ScaleZ=1)  # -> Geometry, Transform

# ----
subtraction_7 = Subtraction(A=int_126, B=1)  # disabled
and = GateAnd(A=larger_2.OrEqualTo, B=smaller.OrEqualTo)
dispatch_4 = Dispatch(List=int_118, DispatchPattern=and)  # -> ListA, ListB

# ---- group: filted id
int_132 = Integer(dispatch_4.ListA)

# ----
item_30 = ListItem(List=int_51, Index=graft(int_132), Wrap=True)
pshift_35 = ShiftPaths(Data=item_30, Offset=-1)

# ---- group: flr #s
txt_32 = Text(pshift_35)

# ----
item_31 = ListItem(List=num_35, Index=graft(int_132), Wrap=True)
item_32 = ListItem(List=num_33, Index=graft(int_132), Wrap=True)
item_33 = ListItem(List=num_34, Index=graft(int_132), Wrap=True)
pshift_36 = ShiftPaths(Data=item_31, Offset=-1)
pshift_37 = ShiftPaths(Data=item_32, Offset=-1)
pshift_38 = ShiftPaths(Data=item_33, Offset=-1)

# ---- group: old per flr
num_87 = Number(pshift_36)

# ---- group: young per flr
num_88 = Number(pshift_37)

# ---- group: mid per flr
num_89 = Number(pshift_38)

# ----
multiplication_37 = Multiplication(A=num_89, B=txt_32)
multiplication_38 = Multiplication(A=num_88, B=txt_32)
multiplication_39 = Multiplication(A=num_87, B=txt_32)

# ---- group: total ppl in building mid
int_133 = Integer(multiplication_37)

# ---- group: total ppl in building young
int_134 = Integer(multiplication_38)

# ----
addition_13 = Addition(A=int_134, B=int_133)

# ---- group: total ppl in building old
int_135 = Integer(multiplication_39)

# ----
addition_14 = Addition(A=addition_13, B=int_135)

# ---- group: total ppl in building - all
int_136 = Integer(addition_14)

# ----
and_2 = GateAnd(A=larger_3.OrEqualTo, B=smaller_2.OrEqualTo)
panel_112 = Panel("6")  # disabled
simplify = SimplifyCurve(Curve=runion)  # -> Curve, Simplified
filter_13 = StreamFilter(Gate=larger.LargerThan, Stream0=crv_14, Stream1=simplify.Curve)

# ---- group: toggle1
bool_14 = Boolean(bool_13)

# ----
filter_14 = StreamFilter(Gate=bool_14, Stream0=scale_nu.Geometry, Stream1=scale_nu_7.Geometry)
filter_15 = StreamFilter(Gate=bool_14, Stream0=scale_nu_2.Geometry, Stream1=scale_nu_8.Geometry)

# ---- group: toggle1
bool_15 = Boolean(bool_13)

# ----
filter_16 = StreamFilter(Gate=bool_15, Stream0=scale_nu_3.Geometry, Stream1=scale_nu_9.Geometry)
filter_17 = StreamFilter(Gate=bool_15, Stream0=scale_nu_4.Geometry, Stream1=scale_nu_10.Geometry)

# ---- group: toggle1
bool_16 = Boolean(bool_13)

# ----
filter_18 = StreamFilter(Gate=bool_16, Stream0=scale_nu_5.Geometry, Stream1=scale_nu_11.Geometry)
filter_19 = StreamFilter(Gate=bool_16, Stream0=scale_nu_6.Geometry, Stream1=scale_nu_12.Geometry)
panel_113 = Panel("0.0 to 8000")  # disabled
panel_114 = Panel("0.0 to 12000")  # disabled
subtraction_8 = Subtraction(A=subtraction_7, B=num_80)  # disabled
dispatch_5 = Dispatch(List=int_118, DispatchPattern=and)  # -> ListA, ListB
dispatch_6 = Dispatch(List=int_118, DispatchPattern=and_2)  # -> ListA, ListB

# ---- group: translate example
pt_82 = Point(Point(-15, -8, 0))  # disabled
python_8 = PythonScript(point=pt_82)  # -> out, output; inputs point: Point3d; disabled
# ---------- python_8: Python ----------
import Rhino

transform = Rhino.Geometry.Transform.Translation(0,0,5)
point.Transform(transform)

output = point
# ---------- end python_8 ----------

# ----
int_137 = Integer()
panel_115 = Panel(int_137)

# ---- group: toggle1
# Toggles
bool_17 = Boolean(bool_7)

# ---- group: toggle2
bool_18 = Boolean(bool_9)

bool_19 = Boolean(bool_18)  # disabled

# ---- group: connected and offset ref crvs
crv_16 = Curve(filter_13)

# ---- group: toggle3
bool_20 = Boolean(bool_8)

# ---- group: toggle4
bool_21 = Boolean(bool_10)

# ----
mesh_36 = Mesh(filter_15)
mesh_37 = Mesh(filter_14)
mesh_38 = Mesh(filter_17)
smaller_3 = SmallerThan(FirstNumber=int_118, SecondNumber="0")  # -> SmallerThan, OrEqualTo
mesh_39 = Mesh(filter_16)
larger_4 = LargerThan(FirstNumber=int_118, SecondNumber="6")  # -> LargerThan, OrEqualTo
mesh_40 = Mesh(filter_19)
hatchtable = HatchTable(Update=True)
mesh_41 = Mesh(filter_18)
item_34 = ListItem(List=mesh_27, Index=graft(dispatch_5.ListA), Wrap=False)
item_35 = ListItem(List=mesh_28, Index=graft(dispatch_6.ListA), Wrap=False)
fillet = FilletDistance(Curve=[crv_16, crv_15], Distance=Slider(15, range=0..100))

# ---- group: x flipped
num_90 = Number(subtraction_8)  # disabled

# ---- group: blink2
filter_20 = StreamFilter(Gate=Slider(1, range=0..1), Stream1=[crv_9, crv_10, crv_11])

# ----
filter_21 = StreamFilter(Gate=bool_14, Stream0=pt_65, Stream1=pt_76)
filter_22 = StreamFilter(Gate=bool_14, Stream0=pt_71, Stream1=pt_79)
filter_23 = StreamFilter(Gate=bool_15, Stream0=pt_66, Stream1=pt_77)
filter_24 = StreamFilter(Gate=bool_15, Stream0=pt_72, Stream1=pt_80)
filter_25 = StreamFilter(Gate=bool_16, Stream0=pt_67, Stream1=pt_78)
filter_26 = StreamFilter(Gate=bool_16, Stream0=pt_73, Stream1=pt_81)
dispatch_7 = Dispatch(List=pt_69, DispatchPattern=larger_4.LargerThan)  # -> ListA, ListB
rad = Radians(Degrees=Slider(45, range=0..100))
show_google_map = BooleanToggle(False)
filter_27 = StreamFilter(Gate=show_google_map, Stream1=move_10.Geometry)  # disabled
previewmat = CustomPreviewMaterials(Geometry=filter_27, DiffuseColor=swatch, Transparency=panel_109, DiffuseBitmap=panel_107)  # disabled
item_36 = ListItem(List=hatchtable, Index=Slider(1, range=0..1), Wrap=False)
pshift_39 = ShiftPaths(Data=item_34, Offset=-1)
pshift_40 = ShiftPaths(Data=item_35, Offset=-1)
dispatch_8 = Dispatch(List=int_117, DispatchPattern=and)  # -> ListA, ListB
crv_17 = Curve(fillet)
dispatch_9 = Dispatch(List=int_117, DispatchPattern=and_2)  # -> ListA, ListB
vec2pt_2 = Vector2Pt(PointA=Point(0, 0, 0), PointB=dispatch_7.ListA, Unitize=False)  # -> Vector, Length
pt_83 = Point(filter_22)
pt_84 = Point(filter_24)
pt_85 = Point(filter_21)

# ---- group: road check list
python_9 = PythonScript(pt=pt_69, id=int_118, rdType=python_5.rdType, rdQua0=mesh_37, c0=pt_85, rdQua1=mesh_36, c1=pt_83)  # -> out, allRoadMesh; inputs pt: list, id: list, rdType: list, rdQua0: list, rdQua1: list
# ---------- python_9: Python ----------
"""
CityMatrix

written by "Ryan" Yan Zhang <ryanz@mit.edu>
for MIT Media Lab, Changing Place Group
April.6th.2016
"""

import rhinoscriptsyntax as rs
import Rhino.Geometry as rg

allRoadMesh = []

for n in range(len(id)):
    
    if id[n]==6:
        
        for i in range(len(rdType[n])):
            t = rdType[n][i]
            v = rs.PointCoordinates(pt[n])
            if t == 0:
                c = rs.PointCoordinates(c0)
                vx = v[0]-c[0]
                vy = v[1]-c[1]
                new = rs.CopyObject(rdQua0[i],(vx,vy,0.))
            else:
                c = rs.PointCoordinates(c1)
                vx = v[0]-c[0]
                vy = v[1]-c[1]
                new = rs.CopyObject(rdQua1[i],(vx,vy,0.))
            allRoadMesh.append(new)
# ---------- end python_9 ----------

# ----
pt_86 = Point(filter_23)

# ---- group: road check list
python_10 = PythonScript(pt=pt_69, id=int_118, rdType=python_6.rdType, rdQua0=mesh_39, c0=pt_86, rdQua1=mesh_38, c1=pt_84)  # -> out, allRoadMesh; inputs pt: list, id: list, rdType: list, rdQua0: list, rdQua1: list; same code as python_9

# ----
pt_87 = Point(filter_26)
pt_88 = Point(filter_25)

# ---- group: sidewalk check list
python_11 = PythonScript(pt=pt_69, id=int_118, rdType=python_7.rdType, rdQua0=mesh_41, c0=pt_88, rdQua1=mesh_40, c1=pt_87)  # -> out, allRoadMesh; inputs pt: list, id: list, rdType: list, rdQua0: list, rdQua1: list; same code as python_9

# ----
dashline2_0 = DashLine20(crv=crv_17, num=Slider(7.5, range=0..100))
createhatch = CreateHatch(Bake=Toggle(False), Curves=crv_17, HatchPatternName=item_36, HatchScale=Slider(75, range=0..100), HatchRotation=rad)
swatch_3 = ColourSwatch(SwatchColor=RGB(255, 127, 0))
txt_33 = Text(["Amenity On", "Amenity Off"])
txt_34 = Text(["Human Int. On", "Human Int. Off"])
txt_35 = Text(["Sat. Map On", "Sat. Map Off"])
swatch_4 = ColourSwatch(SwatchColor=RGB(255, 0, 0))  # disabled
txt_36 = Text(["Next", "- Next -"])
rotate_2 = Rotate(Geometry=pshift_39, Angle=degrees(dispatch_8.ListA), Plane=PlaneXY(0, 0, 0))  # -> Geometry, Transform
graft_2 = GraftTree(Tree=rotate_2.Transform, IncludeEmptyLists=True, IncludeNullItems=True)
rotate_3 = Rotate(Geometry=pshift_40, Angle=degrees(dispatch_9.ListA), Plane=PlaneXY(0, 0, 0))  # -> Geometry, Transform

# ---- group: solar value
num_91 = Number(num_86)

# ----
bnd = Bounds(Numbers=num_91)
panel_116 = Panel(bnd)
dispatch_10 = Dispatch(List=pt_69, DispatchPattern=and)  # -> ListA, ListB
number_slider_32 = Slider(7, range=0..100)
dispatch_11 = Dispatch(List=pt_69, DispatchPattern=and_2)  # -> ListA, ListB
move_12 = Move(Geometry=mesh_26, Motion=vec2pt_2.Vector)  # -> Geometry, Transform
item_37 = ListItem(List=txt_33, Index=bool_20, Wrap=True)
item_38 = ListItem(List=txt_35, Index=bool_21, Wrap=True)
item_39 = ListItem(List=txt_34, Index=bool_18, Wrap=True)
item_40 = ListItem(List=txt_36, Index=bool_17, Wrap=True)

# ---- group: AI Step
int_138 = Integer()

# ----
panel_117 = Panel(int_138)
swatch_5 = ColourSwatch(SwatchColor=RGB(125, 125, 125))
Y_11 = UnitY(Factor=-100)
remap_4 = RemapNumbers(Value=num_91, Source="500.0 To 1400.0", Target=Domain(0, 1))  # -> Mapped, Clipped
vec2pt_3 = Vector2Pt(PointA=Point(0, 0, 0), PointB=dispatch_10.ListA, Unitize=False)  # -> Vector, Length
equals_8 = Equality(FirstNumber=int_118, SecondNumber="6")  # -> Equality, Inequality
equals_9 = Equality(FirstNumber=int_118, SecondNumber="7")  # -> Equality, Inequality
vec2pt_4 = Vector2Pt(PointA=Point(0, 0, 0), PointB=dispatch_11.ListA, Unitize=False)  # -> Vector, Length
join_9 = TextJoin(Text=["AIStep: ", int_138])
crv_18 = Curve(createhatch)
crv_19 = Curve(dashline2_0)
filter_28 = StreamFilter(Gate=0, Stream0=swatch_4, Stream1=swatch_3)  # disabled
pt_89 = Point(<point referenced from the Rhino model>)
move_13 = Move(Geometry=pt_89, Motion=Y_11)  # -> Geometry, Transform
pt_90 = Point(<point referenced from the Rhino model>)  # disabled
pt_91 = Point(<point referenced from the Rhino model>)  # disabled
pt_92 = Point(<point referenced from the Rhino model>)  # disabled

# ---- group: score range by experience
panel_118 = Panel("-0.4 To 0.4")

# ----
move_14 = Move(Geometry=rotate_2.Geometry, Motion=vec2pt_3.Vector)  # -> Geometry, Transform
graft_3 = GraftTree(Tree=move_14.Transform, IncludeEmptyLists=True, IncludeNullItems=True)
comp = Compound(Transforms=[graft_2, graft_3])
transform = Transform(Geometry=xy, Transform=comp)
pshift_41 = ShiftPaths(Data=transform, Offset=-1)

# ---- group: people dots base plans
pln_2 = Plane(pshift_41)

# ---- group: block #
lng_7 = ListLength(List=pln_2)

# ---- group: seed d
random = Random(Range=Domain(0, 10000), Number=lng_7, Seed=number_slider_4)  # disabled

# ---- group: seed r
random_2 = Random(Range=Domain(0, 10000), Number=lng_7, Seed=number_slider_5)  # disabled

# ---- group: seed d
random_3 = Random(Range=Domain(0, 10000), Number=lng_7, Seed=number_slider_6)  # disabled

random_4 = Random(Range=Domain(0, 10000), Number=lng_7, Seed=number_slider_7)  # disabled

# ---- group: seed r
random_5 = Random(Range=Domain(0, 10000), Number=lng_7, Seed=number_slider_8)  # disabled

random_6 = Random(Range=Domain(0, 10000), Number=lng_7, Seed=number_slider_9)  # disabled

# ----
pshift_42 = ShiftPaths(Data=random_2, Offset=-1)  # disabled
pshift_43 = ShiftPaths(Data=random, Offset=-1)  # disabled
pshift_44 = ShiftPaths(Data=random_5, Offset=-1)  # disabled
pshift_45 = ShiftPaths(Data=random_6, Offset=-1)  # disabled
pshift_46 = ShiftPaths(Data=random_3, Offset=-1)  # disabled
pshift_47 = ShiftPaths(Data=random_4, Offset=-1)  # disabled

# ---- group: d
random_7 = Random(Range=Domain(0, 1), Number=int_134, Seed=pshift_43)  # disabled

# ---- group: r
random_8 = Random(Range=Domain(0, 360), Number=int_134, Seed=pshift_42)  # disabled

# ---- group: d
random_9 = Random(Range=Domain(0, 1), Number=int_133, Seed=pshift_46)  # disabled

random_10 = Random(Range=Domain(0, 1), Number=int_135, Seed=pshift_47)  # disabled

# ---- group: r
random_11 = Random(Range=Domain(0, 360), Number=int_133, Seed=pshift_44)  # disabled

random_12 = Random(Range=Domain(0, 360), Number=int_135, Seed=pshift_45)  # disabled

# ----
graph = GraphMapper(
    random_7,
    x0=0,
    x1=1,
    y0=0,
    y1=1,
    container_name="Bezier",
    cpx=[0, 0.2763824463, 1, 1],
    cpy=[0, 0.2786865234, 0.3680863976, 1])  # disabled
graph_2 = GraphMapper(
    random_9,
    x0=0,
    x1=1,
    y0=0,
    y1=1,
    container_name="Bezier",
    cpx=[0, 0.3430397809, 1, 1],
    cpy=[0, 0.5653408766, 0.3680863976, 1])  # disabled
graph_3 = GraphMapper(
    random_10,
    x0=0,
    x1=1,
    y0=0,
    y1=1,
    container_name="Bezier",
    cpx=[0, 0.2961647809, 0.9886363745, 1],
    cpy=[0, 0.6839488745, 0.5063920021, 1])  # disabled
rad_2 = Radians(Degrees=random_8)  # disabled
rad_3 = Radians(Degrees=random_11)  # disabled
rad_4 = Radians(Degrees=random_12)  # disabled
remap_5 = RemapNumbers(Value=graph, Source=Domain(0, 1), Target=dom)  # -> Mapped, Clipped; disabled
remap_6 = RemapNumbers(Value=graph_2, Source=Domain(0, 1), Target=dom_2)  # -> Mapped, Clipped; disabled
remap_7 = RemapNumbers(Value=graph_3, Source=Domain(0, 1), Target=dom_3)  # -> Mapped, Clipped; disabled
pt_93 = PointCylindrical(BasePlane=graft(pln_2), Angle=rad_2, Radius=remap_5.Mapped, Elevation=0)  # disabled
pt_94 = PointCylindrical(BasePlane=graft(pln_2), Angle=rad_3, Radius=remap_6.Mapped, Elevation=0)  # disabled
pt_95 = PointCylindrical(BasePlane=graft(pln_2), Angle=rad_4, Radius=remap_7.Mapped, Elevation=0)  # disabled
pshift_48 = ShiftPaths(Data=pt_93, Offset=-1)  # disabled
pdecon_27 = Deconstruct(Point=pshift_48)  # -> XComponent, YComponent, ZComponent; disabled
pshift_49 = ShiftPaths(Data=pt_94, Offset=-1)  # disabled
pdecon_28 = Deconstruct(Point=pshift_49)  # -> XComponent, YComponent, ZComponent; disabled
pshift_50 = ShiftPaths(Data=pt_95, Offset=-1)  # disabled
pdecon_29 = Deconstruct(Point=pshift_50)  # -> XComponent, YComponent, ZComponent; disabled
inc = Includes(Value=pdecon_27.YComponent, Domain=Domain(0, 1000))  # -> Includes, Deviation; disabled
inc_2 = Includes(Value=pdecon_27.XComponent, Domain=Domain(0, 1000))  # -> Includes, Deviation; disabled
inc_3 = Includes(Value=pdecon_28.YComponent, Domain=Domain(0, 1000))  # -> Includes, Deviation; disabled
inc_4 = Includes(Value=pdecon_28.XComponent, Domain=Domain(0, 1000))  # -> Includes, Deviation; disabled
inc_5 = Includes(Value=pdecon_29.YComponent, Domain=Domain(0, 1000))  # -> Includes, Deviation; disabled
inc_6 = Includes(Value=pdecon_29.XComponent, Domain=Domain(0, 1000))  # -> Includes, Deviation; disabled
and_3 = GateAnd(A=inc_2.Includes, B=inc.Includes)  # disabled
and_4 = GateAnd(A=inc_4.Includes, B=inc_3.Includes)  # disabled
and_5 = GateAnd(A=inc_6.Includes, B=inc_5.Includes)  # disabled
dispatch_12 = Dispatch(List=pshift_48, DispatchPattern=and_3)  # -> ListA, ListB; disabled
dispatch_13 = Dispatch(List=pshift_49, DispatchPattern=and_4)  # -> ListA, ListB; disabled
dispatch_14 = Dispatch(List=pshift_50, DispatchPattern=and_5)  # -> ListA, ListB; disabled
pt_96 = Point(dispatch_12.ListA)  # disabled
pt_97 = Point(dispatch_13.ListA)  # disabled
pt_98 = Point(dispatch_14.ListA)  # disabled
rnd_reduce_by_ratio = RndReduceByRatio(L=pt_96, B=number_slider_15, S=number_slider_16)  # disabled
rnd_reduce_by_ratio_2 = RndReduceByRatio(L=pt_97, B=number_slider_15, S=number_slider_18)  # disabled
rnd_reduce_by_ratio_3 = RndReduceByRatio(L=pt_98, B=number_slider_15, S=number_slider_20)  # disabled
pt_99 = Point(rnd_reduce_by_ratio)  # disabled
move_15 = Move(Geometry=mesh_11, Motion=pt_99)  # -> Geometry, Transform; disabled
pt_100 = Point(rnd_reduce_by_ratio_2)  # disabled
move_16 = Move(Geometry=mesh_13, Motion=pt_100)  # -> Geometry, Transform; disabled
pt_101 = Point(rnd_reduce_by_ratio_3)  # disabled
move_17 = Move(Geometry=mesh_12, Motion=pt_101)  # -> Geometry, Transform; disabled
mjoin = MeshJoin(Meshes=move_15.Geometry)  # disabled
mjoin_2 = MeshJoin(Meshes=move_17.Geometry)  # disabled
mjoin_3 = MeshJoin(Meshes=move_16.Geometry)  # disabled
mcol_2 = MeshColours(Mesh=mjoin, Colours=mln_young)  # disabled
mcol_3 = MeshColours(Mesh=mjoin_2, Colours=exc_elderly)  # disabled
mcol_4 = MeshColours(Mesh=mjoin_3, Colours=mid_mid_career)  # disabled
preview_8 = CustomPreview(Geometry=pt_100, Shader=mid_mid_career)  # disabled
preview_9 = CustomPreview(Geometry=pt_101, Shader=exc_elderly)  # disabled
filter_29 = StreamFilter(Gate=bool_19, Stream1=mcol_2)  # disabled
filter_30 = StreamFilter(Gate=bool_19, Stream1=mcol_3)  # disabled
preview_10 = CustomPreview(Geometry=pt_99, Shader=mln_young)  # disabled
filter_31 = StreamFilter(Gate=bool_19, Stream1=mcol_4)  # disabled

# ---- group: old ppl dots mesh
mesh_42 = Mesh(filter_30)  # disabled

# ---- group: mid ppl dots mesh
mesh_43 = Mesh(filter_31)  # disabled

# ---- group: young ppl dots mesh
mesh_44 = Mesh(filter_29)  # disabled

# ----
move_18 = Move(Geometry=rotate_3.Geometry, Motion=vec2pt_4.Vector)  # -> Geometry, Transform
or = GateOr(A=equals_8.Equality, B=equals_9.Equality)

# ---- group: solar value - normalized
num_92 = Number(remap_4.Mapped)

# ---- group: amenities
tag_19 = TextTag3D(Location=pt_90, Text=item_37, Size=number_slider_31, Colour=swatch_2, Justification=5)  # disabled

# ---- group: google map
tag_20 = TextTag3D(Location=pt_91, Text=item_38, Size=number_slider_31, Colour=swatch_2, Justification=5)  # disabled

# ---- group: human interaction
tag_21 = TextTag3D(Location=pt_92, Text=item_39, Size=number_slider_31, Colour=swatch_2, Justification=5)  # disabled

# ---- group: AI Step Next
tag_22 = TextTag3D(Location=move_13.Geometry, Text=item_40, Size=number_slider_32, Colour=swatch_5, Justification=5)

# ---- group: AI Step Int
tag_23 = TextTag3D(Location=pt_89, Text=join_9, Size=number_slider_32, Colour=swatch_5, Justification=5)

# ----
dispatch_15 = Dispatch(List=pt_69, DispatchPattern=or)  # -> ListA, ListB

# ---- group: Dashline
previewlw = CustomPreviewLineweights(Geometry=crv_19, Shader=swatch_3, Thickness=Slider(5, range=0..100))

# ---- group: Arrows
previewlw_2 = CustomPreviewLineweights(Geometry=filter_20, Shader=ColourSwatch(SwatchColor=RGB(255, 127, 0)), Thickness=Slider(7, range=0..100))

# ---- group: Hatch
preview_11 = CustomPreview(Geometry=crv_18, Shader=swatch_3)

# ---- group: green is good, more solar access
gradient = Gradient(LowerLimit=0, UpperLimit=1, Parameter=num_92, stops=[0: RGB(0, 128, 0), 0.5: RGB(222, 222, 0), 1: RGB(255, 0, 0)])  # disabled

# ----
gradient_2 = Gradient(LowerLimit=0, UpperLimit=1, stops=[0: RGB(0, 51, 153), 0.5: RGB(6, 176, 0), 1: RGB(242, 40, 0)])  # disabled
gradient_3 = Gradient(LowerLimit=0, UpperLimit=1, stops=[0: RGB(0, 128, 0), 0.5: RGB(222, 222, 0), 1: RGB(255, 0, 0)])  # disabled
gradient_4 = Gradient(LowerLimit=0, UpperLimit=1, stops=[0: RGB(0, 128, 0), 1: RGB(255, 0, 0)])  # disabled

# ---- group: red is good, more solar access
gradient_5 = Gradient(LowerLimit=0, UpperLimit=1, Parameter=num_92, stops=[0: RGB(255, 0, 0), 0.5: RGB(255, 255, 0), 1: RGB(0, 128, 0)])  # disabled

# ---- group: white is good, more solar access
gradient_6 = Gradient(LowerLimit=0, UpperLimit=1, Parameter=num_92, stops=[0: RGB(0, 50, 199), 1: RGB(255, 255, 0)])

# ----
gradient_7 = Gradient(LowerLimit=0, UpperLimit=1, stops=[0: RGB(0, 51, 153), 0.5: RGB(6, 176, 0), 1: RGB(242, 40, 0)])
gradient_8 = Gradient(LowerLimit=0, UpperLimit=1, stops=[0: RGB(0, 128, 0), 0.5: RGB(222, 222, 0), 1: RGB(255, 0, 0)])
gradient_9 = Gradient(LowerLimit=0, UpperLimit=1, stops=[0: RGB(0, 128, 0), 1: RGB(255, 0, 0)])

# ---- group: Alpha
number_slider_33 = Slider(0.5, range=0..1)  # disabled

# ---- group: road center pts
pt_102 = Point(dispatch_15.ListA)

# ---- group: road mesh final!
mesh_45 = Mesh(python_9.allRoadMesh)

# ---- group: center line mesh final!
mesh_46 = Mesh(python_10.allRoadMesh)

# ----
easter_eggs = EasterEggs(L=pt_69, A_2=int_118, shrink=num_62, L_2=pt_69, A=int_118, shrink_2=num_62)  # disabled

# ---- group: blank
mesh_47 = Mesh(move_12.Geometry)

# ---- group: sidewalk mesh final!
mesh_48 = Mesh(python_11.allRoadMesh)

# ---- group: building lego modules
mesh_49 = Mesh(move_14.Geometry)

# ----
mesh_50 = Mesh(move_18.Geometry)
# AI Weights
panel_119 = Panel("1 to 30")
panel_120 = Panel("""Density
Diversity
Energy
Traffic
Solar""")

# ---- group: AIWeights
num_93 = Number()

# ----
panel_121 = Panel("%")  # disabled

# ---- group: Ref Pts
# Slider 2 - Heatmap Mode
pt_103 = Point([<point referenced from the Rhino model> x5])

# ---- group: Alpha
number_slider_34 = Slider(0.5, range=0..1)

# ----
filter_32 = StreamFilter(Gate=show_google_map, Stream0=mesh_49)
filter_33 = StreamFilter(Gate=show_google_map, Stream0=mesh_50)
filter_34 = StreamFilter(Gate=show_google_map, Stream0=mesh_45)
filter_35 = StreamFilter(Gate=show_google_map, Stream0=mesh_46)
filter_36 = StreamFilter(Gate=show_google_map, Stream0=mesh_47)
panel_122 = Panel("""Mobility
Effic.""")
panel_123 = Panel("""Satellite
Imagery""")
panel_124 = Panel("""Pop.
Density""")
panel_125 = Panel("""Exp.
Diversity""")
panel_126 = Panel("""Energy
Effic.""")
filter_37 = StreamFilter(Gate=show_google_map, Stream0=mesh_48)
panel_127 = Panel("""Working
Prox.""")
panel_128 = Panel("""H.M.
Off""")
panel_129 = Panel("""Park
Prox.""")
panel_130 = Panel("""Live/Work
Balance""")
panel_131 = Panel("""Living
Prox.""")
panel_132 = Panel("""Mobility
Perform.""")
panel_133 = Panel("""Solar
Perform.""")

# ---- group: slider1
# Slider
num_94 = Number(num_21)

# ----
range = Range(Domain=panel_119, Steps=100)
argb_2 = SplitARGB(Colour=gradient_6)  # -> Alpha, Red, Green, Blue

# ---- group: road color - none
swatch_6 = ColourSwatch(SwatchColor=RGB(64, 64, 64))  # disabled

# ----
lng_8 = ListLength(List=num_93)
multiplication_40 = Multiplication(A=num_94, B=100)
multiplication_41 = Multiplication(A=num_93, B=100)  # disabled
txt_37 = Text(panel_120)
txt_38 = Text(panel_121)  # disabled
txt_39 = Text("")
int_139 = Integer(range)
repeat_8 = RepeatData(Data=txt_39, Length=lng_8)
repeat_9 = RepeatData(Data=txt_38, Length=lng_8)  # disabled
int_140 = Integer(multiplication_41)  # disabled
txt_40 = Text(int_139)
int_141 = Integer(multiplication_40)
merge_16 = Merge(
    Data1=panel_128,
    Data2=panel_123,
    Data3=panel_124,
    Data4=panel_125,
    Data5=panel_126,
    Data6=panel_127,
    Data7=panel_131,
    Data8=panel_129,
    Data9=panel_130,
    Data10=panel_132,
    Data11=panel_133)
pshift_51 = ShiftPaths(Data=int_140, Offset=-1)  # disabled
pshift_52 = ShiftPaths(Data=repeat_8, Offset=-2)
pshift_53 = ShiftPaths(Data=repeat_9, Offset=-2)  # disabled
num_95 = Number(number_slider)
frgb_21 = ColourRGBF(Alpha=num_95, Red=argb_2.Red, Green=argb_2.Green, Blue=argb_2.Blue)
python_12 = PythonScript(x=merge_16)  # -> out, a; inputs x: list
# ---------- python_12: Python ----------
a = [i for i in range(len(x))]
# ---------- end python_12 ----------
swatch_7 = ColourSwatch(SwatchColor=RGB(255, 255, 255))

# ---- group: road color - none
col_45 = Colour(swatch_6)  # disabled

# ---- group: Position Calibration / road mesh final!
mesh_51 = Mesh(filter_34)

# ---- group: Position Calibration / center line mesh final!
mesh_52 = Mesh(filter_35)

# ---- group: center line mesh final!
# Traffic Heatmap - Ryan - Crude
mesh_53 = Mesh(mesh_52)  # disabled

# ----
pshift_54 = ShiftPaths(Data=mesh_53, Offset=-3)  # disabled
area = Area(Geometry=pshift_54)  # -> Area, Centroid; disabled

# ---- group: center pts
pt_104 = Point(area.Centroid)  # disabled

# ----
cps = ClosestPoints(Point=pt_104, Cloud=pt_45, Count=1)  # -> ClosestPoint, CPIndex, Distance; disabled
pshift_55 = ShiftPaths(Data=cps.ClosestPoint, Offset=-1)  # disabled
dist_2 = Distance(PointA=graft(pshift_55), PointB=crossings)  # disabled
bnd_2 = Bounds(Numbers=dist_2)  # disabled
dedomain = DeconstructDomain(Domain=bnd_2)  # -> Start, End; disabled
pshift_56 = ShiftPaths(Data=dedomain.Start, Offset=-1)  # disabled

# ---- group: min dis to intersections
num_96 = Number(pshift_56)  # disabled

# ----
bnd_3 = Bounds(Numbers=num_96)  # disabled
remap_8 = RemapNumbers(Value=num_96, Source=bnd_3, Target=Domain(0, 1))  # -> Mapped, Clipped; disabled
subtraction_9 = Subtraction(A=1, B=remap_8.Mapped)  # disabled
graph_4 = GraphMapper(
    subtraction_9,
    x0=0,
    x1=1,
    y0=0,
    y1=0.5,
    container_name="Bezier",
    cpx=[0, 0.1613658518, 0.7159118652, 1],
    cpy=[0, 0.3613502979, 0.9704423547, 1])  # disabled

# ---- group: heatmap color - solar
col_46 = Colour(frgb_21)

# ----
item_41 = ListItem(List=txt_40, Index=int_141, Wrap=True)

# ---- group: Position Calibration / building lego modules
mesh_54 = Mesh(filter_32)

# ---- group: Position Calibration / blank
mesh_55 = Mesh(filter_36)

# ---- group: Position Calibration / sidewalk mesh final!
mesh_56 = Mesh(filter_37)

# ----
merge_17 = Merge(Data1=graft(txt_37), Data2=graft(pshift_52), Data3=graft(pshift_51), Data4=graft(pshift_53))
pt_105 = Point(<point referenced from the Rhino model>)

# ---- group: fl # slider
tag_24 = TextTag3D(Location=pt_105, Text=item_41, Size=Slider(16, range=0..100), Colour=swatch_2, Justification=8)

# ----
join_10 = TextJoin(Text=merge_17)
pshift_57 = ShiftPaths(Data=join_10, Offset=-1)
python_13 = PythonScript(x=list)  # -> out, a
# ---------- python_13: Python ----------
if x < 1000:
    a = str(x)+"m"
elif x> 1000:
    a = str(x//1000) +"," + str(x%1000) + "m"
# ---------- end python_13 ----------

pt_106 = Point([<point referenced from the Rhino model> x2])
tag_25 = TextTag3D(Location=pt_106, Text=python_13.a, Size=Slider(15, range=0..100), Colour=swatch_7, Justification=5)

python_14 = PythonScript(x=list)  # -> out, a
# ---------- python_14: Python ----------
x = x/0.276225

a = "1:"+str(int(x/100)*100 )
# ---------- end python_14 ----------

pt_107 = Point(<point referenced from the Rhino model>)
tag_26 = TextTag3D(Location=pt_107, Text=python_14.a, Size=Slider(15, range=0..100), Colour=swatch_7, Justification=4)

txt_41 = Text(pshift_57)
panel_134 = Panel(txt_41)

# ---- group: cell size
num_97 = Number(num_76)

# ---- group: module id
int_142 = Integer(int_40)

int_143 = Integer(int_40)

# ---- group: fl # slider
tag_27 = TextTag3D(
    Location=pt_103,
    Text=txt_41,
    Size=Slider(12, range=0..100),
    Colour=ColourSwatch(SwatchColor=RGB(255, 255, 255)),
    Justification=1)

# ---- group: cell size
num_98 = Number(num_76)

# ---- group: shrink
cell_shrink_3 = Slider(1, range=0.75..1)

# ----
move_z_4 = Slider(6.5, range=0..30)

# ---- group: shrink
cell_shrink_4 = Slider(1, range=0.75..1)

# ----
move_z_5 = Slider(6.5, range=0..30)

# ---- group: Diversity Formular
# Population Diversity Heatmap - GH
panel_135 = Panel("\CityMatrix_ML\01_Software\RH_GH\Grasshopper\ImagesInGH\Diversity Formular.PNG")  # disabled
path_3 = FilePath("C:\Users\RYAN\Dropbox (MIT)\01_Work\Share\_CityScope\CityMatrix_ML\01_Software\RH_GH\Grasshopper\ImagesInGH\Diversity Formular.PNG")  # disabled
panel_136 = Panel(path_3)  # disabled
load_bitmap_2 = LoadBitmap(FilePathToImageLocation=path_3)  # disabled

# ---- group: floor num for each type
int_144 = Integer(int_46)

# ---- group: colortizer orgin
pt_108 = Point(pt_60)

# ---- group: # ppl per flr
num_99 = Number(num_36)

# ---- group: gridExtent_x
int_145 = Integer(int_38)

# ---- group: gridExtent_y
int_146 = Integer(int_39)

# ---- group: x
int_147 = Integer(int_41)

# ---- group: y
int_148 = Integer(int_42)

# ---- group: shrink
num_100 = Number(cell_shrink_3)

# ---- group: floor num for each type
int_149 = Integer(int_46)

# ---- group: colortizer orgin
pt_109 = Point(pt_60)

# ---- group: # ppl per flr
num_101 = Number(num_36)

# ---- group: gridExtent_x
# Population Density Formular:
# Sum of (Nearest N Building Population/Distance to that building)
int_150 = Integer(int_38)

# ---- group: gridExtent_y
int_151 = Integer(int_39)

# ---- group: x
int_152 = Integer(int_41)

# ---- group: y
int_153 = Integer(int_42)

# ---- group: shrink
num_102 = Number(cell_shrink_4)

# ---- group: total parking cell number
# Parking & Park
int_154 = Integer(parking_cell)

# ---- group: cell size
num_103 = Number(division_17)

# ---- group: 3D City / module id
int_155 = Integer(int_40)

# ---- group: parking / meshes lego ref: parking
mesh_57 = Mesh(<mesh referenced from the Rhino model>)  # disabled

# ---- group: blank modules
mesh_58 = Mesh(mesh_47)

# ---- group: meshes lego ref: park
mesh_59 = Mesh(<mesh referenced from the Rhino model>)

# ---- group: total park cell number
int_156 = Integer(park_cell)

# ----
division_18 = Division(A=num_103, B=2.5)

# ---- group: prevent 0
panel_137 = Panel(".000001")

panel_138 = Panel(".000001")  # disabled

panel_139 = Panel(".000001")  # disabled

# ----
multiplication_42 = Multiplication(A=int_144, B=num_99)

# ---- group: note: none of P1, P2, or P3 could be 0 !!!
panel_140 = Panel("(P1*log10(P1)+P2*log10(P2)+P3*log10(P3)+P4*log10(P4)+P5*log10(P5)+P6*log10(P6)) / log10(6) * (-1)")

panel_141 = Panel("(P1*log10(P1)+P2*log10(P2)+P3*log10(P3)) / log10(3) * (-1)")  # disabled

# ---- group: prevent 0
panel_142 = Panel(".000001")  # disabled

# ---- group: note: none of P1, P2, or P3 could be 0 !!!
panel_143 = Panel("(P1*log10(P1)+P2*log10(P2)+P3*log10(P3)) / log10(3) * (-1)")  # disabled

panel_144 = Panel("(P1*log10(P1)+P2*log10(P2)) / log10(2) * (-1)")  # disabled

# ---- group: dockID
int_157 = Integer(int_44)

# ----
multiplication_43 = Multiplication(A=int_149, B=num_101)

# ---- group: influence range - distance limit
number_slider_35 = Slider(217.9, range=0..1000)

# ---- group: infulence range - # nearest
range_count_2 = Slider(49, range=1..130)

# ---- group: 3D City / 3D building site move amount
X_3 = UnitX(Factor="10000")

# ---- group: module center
pt_110 = Point(modulecenter.pt_5)

# ----
# On Dashboard
panel_145 = Panel("-1")
# Activation Mask
# On LEGOs
srf = Surface(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)

# ---- group: module id
int_158 = Integer(int_40)

# ---- group: dockID
int_159 = Integer(int_130)

# ----
neg_7 = Negative(Value=division_18)

# ---- group: ref mask srf - R
srf_2 = Surface(<surface referenced from the Rhino model>)

# ---- group: ref mask srf - RM
srf_3 = Surface(<surface referenced from the Rhino model>)

# ---- group: ref mask srf - bar live
srf_4 = Surface(<surface referenced from the Rhino model>)

# ---- group: ref mask srf - RS
srf_5 = Surface(<surface referenced from the Rhino model>)

# ----
geobottomcenter = GeoBottomCenter_2(geo=mesh_58)

# ---- group: influence range - distance limit
number_slider_36 = Slider(200, range=0..1000)

# ---- group: ref mask srf - RL
srf_6 = Surface(<surface referenced from the Rhino model>)

# ---- group: infulence range - # nearest
range_count_3 = Slider(49, range=1..130)

# ----
movetoorgin_4 = MoveToOrgin(G=mesh_59, num=num_62)
mesh_60 = Mesh(srf)
equals_10 = Equality(FirstNumber=int_159, SecondNumber=panel_145)  # -> Equality, Inequality

# ---- group: # ppl per building
num_104 = Number(multiplication_42)

# ----
panel_146 = Panel(num_104)
equals_11 = Equality(FirstNumber=int_158, SecondNumber=int_159)  # -> Equality, Inequality

# ---- group: 3D City / module center
pt_111 = Point(pt_69)

# ---- group: # ppl per building
num_105 = Number(multiplication_43)

# ----
panel_147 = Panel(num_105)
Z_5 = UnitZ(Factor=Slider(6.2, range=0..10))
lng_9 = ListLength(List=geobottomcenter)

# ---- group: 3D City / blank
mesh_61 = Mesh(mesh_47)

# ---- group: 3D City / sidewalk mesh final!
mesh_62 = Mesh(python_11.allRoadMesh)

# ---- group: 3D City / road mesh final!
mesh_63 = Mesh(mesh_51)

# ----
equals_12 = Equality(FirstNumber=int_157, SecondNumber="1")  # -> Equality, Inequality
equals_13 = Equality(FirstNumber=int_157, SecondNumber="2")  # -> Equality, Inequality
and_6 = GateAnd(A=equals_13.Inequality, B=equals_12.Inequality)
equals_14 = Equality(FirstNumber=int_157, SecondNumber="0")  # -> Equality, Inequality
and_7 = GateAnd(A=and_6, B=equals_14.Inequality)
equals_15 = Equality(FirstNumber=int_157, SecondNumber="7")  # -> Equality, Inequality
division_19 = Division(A=int_154, B=lng_9)
and_8 = GateAnd(A=equals_12.Inequality, B=equals_15.Inequality)
and_9 = GateAnd(A=equals_13.Inequality, B=equals_15.Inequality)
and_10 = GateAnd(A=equals_14.Inequality, B=equals_15.Inequality)
move_19 = Move(Geometry=mesh_60, Motion=Z_5)  # -> Geometry, Transform

# ---- group: module meshes lego at orgin
mesh_64 = Mesh(movetoorgin_4)

# ----
and_11 = GateAnd(A=and_7, B=equals_15.Inequality)

# ---- group: mask settings
swatch_8 = ColourSwatch(SwatchColor=RGB(0, 0, 0))
panel_148 = Panel(".5")
path_4 = FilePath("C:\Users\RYAN\Documents\GitHub\CityMatrix\Map\MAP_BLACK.png")

# ----
dispatch_16 = Dispatch(List=pt_110, DispatchPattern=equals_11.Inequality)  # -> ListA, ListB
randomsplit = RandomSplitList(MasterList=geobottomcenter, Seed=Slider(32, range=0..100), Split=division_19)  # -> ListA, ListB
lng_10 = ListLength(List=randomsplit.ListA)
division_20 = Division(A=int_156, B=lng_10)
Z_6 = UnitZ(Factor=move_z_4)
filter_38 = StreamFilter(Gate=and_8, Stream1=srf_3)
filter_39 = StreamFilter(Gate=and_11, Stream1=srf_4)
filter_40 = StreamFilter(Gate=and_9, Stream1=srf_5)
filter_41 = StreamFilter(Gate=and_10, Stream1=srf_6)
mesh_65 = Mesh(filter_33)
filter_42 = StreamFilter(Gate=and_11, Stream1=srf_2)
randomsplit_2 = RandomSplitList(MasterList=randomsplit.ListA, Seed=Slider(25, range=0..100), Split=division_20)  # -> ListA, ListB
Z_7 = UnitZ(Factor=move_z_5)

# ---- group: mask setting
swatch_9 = ColourSwatch(SwatchColor=RGBA(0, 0, 0, 127))

# ---- group: 3D City / cell size
num_106 = Number(division_17)

# ---- group: cell area
sqr = Square(Value=num_106)

# ----
multiplication_44 = Multiplication(A=sqr, B=number_slider_10)

# ---- group: floor area
num_107 = Number(multiplication_44)

# ----
vec2pt_5 = Vector2Pt(PointA=Point(0, 0, 0), PointB=dispatch_16.ListA, Unitize=False)  # -> Vector, Length

# ---- group: 3D City / 3D building site move amount
vec_3 = Vector(X_3)

# ----
preview_12 = CustomPreview(Geometry=filter_38, Shader=swatch_9)
preview_13 = CustomPreview(Geometry=filter_39, Shader=swatch_9)
preview_14 = CustomPreview(Geometry=filter_40, Shader=swatch_9)
preview_15 = CustomPreview(Geometry=filter_41, Shader=swatch_9)
preview_16 = CustomPreview(Geometry=filter_42, Shader=swatch_9)
move_20 = Move(Geometry=move_19.Geometry, Motion=vec2pt_5.Vector)  # -> Geometry, Transform
# Population Diversity Formular:
# (P1*log10(P1)+P2*log10(P2)+P3*log10(P3)) / log10(3) * (-1)
# P is probability
panel_149 = Panel("""Res. Small
Density
Approximity
Health
Life Quality
Traffic
Energy
Education
Invation""")

# ---- group: parking / parking center
pt_112 = Point(randomsplit.ListB)

# ---- group: park center lego
pt_113 = Point(randomsplit_2.ListB)

# ---- group: 3D City / base height
panel_150 = Panel("5.0")

# ----
mjoin_4 = MeshJoin(Meshes=move_20.Geometry)

# ---- group: ref mask srf - O
srf_7 = Surface(<surface referenced from the Rhino model>)

# ---- group: ref mask srf - OM
srf_8 = Surface(<surface referenced from the Rhino model>)

# ---- group: ref mask srf - bar work
srf_9 = Surface(<surface referenced from the Rhino model>)

# ---- group: ref mask srf - OS
srf_10 = Surface(<surface referenced from the Rhino model>)

# ---- group: ref mask srf - OL
srf_11 = Surface(<surface referenced from the Rhino model>)

# ----
panel_151 = Panel("1.0")  # disabled
panel_152 = Panel("0.0")  # disabled
panel_153 = Panel("1.0")  # disabled
panel_154 = Panel("0.0")  # disabled
vec2pt_6 = Vector2Pt(PointA=Point(0, 0, 0), PointB=pt_113, Unitize=False)  # -> Vector, Length
panel_155 = Panel("1.0")  # disabled
panel_156 = Panel("0.0")  # disabled

# ---- group: 3D City / building height for each type
num_108 = Number(num_23)

# ----
filter_43 = StreamFilter(Gate=equals_10.Equality, Stream0=mjoin_4)
move_21 = Move(Geometry=mesh_64, Motion=vec2pt_6.Vector)  # -> Geometry, Transform
equals_16 = Equality(FirstNumber=int_157, SecondNumber="4")  # -> Equality, Inequality
equals_17 = Equality(FirstNumber=int_157, SecondNumber="5")  # -> Equality, Inequality
and_12 = GateAnd(A=equals_17.Inequality, B=equals_16.Inequality)
equals_18 = Equality(FirstNumber=int_157, SecondNumber="3")  # -> Equality, Inequality
and_13 = GateAnd(A=and_12, B=equals_18.Inequality)
num_109 = Number(panel_151)  # disabled
num_110 = Number(panel_152)  # disabled
num_111 = Number(panel_153)  # disabled
num_112 = Number(panel_154)  # disabled
num_113 = Number(panel_155)  # disabled
num_114 = Number(panel_156)  # disabled
num_115 = Number("1.0")
num_116 = Number("0.0")

number_slider_37 = Slider(1, range=0..10)
argb_3 = SplitARGB(Colour=ColourSwatch(SwatchColor=RGB(0, 0, 0)))  # -> Alpha, Red, Green, Blue
frgb_22 = ColourRGBF(Alpha=Slider(1, range=0..1), Red=argb_3.Red, Green=argb_3.Green, Blue=argb_3.Blue)

and_14 = GateAnd(A=equals_16.Inequality, B=equals_15.Inequality)
and_15 = GateAnd(A=equals_17.Inequality, B=equals_15.Inequality)
and_16 = GateAnd(A=equals_18.Inequality, B=equals_15.Inequality)
previewmat_2 = CustomPreviewMaterials(Geometry=filter_43, DiffuseColor=swatch_8, Transparency=panel_148, DiffuseBitmap=path_4)
and_17 = GateAnd(A=and_13, B=equals_15.Inequality)
filter_44 = StreamFilter(Gate=and_14, Stream1=srf_8)
filter_45 = StreamFilter(Gate=and_17, Stream1=srf_9)
filter_46 = StreamFilter(Gate=and_15, Stream1=srf_10)
filter_47 = StreamFilter(Gate=and_16, Stream1=srf_11)
filter_48 = StreamFilter(Gate=and_17, Stream1=srf_7)

# ---- group: park lego
mesh_66 = Mesh(move_21.Geometry)

# ----
preview_17 = CustomPreview(Geometry=filter_44, Shader=swatch_9)
preview_18 = CustomPreview(Geometry=filter_45, Shader=swatch_9)
preview_19 = CustomPreview(Geometry=filter_46, Shader=swatch_9)
preview_20 = CustomPreview(Geometry=filter_47, Shader=swatch_9)
preview_21 = CustomPreview(Geometry=filter_48, Shader=swatch_9)

# ---- group: 3D City / building height factor
number_slider_38 = Slider(3.1, range=0..10)

# ----
filter_49 = StreamFilter(Gate=show_google_map, Stream0=mesh_66)

# ---- group: score range by experience
panel_157 = Panel("0.0 To 250.0")

# ----
item_42 = ListItem(List=num_104, Index="0", Wrap=False)
item_43 = ListItem(List=num_104, Index="2", Wrap=False)
item_44 = ListItem(List=num_104, Index="1", Wrap=False)
item_45 = ListItem(List=num_104, Index="3", Wrap=False)
item_46 = ListItem(List=num_104, Index="4", Wrap=False)
item_47 = ListItem(List=num_104, Index="5", Wrap=False)

# ---- group: Alpha
number_slider_39 = Slider(0.5, range=0..1)

# ---- group: # ppl per building
num_117 = Number(item_42)
num_118 = Number(item_44)
num_119 = Number(item_43)
num_120 = Number(item_45)
num_121 = Number(item_46)
num_122 = Number(item_47)

# ---- group: Position Calibration / park lego
mesh_67 = Mesh(filter_49)

# ---- group: Alpha
number_slider_40 = Slider(0.5, range=0..1)

# ----
multiplication_45 = Multiplication(A=num_76, B=division_8)
cell_size = Number(multiplication_45)

python_15 = PythonScript(x=Slider(9, range=6..15), scale=division_8)  # -> out, out_2; inputs inL: list
# ---------- python_15: Python ----------
out = x if scale>1 else x+2
# ---------- end python_15 ----------

# ---- group: adjust scales
subtraction_10 = Subtraction(A=python_15.out_2, B="0.75")
dom_4 = ConstructDomain(DomainStart="-0.25", DomainEnd=subtraction_10)

# ----
panel_158 = Panel(dom_4)
remap_9 = RemapNumbers(Value=num_20, Source=Domain(0, 1), Target=panel_158)  # -> Mapped, Clipped

# ---- group: viz ctrl - slider
int_160 = Integer(remap_9.Mapped)

# ----
panel_159 = Panel(int_160)

# ---- group: viz ctrl - slider
int_161 = Integer(int_160)

# ----
panel_160 = Panel(int_161)

# ---- group: viz ctrl - AI override
int_162 = Integer(int_161)

# ----
panel_161 = Panel(int_162)

# ---- group: viz ctrl - AI override
int_163 = Integer(int_162)

# ----
filter_50 = StreamFilter(Gate=int_163, Stream4=int_112)
panel_162 = Panel(int_163)  # disabled

# ---- group: viz ctrl - AI override
int_164 = Integer(int_162)

# ----
filter_51 = StreamFilter(Gate=int_164, Stream5=int_113)
panel_163 = Panel(int_164)

# ---- group: viz ctrl - AI override
# Energy/Cost Efficiency Heatmap - GH
int_165 = Integer(int_162)

# ----
panel_164 = Panel(int_165)
filter_52 = StreamFilter(Gate=int_163, Stream4=num_77)
filter_53 = StreamFilter(Gate=int_164, Stream5=num_78)
filter_54 = StreamFilter(Gate=int_165, Stream4=num_79)
filter_55 = StreamFilter(Gate=int_165, Stream4=int_114)

# ---- group: cell size
num_123 = Number(filter_54)

# ---- group: module id
int_166 = Integer(filter_55)

# ---- group: type / module id
int_167 = Integer(filter_50)  # disabled

# ---- group: cell size
num_124 = Number(filter_52)

# ---- group: type / module id
int_168 = Integer(filter_51)

# ---- group: cell size
num_125 = Number(filter_53)

# ----
modulecenter_2 = ModuleCenter(pt=pt_62, num=num_123, int_2=int_124, int=int_125)  # -> pt_5, transform_2
division_21 = Division(A=num_123, B=2)
neg_8 = Negative(Value=division_21)
modulecenter_3 = ModuleCenter(pt=pt_63, num=num_124, int_2=num_80, int=num_81)  # -> pt_5, transform_2
division_22 = Division(A=num_124, B=2)
neg_9 = Negative(Value=division_22)
modulecenter_4 = ModuleCenter(pt=pt_64, num=num_125, int_2=num_84, int=num_85)  # -> pt_5, transform_2
division_23 = Division(A=num_125, B=2)
neg_10 = Negative(Value=division_23)
larger_5 = LargerThan(FirstNumber=int_166, SecondNumber="0")  # -> LargerThan, OrEqualTo
smaller_4 = SmallerThan(FirstNumber=int_166, SecondNumber="5")  # -> SmallerThan, OrEqualTo
dom_5 = ConstructDomain(DomainStart=neg_8, DomainEnd=division_21)
dom_6 = ConstructDomain(DomainStart=neg_9, DomainEnd=division_22)
dom_7 = ConstructDomain(DomainStart=neg_10, DomainEnd=division_23)
and_18 = GateAnd(A=larger_5.OrEqualTo, B=smaller_4.OrEqualTo)

# ---- group: type / module id
int_169 = Integer(int_167)  # disabled

int_170 = Integer(int_168)

# ----
planesrf_2 = PlaneSurface(Plane=PlaneXY(0, 0, 0), XSize=dom_5, YSize=dom_5)
planesrf_3 = PlaneSurface(Plane=PlaneXY(0, 0, 0), XSize=dom_6, YSize=dom_6)
planesrf_4 = PlaneSurface(Plane=PlaneXY(0, 0, 0), XSize=dom_7, YSize=dom_7)

# ---- group: module center
pt_114 = Point(modulecenter_2.pt_5)

# ---- group: isBuilding
bool_22 = Boolean(and_18)

# ----
scale_nu_13 = ScaleNU(Geometry=planesrf_2, Plane=PlaneXY(0, 0, 0), ScaleX=num_65, ScaleY=num_65, ScaleZ=1)  # -> Geometry, Transform
scale_nu_14 = ScaleNU(Geometry=planesrf_3, Plane=PlaneXY(0, 0, 0), ScaleX=num_66, ScaleY=num_66, ScaleZ=1)  # -> Geometry, Transform
scale_nu_15 = ScaleNU(Geometry=planesrf_4, Plane=PlaneXY(0, 0, 0), ScaleX=num_71, ScaleY=num_71, ScaleZ=1)  # -> Geometry, Transform

# ---- group: module center
pt_115 = Point(modulecenter_3.pt_5)

pt_116 = Point(modulecenter_4.pt_5)

# ----
dispatch_17 = Dispatch(List=int_166, DispatchPattern=bool_22)  # -> ListA, ListB
dispatch_18 = Dispatch(List=pt_114, DispatchPattern=bool_22)  # -> ListA, ListB
move_22 = Move(Geometry=scale_nu_13.Geometry, Motion=Z_2)  # -> Geometry, Transform
move_23 = Move(Geometry=scale_nu_14.Geometry, Motion=Z_3)  # -> Geometry, Transform
move_24 = Move(Geometry=scale_nu_15.Geometry, Motion=Z_4)  # -> Geometry, Transform

# ---- group: module center - building only
pt_117 = Point(dispatch_18.ListA)

# ----
cps_2 = ClosestPoints(Point=pt_114, Cloud=pt_117, Count=range_count)  # -> ClosestPoint, CPIndex, Distance
smaller_5 = SmallerThan(FirstNumber=cps_2.Distance, SecondNumber=number_slider_30)  # -> SmallerThan, OrEqualTo

# ---- group: module id - building only
int_171 = Integer(dispatch_17.ListA)

# ----
item_48 = ListItem(List=int_171, Index=cps_2.CPIndex, Wrap=False)
vec2pt_7 = Vector2Pt(PointA=Point(0, 0, 0), PointB=pt_114, Unitize=False)  # -> Vector, Length

# ---- group: mesh srf at orgin
mesh_68 = Mesh(move_22.Geometry)

# ----
vec2pt_8 = Vector2Pt(PointA=Point(0, 0, 0), PointB=pt_116, Unitize=False)  # -> Vector, Length

# ---- group: mesh srf at orgin
mesh_69 = Mesh(move_23.Geometry)

# ----
dispatch_19 = Dispatch(List=cps_2.ClosestPoint, DispatchPattern=smaller_5.OrEqualTo)  # -> ListA, ListB
dispatch_20 = Dispatch(List=item_48, DispatchPattern=smaller_5.OrEqualTo)  # -> ListA, ListB
dispatch_21 = Dispatch(List=cps_2.Distance, DispatchPattern=smaller_5.OrEqualTo)  # -> ListA, ListB

# ---- group: mesh srf at orgin
mesh_70 = Mesh(move_24.Geometry)

# ----
move_25 = Move(Geometry=mesh_68, Motion=vec2pt_7.Vector)  # -> Geometry, Transform
equals_19 = Equality(FirstNumber=int_169, SecondNumber=panel_112)  # -> Equality, Inequality; disabled
move_26 = Move(Geometry=mesh_70, Motion=vec2pt_8.Vector)  # -> Geometry, Transform

# ---- group: bldg cntr in range
pt_118 = Point(dispatch_19.ListA)

# ---- group: distances in range
num_126 = Number(dispatch_21.ListA)

# ---- group: module ids in range
int_172 = Integer(dispatch_20.ListA)

# ---- group: mesh srfs at module centers
mesh_71 = Mesh(move_25.Geometry)

# ---- group: isRoad
bool_23 = Boolean(equals_19.Equality)  # disabled

# ----
dispatch_22 = Dispatch(List=pt_115, DispatchPattern=bool_23)  # -> ListA, ListB

# ---- group: module center road only
pt_119 = Point(dispatch_22.ListA)

# ----
vec2pt_9 = Vector2Pt(PointA=Point(0, 0, 0), PointB=pt_119, Unitize=False)  # -> Vector, Length; disabled
move_27 = Move(Geometry=mesh_69, Motion=vec2pt_9.Vector)  # -> Geometry, Transform; disabled
dispatch_23 = Dispatch(List=num_82, DispatchPattern=bool_23)  # -> ListA, ListB; disabled
dispatch_24 = Dispatch(List=num_83, DispatchPattern=bool_23)  # -> ListA, ListB; disabled

# ---- group: mesh srfs at module centers
mesh_72 = Mesh(move_27.Geometry)  # disabled

mesh_73 = Mesh(move_26.Geometry)

# ----
item_49 = ListItem(List=panel_105, Index=int_172, Wrap=False)
item_50 = ListItem(List=int_121, Index=int_172, Wrap=False)
addition_15 = Addition(A=num_126, B=num_123)

# ---- group: traffic value - road
num_127 = Number(dispatch_23.ListA)  # disabled

# ----
bnd_4 = Bounds(Numbers=num_127)  # disabled
panel_165 = Panel(bnd_4)  # disabled

# ---- group: wait value - road
num_128 = Number(dispatch_24.ListA)  # disabled

# ----
bnd_5 = Bounds(Numbers=num_128)  # disabled
panel_166 = Panel(bnd_5)  # disabled
multiplication_46 = Multiplication(A=item_49, B=item_50)
dispatch_25 = Dispatch(List=num_82, DispatchPattern=bool_23)  # -> ListA, ListB; disabled

pt_120 = Point(<point referenced from the Rhino model>)
pt_121 = Point(<point referenced from the Rhino model>)
ln_4 = Line(StartPoint=pt_120, EndPoint=pt_121)
subtraction_11 = Subtraction(A=python_15.out_2, B="1")
divide_4 = DivideCurve(Curve=ln_4, Count=subtraction_11, Kinks=False)  # -> Points, Tangents, Parameters

remap_10 = RemapNumbers(Value=num_127, Source=panel_113, Target=Domain(0, 1))  # -> Mapped, Clipped; disabled

crv_20 = Curve(<curve referenced from the Rhino model>)
subtraction_12 = Subtraction(A=python_15.out_2, B="0")
divide_5 = DivideCurve(Curve=crv_20, Count=subtraction_12, Kinks=False)  # -> Points, Tangents, Parameters

# ---- group: energy/cost efficiency in range
num_129 = Number(multiplication_46)

# ----
remap_11 = RemapNumbers(Value=num_128, Source=panel_114, Target=Domain(0, 1))  # -> Mapped, Clipped; disabled

# ---- group: distances in range - avoid 0
num_130 = Number(addition_15)

# ---- group: traffic value road only
num_131 = Number(dispatch_25.ListA)  # disabled

# ----
division_24 = Division(A=num_129, B=num_130)

# ---- group: traffic value - normalized
num_132 = Number(remap_10.Mapped)  # disabled

# ---- group: wait value - normalized
num_133 = Number(remap_11.Mapped)  # disabled

# ----
gradient_10 = Gradient(LowerLimit=0, UpperLimit=1, Parameter=num_132, stops=[0: RGB(0, 128, 0), 0.5: RGB(222, 222, 0), 1: RGB(255, 0, 0)])  # disabled
gradient_11 = Gradient(LowerLimit=0, UpperLimit=1, Parameter=num_132, stops=[0: RGB(255, 255, 255), 1: RGB(0, 0, 0)])  # disabled
gradient_12 = Gradient(LowerLimit=0, UpperLimit=1, Parameter=num_133, stops=[0: RGB(0, 128, 0), 0.5: RGB(222, 222, 0), 1: RGB(255, 0, 0)])  # disabled
ma_15 = MassAddition(Input=division_24)  # -> Result, PartialResults

# ---- group: Ref Pts
pt_122 = Point(divide_4.Points)

# ----
item_51 = ListItem(List=pt_122, Index="0", Wrap=True)
item_52 = ListItem(List=pt_122, Index="1", Wrap=True)
dist_3 = Distance(PointA=item_51, PointB=item_52)
division_25 = Division(A=dist_3, B="2")
vec_4 = VectorXYZ(XComponent=division_25, YComponent=0, ZComponent=0)  # -> Vector, Length
move_28 = Move(Geometry=pt_122, Motion=vec_4.Vector)  # -> Geometry, Transform

# ---- group: Ref Pts
pt_123 = Point(divide_5.Points)

# ----
item_53 = ListItem(List=pt_123, Index="0", Wrap=True)
item_54 = ListItem(List=pt_123, Index="1", Wrap=True)
dist_4 = Distance(PointA=item_53, PointB=item_54)
division_26 = Division(A=dist_4, B="2")
vec_5 = VectorXYZ(XComponent=division_26, YComponent=0, ZComponent=0)  # -> Vector, Length
move_29 = Move(Geometry=pt_123, Motion=vec_5.Vector)  # -> Geometry, Transform

pshift_58 = ShiftPaths(Data=ma_15.Result, Offset=-1)

# ---- group: population density score
num_134 = Number(pshift_58)

# ----
bnd_6 = Bounds(Numbers=num_134)
panel_167 = Panel(bnd_6)
argb_4 = SplitARGB(Colour=gradient_10)  # -> Alpha, Red, Green, Blue; disabled
argb_5 = SplitARGB(Colour=gradient_12)  # -> Alpha, Red, Green, Blue; disabled

pdecon_30 = Deconstruct(Point=item_51)  # -> XComponent, YComponent, ZComponent
pdecon_31 = Deconstruct(Point=item_53)  # -> XComponent, YComponent, ZComponent
python_16 = PythonScript(x=subtraction_12)  # -> out, a; inputs x: Int32
# ---------- python_16: Python ----------
import math
a = []
for n in range(x):
    i = max(n-int(x/2),int(x/2)-n)+2
    a.append(i)
    
print(a)
# ---------- end python_16 ----------
subtraction_13 = Subtraction(A=pdecon_30.YComponent, B=pdecon_31.YComponent)
division_27 = Division(A=subtraction_13, B=python_16.a)

number_slider_41 = Slider(10, range=0..30)
neg_11 = Negative(Value=number_slider_41)
vec_6 = VectorXYZ(XComponent=0, YComponent=Slider(10, range=0..30), ZComponent=0)  # -> Vector, Length
vec_7 = VectorXYZ(XComponent=number_slider_41, YComponent=0, ZComponent=0)  # -> Vector, Length
vec_8 = VectorXYZ(XComponent=neg_11, YComponent=0, ZComponent=0)  # -> Vector, Length
move_30 = Move(Geometry=move_29.Geometry, Motion=vec_7.Vector)  # -> Geometry, Transform
move_31 = Move(Geometry=move_29.Geometry, Motion=vec_8.Vector)  # -> Geometry, Transform
ln_5 = Line(StartPoint=move_30.Geometry, EndPoint=move_31.Geometry)
vec_9 = VectorXYZ(XComponent=0, YComponent=division_27, ZComponent=0)  # -> Vector, Length
split_6 = SplitList(List=ln_5, Index=subtraction_12)  # -> ListA, ListB
crv_21 = Curve(split_6.ListA)
curvepoint = PointOnCurve(crv_21, parameter=0.5)
move_32 = Move(Geometry=curvepoint, Motion=vec_9.Vector)  # -> Geometry, Transform

remap_12 = RemapNumbers(Value=num_134, Source=panel_118, Target=Domain(0, 1))  # -> Mapped, Clipped
max_10 = Maximum(A=remap_12.Mapped, B=0)
min_3 = Minimum(A=max_10, B=1)
frgb_23 = ColourRGBF(Alpha=number_slider_33, Red=argb_4.Red, Green=argb_4.Green, Blue=argb_4.Blue)  # disabled
frgb_24 = ColourRGBF(Alpha=number_slider_33, Red=argb_5.Red, Green=argb_5.Green, Blue=argb_5.Blue)  # disabled

# ---- group: population density score normalized
num_135 = Number(remap_12.Mapped)

# ----
gradient_13 = Gradient(LowerLimit=0, UpperLimit=1, Parameter=num_135, stops=[0: RGB(0, 0, 0), 1: RGB(255, 255, 255)])
gradient_14 = Gradient(LowerLimit=0, UpperLimit=1, Parameter=num_135, stops=[0: RGB(255, 0, 0), 0.5: RGB(222, 222, 0), 1: RGB(0, 128, 0)])
argb_6 = SplitARGB(Colour=gradient_14)  # -> Alpha, Red, Green, Blue
frgb_25 = ColourRGBF(Alpha=num_95, Red=argb_6.Red, Green=argb_6.Green, Blue=argb_6.Blue)

# ---- group: viz color
col_47 = Colour(frgb_25)

# ---- group: road color - wait
col_48 = Colour(frgb_24)  # disabled

# ---- group: road color - traffic
col_49 = Colour(frgb_23)  # disabled

# ----
subtraction_14 = Subtraction(A=subtraction_13, B=division_27)
neg_12 = Negative(Value=subtraction_14)
vec_10 = VectorXYZ(XComponent=0, YComponent=neg_12, ZComponent=0)  # -> Vector, Length
move_33 = Move(Geometry=move_28.Geometry, Motion=vec_6.Vector)  # -> Geometry, Transform
move_34 = Move(Geometry=move_28.Geometry, Motion=vec_10.Vector)  # -> Geometry, Transform
ln_6 = Line(StartPoint=move_34.Geometry, EndPoint=move_33.Geometry)
ln_7 = Line(StartPoint=move_34.Geometry, EndPoint=move_32.Geometry)
ln_8 = Line(StartPoint=curvepoint, EndPoint=move_32.Geometry)

# ---- group: viz ctrl - AI override
int_173 = Integer(int_162)

# ----
equals_20 = Equality(FirstNumber=int_173, SecondNumber=python_12.a)  # -> Equality, Inequality

# ---- group: population density viz
preview_22 = CustomPreview(Geometry=mesh_71, Shader=col_47)

# ----
item_55 = ListItem(List=[ColourSwatch(SwatchColor=RGB(125, 125, 125)), swatch_7], Index=equals_20.Equality, Wrap=False)

# ---- group: wait
preview_23 = CustomPreview(Geometry=mesh_72, Shader=col_48)  # disabled

# ---- group: traffic
preview_24 = CustomPreview(Geometry=mesh_72, Shader=col_49)  # disabled

# ---- group: solar
preview_25 = CustomPreview(Geometry=mesh_73, Shader=col_46)  # disabled

# ----
python_17 = PythonScript(x=subtraction_12, scale=division_8, inL=merge_16)  # -> out, out_2; inputs inL: list
# ---------- python_17: Python ----------
out = inL[:int(x)] if scale>1 else inL
# ---------- end python_17 ----------
python_18 = PythonScript(x=subtraction_12, scale=division_8, inL=item_55)  # -> out, out_2; inputs inL: list; same code as python_17
panel_168 = Panel(int_173)

# ---- group: fl # slider
tag_28 = TextTag3D(Location=pt_122, Text=python_17.out_2, Size=Slider(13.5, range=0..100), Colour=python_18.out_2, Justification=4)

# ----
item_56 = ListItem(List=ln_6, Index=int_173, Wrap=True)
item_57 = ListItem(List=crv_21, Index=int_173, Wrap=True)
item_58 = ListItem(List=ln_8, Index=int_173, Wrap=True)
item_59 = ListItem(List=ln_7, Index=int_173, Wrap=True)
# Population Density Heatmap - GH
previewlw_3 = CustomPreviewLineweights(Geometry=[ln_8, ln_7, ln_6, crv_21], Shader=ColourSwatch(SwatchColor=RGB(125, 125, 125)), Absolute=False)
previewlw_4 = CustomPreviewLineweights(Geometry=[item_57, item_58, item_59, item_56], Shader=ColourSwatch(SwatchColor=RGB(255, 255, 255)), Absolute=False)

# ---- group: viz ctrl - AI override
int_174 = Integer(int_162)

# ----
panel_169 = Panel(int_174)

# ---- group: viz ctrl - AI override
int_175 = Integer(int_162)

# ----
panel_170 = Panel(int_175)
filter_56 = StreamFilter(Gate=int_174, Stream3=int_142)
filter_57 = StreamFilter(Gate=int_174, Stream3=num_97)
filter_58 = StreamFilter(Gate=int_175, Stream2=num_98)
filter_59 = StreamFilter(Gate=int_175, Stream2=int_143)

# ---- group: cell size
num_136 = Number(filter_57)

# ---- group: module id
int_176 = Integer(filter_56)

# ---- group: cell size
num_137 = Number(filter_58)

# ---- group: module id
int_177 = Integer(filter_59)

# ----
modulecenter_5 = ModuleCenter(pt=pt_108, num=num_136, int_2=int_147, int=int_148)  # -> pt_5, transform_2
division_28 = Division(A=num_136, B=2)
neg_13 = Negative(Value=division_28)
modulecenter_6 = ModuleCenter(pt=pt_109, num=num_137, int_2=int_152, int=int_153)  # -> pt_5, transform_2
division_29 = Division(A=num_137, B=2)
neg_14 = Negative(Value=division_29)
larger_6 = LargerThan(FirstNumber=int_176, SecondNumber="0")  # -> LargerThan, OrEqualTo
smaller_6 = SmallerThan(FirstNumber=int_176, SecondNumber="5")  # -> SmallerThan, OrEqualTo
dom_8 = ConstructDomain(DomainStart=neg_13, DomainEnd=division_28)
larger_7 = LargerThan(FirstNumber=int_177, SecondNumber="0")  # -> LargerThan, OrEqualTo
smaller_7 = SmallerThan(FirstNumber=int_177, SecondNumber="5")  # -> SmallerThan, OrEqualTo
dom_9 = ConstructDomain(DomainStart=neg_14, DomainEnd=division_29)
and_19 = GateAnd(A=larger_6.OrEqualTo, B=smaller_6.OrEqualTo)
and_20 = GateAnd(A=larger_7.OrEqualTo, B=smaller_7.OrEqualTo)
planesrf_5 = PlaneSurface(Plane=PlaneXY(0, 0, 0), XSize=dom_8, YSize=dom_8)
planesrf_6 = PlaneSurface(Plane=PlaneXY(0, 0, 0), XSize=dom_9, YSize=dom_9)

# ---- group: module center
pt_124 = Point(modulecenter_5.pt_5)

# ---- group: isBuilding
bool_24 = Boolean(and_19)

# ---- group: module center
pt_125 = Point(modulecenter_6.pt_5)

# ---- group: isBuilding
bool_25 = Boolean(and_20)

# ----
scale_nu_16 = ScaleNU(Geometry=planesrf_5, Plane=PlaneXY(0, 0, 0), ScaleX=num_100, ScaleY=num_100, ScaleZ=1)  # -> Geometry, Transform
scale_nu_17 = ScaleNU(Geometry=planesrf_6, Plane=PlaneXY(0, 0, 0), ScaleX=num_102, ScaleY=num_102, ScaleZ=1)  # -> Geometry, Transform
dispatch_26 = Dispatch(List=int_176, DispatchPattern=bool_24)  # -> ListA, ListB
dispatch_27 = Dispatch(List=pt_124, DispatchPattern=bool_24)  # -> ListA, ListB
move_35 = Move(Geometry=scale_nu_16.Geometry, Motion=Z_6)  # -> Geometry, Transform
dispatch_28 = Dispatch(List=int_177, DispatchPattern=bool_25)  # -> ListA, ListB
dispatch_29 = Dispatch(List=pt_125, DispatchPattern=bool_25)  # -> ListA, ListB
move_36 = Move(Geometry=scale_nu_17.Geometry, Motion=Z_7)  # -> Geometry, Transform

# ---- group: module center - building only
pt_126 = Point(dispatch_27.ListA)

# ----
cps_3 = ClosestPoints(Point=pt_126, Cloud=pt_126, Count=range_count_2)  # -> ClosestPoint, CPIndex, Distance
smaller_8 = SmallerThan(FirstNumber=cps_3.Distance, SecondNumber=number_slider_35)  # -> SmallerThan, OrEqualTo

# ---- group: module id - building only
int_178 = Integer(dispatch_26.ListA)

# ----
item_60 = ListItem(List=int_178, Index=cps_3.CPIndex, Wrap=False)
vec2pt_10 = Vector2Pt(PointA=Point(0, 0, 0), PointB=pt_126, Unitize=False)  # -> Vector, Length

# ---- group: module center - building only
pt_127 = Point(dispatch_29.ListA)

# ----
cps_4 = ClosestPoints(Point=pt_125, Cloud=pt_127, Count=range_count_3)  # -> ClosestPoint, CPIndex, Distance
smaller_9 = SmallerThan(FirstNumber=cps_4.Distance, SecondNumber=number_slider_36)  # -> SmallerThan, OrEqualTo

# ---- group: module id - building only
int_179 = Integer(dispatch_28.ListA)

# ----
item_61 = ListItem(List=int_179, Index=cps_4.CPIndex, Wrap=False)

# ---- group: mesh srf at orgin
mesh_74 = Mesh(move_35.Geometry)

# ----
vec2pt_11 = Vector2Pt(PointA=Point(0, 0, 0), PointB=pt_125, Unitize=False)  # -> Vector, Length
dispatch_30 = Dispatch(List=item_60, DispatchPattern=smaller_8.OrEqualTo)  # -> ListA, ListB

# ---- group: mesh srf at orgin
mesh_75 = Mesh(move_36.Geometry)

# ----
dispatch_31 = Dispatch(List=cps_4.ClosestPoint, DispatchPattern=smaller_9.OrEqualTo)  # -> ListA, ListB
dispatch_32 = Dispatch(List=item_61, DispatchPattern=smaller_9.OrEqualTo)  # -> ListA, ListB
dispatch_33 = Dispatch(List=cps_4.Distance, DispatchPattern=smaller_9.OrEqualTo)  # -> ListA, ListB
move_37 = Move(Geometry=mesh_74, Motion=vec2pt_10.Vector)  # -> Geometry, Transform
move_38 = Move(Geometry=mesh_75, Motion=vec2pt_11.Vector)  # -> Geometry, Transform

# ---- group: module ids in range
int_180 = Integer(dispatch_30.ListA)

# ---- group: mesh srfs at module centers
mesh_76 = Mesh(move_37.Geometry)

# ---- group: bldg cntr in range
pt_128 = Point(dispatch_31.ListA)

# ---- group: distances in range
num_138 = Number(dispatch_33.ListA)

# ---- group: module ids in range
int_181 = Integer(dispatch_32.ListA)

# ---- group: mesh srfs at module centers
mesh_77 = Mesh(move_38.Geometry)

# ----
equals_21 = Equality(FirstNumber=int_180, SecondNumber="3")  # -> Equality, Inequality
equals_22 = Equality(FirstNumber=int_180, SecondNumber="5")  # -> Equality, Inequality
equals_23 = Equality(FirstNumber=int_180, SecondNumber="4")  # -> Equality, Inequality
equals_24 = Equality(FirstNumber=int_180, SecondNumber="0")  # -> Equality, Inequality
equals_25 = Equality(FirstNumber=int_180, SecondNumber="2")  # -> Equality, Inequality
equals_26 = Equality(FirstNumber=int_180, SecondNumber="1")  # -> Equality, Inequality
item_62 = ListItem(List=num_105, Index=int_181, Wrap=False)
addition_16 = Addition(A=num_138, B=num_137)
int_182 = Integer(equals_21.Equality)
int_183 = Integer(equals_24.Equality)
int_184 = Integer(equals_23.Equality)
int_185 = Integer(equals_22.Equality)
int_186 = Integer(equals_26.Equality)
int_187 = Integer(equals_25.Equality)
ma_16 = MassAddition(Input=int_182)  # -> Result, PartialResults
ma_17 = MassAddition(Input=int_185)  # -> Result, PartialResults
ma_18 = MassAddition(Input=int_184)  # -> Result, PartialResults
ma_19 = MassAddition(Input=int_183)  # -> Result, PartialResults
ma_20 = MassAddition(Input=int_187)  # -> Result, PartialResults
ma_21 = MassAddition(Input=int_186)  # -> Result, PartialResults

# ---- group: distances in range - avoid 0
num_139 = Number(addition_16)

# ---- group: # ppl in range
num_140 = Number(item_62)

# ---- group: building # in range
int_188 = Integer(ma_19.Result)
int_189 = Integer(ma_21.Result)
int_190 = Integer(ma_20.Result)
int_191 = Integer(ma_16.Result)
int_192 = Integer(ma_18.Result)
int_193 = Integer(ma_17.Result)

# ----
division_30 = Division(A=num_140, B=num_139)
ma_22 = MassAddition(Input=division_30)  # -> Result, PartialResults
pshift_59 = ShiftPaths(Data=ma_22.Result, Offset=-1)
multiplication_47 = Multiplication(A=int_191, B=num_120)
multiplication_48 = Multiplication(A=int_189, B=num_118)
multiplication_49 = Multiplication(A=int_192, B=num_121)
multiplication_50 = Multiplication(A=int_193, B=num_122)
multiplication_51 = Multiplication(A=int_188, B=num_117)
multiplication_52 = Multiplication(A=int_190, B=num_119)

# ---- group: population density score
num_141 = Number(pshift_59)

# ----
bnd_7 = Bounds(Numbers=num_141)
panel_171 = Panel(bnd_7)
pshift_60 = ShiftPaths(Data=multiplication_47, Offset=-1)
pshift_61 = ShiftPaths(Data=multiplication_48, Offset=-1)
pshift_62 = ShiftPaths(Data=multiplication_51, Offset=-1)
pshift_63 = ShiftPaths(Data=multiplication_52, Offset=-1)
pshift_64 = ShiftPaths(Data=multiplication_49, Offset=-1)
pshift_65 = ShiftPaths(Data=multiplication_50, Offset=-1)
remap_13 = RemapNumbers(Value=num_141, Source=panel_157, Target=Domain(0, 1))  # -> Mapped, Clipped
max_11 = Maximum(A=remap_13.Mapped, B=0)
min_4 = Minimum(A=max_11, B=1)

# ---- group: total # ppl in range
num_142 = Number(pshift_62)
num_143 = Number(pshift_61)
num_144 = Number(pshift_63)
num_145 = Number(pshift_60)
num_146 = Number(pshift_64)
num_147 = Number(pshift_65)

num_148 = Number(num_142)
num_149 = Number(num_143)
num_150 = Number(num_144)
num_151 = Number(num_145)
num_152 = Number(num_146)
num_153 = Number(num_147)

# ----
addition_17 = Addition(A=num_151, B=num_152)  # disabled
addition_18 = Addition(A=num_148, B=num_149)  # disabled
addition_19 = Addition(A=addition_17, B=num_153)  # disabled
addition_20 = Addition(A=addition_18, B=num_150)  # disabled

# ---- group: living
num_154 = Number(addition_20)  # disabled

# ---- group: working
num_155 = Number(addition_19)  # disabled

# ---- group: RL pop.
num_156 = Number(graft(num_148))

# ---- group: OL pop.
num_157 = Number(graft(num_151))

# ---- group: RS pop.
num_158 = Number(graft(num_150))

# ---- group: OS pop.
num_159 = Number(graft(num_153))

# ---- group: OL pop.
num_160 = Number(graft(num_151))  # disabled

# ---- group: OM pop.
num_161 = Number(graft(num_152))

# ---- group: RM pop.
num_162 = Number(graft(num_149))

# ---- group: OS pop.
num_163 = Number(graft(num_153))  # disabled

# ---- group: OM pop.
num_164 = Number(graft(num_152))  # disabled

# ---- group: RL pop.
num_165 = Number(graft(num_148))  # disabled

# ---- group: RS pop.
num_166 = Number(graft(num_150))  # disabled

# ---- group: RM pop.
num_167 = Number(graft(num_149))  # disabled

# ---- group: R pop.
num_168 = Number(graft(num_154))  # disabled

# ---- group: O pop.
num_169 = Number(graft(num_155))  # disabled

# ----
addition_21 = Addition(A=num_159, B=panel_137)
addition_22 = Addition(A=num_158, B=panel_137)
addition_23 = Addition(A=num_157, B=panel_137)
addition_24 = Addition(A=num_156, B=panel_137)
addition_25 = Addition(A=num_161, B=panel_137)
addition_26 = Addition(A=num_162, B=panel_137)
addition_27 = Addition(A=num_163, B=panel_138)  # disabled
addition_28 = Addition(A=num_160, B=panel_138)  # disabled
addition_29 = Addition(A=num_164, B=panel_138)  # disabled
addition_30 = Addition(A=num_166, B=panel_139)  # disabled
addition_31 = Addition(A=num_165, B=panel_139)  # disabled
addition_32 = Addition(A=num_167, B=panel_139)  # disabled
addition_33 = Addition(A=num_168, B=panel_142)  # disabled
addition_34 = Addition(A=num_169, B=panel_142)  # disabled
ma_23 = MassAddition(Input=[addition_24, addition_26, addition_22, addition_23, addition_25, addition_21])  # -> Result, PartialResults
ma_24 = MassAddition(Input=[addition_28, addition_29, addition_27])  # -> Result, PartialResults; disabled
ma_25 = MassAddition(Input=[addition_31, addition_32, addition_30])  # -> Result, PartialResults; disabled
ma_26 = MassAddition(Input=[addition_33, addition_34])  # -> Result, PartialResults; disabled

# ---- group: total O. pop.
num_170 = Number(ma_23.Result)

# ----
division_31 = Division(A=addition_23, B=num_170)
division_32 = Division(A=addition_24, B=num_170)
division_33 = Division(A=addition_21, B=num_170)
division_34 = Division(A=addition_22, B=num_170)
division_35 = Division(A=addition_25, B=num_170)
division_36 = Division(A=addition_26, B=num_170)

# ---- group: total O. pop.
num_171 = Number(ma_24.Result)  # disabled

# ----
division_37 = Division(A=addition_28, B=num_171)  # disabled
division_38 = Division(A=addition_27, B=num_171)  # disabled
division_39 = Division(A=addition_29, B=num_171)  # disabled

# ---- group: total res. pop.
num_172 = Number(ma_25.Result)  # disabled

# ----
division_40 = Division(A=addition_31, B=num_172)  # disabled
division_41 = Division(A=addition_30, B=num_172)  # disabled
division_42 = Division(A=addition_32, B=num_172)  # disabled

# ---- group: total O. pop.
num_173 = Number(ma_26.Result)  # disabled

# ----
division_43 = Division(A=addition_33, B=num_173)  # disabled
division_44 = Division(A=addition_34, B=num_173)  # disabled

# ---- group: % RL pop.
num_174 = Number(division_32)

# ---- group: % OL pop.
num_175 = Number(division_31)

# ---- group: % RM pop.
num_176 = Number(division_36)

# ---- group: % OM pop.
num_177 = Number(division_35)

# ---- group: % OL pop.
num_178 = Number(division_37)  # disabled

# ---- group: % RS pop.
num_179 = Number(division_34)

# ---- group: % OS pop.
num_180 = Number(division_33)

# ---- group: % OM pop.
num_181 = Number(division_39)  # disabled

# ---- group: % OS pop.
num_182 = Number(division_38)  # disabled

# ---- group: % RL pop.
num_183 = Number(division_40)  # disabled

# ---- group: % RM pop.
num_184 = Number(division_42)  # disabled

# ---- group: % RS pop.
num_185 = Number(division_41)  # disabled

# ---- group: % OL pop.
num_186 = Number(division_43)  # disabled

# ---- group: % OM pop.
num_187 = Number(division_44)  # disabled

# ---- group: Diversity Calc
eval = Evaluate(F=panel_140, P1=num_174, P2=num_176, P3=num_179, P4=num_175, P5=num_177, P6=num_180)

eval_2 = Evaluate(F=panel_141, P1=num_178, P2=num_181, P3=num_182)  # disabled

eval_3 = Evaluate(F=panel_143, P1=num_183, P2=num_184, P3=num_185)  # disabled

eval_4 = Evaluate(F=panel_144, P1=num_186, P2=num_187)  # disabled

# ----
pshift_66 = ShiftPaths(Data=eval_2, Offset=-1)  # disabled
pshift_67 = ShiftPaths(Data=eval_3, Offset=-1)  # disabled
pshift_68 = ShiftPaths(Data=eval, Offset=-1)
pshift_69 = ShiftPaths(Data=eval_4, Offset=-1)  # disabled

# ---- group: office diversity - all
num_188 = Number(pshift_66)  # disabled

# ---- group: residential diversity - all
num_189 = Number(pshift_67)  # disabled

# ---- group: living working diversity - all
num_190 = Number(pshift_69)  # disabled

# ---- group: diversity - all
num_191 = Number(pshift_68)

# ----
replace = ReplaceMembers(Set=num_188, Find=num_109, Replace=num_110)  # disabled
replace_2 = ReplaceMembers(Set=num_189, Find=num_111, Replace=num_112)  # disabled
replace_3 = ReplaceMembers(Set=num_191, Find=num_115, Replace=num_116)
replace_4 = ReplaceMembers(Set=num_190, Find=num_113, Replace=num_114)  # disabled

# ---- group: diversity
num_192 = Number(replace_3)

# ---- group: office diversity
num_193 = Number(replace)  # disabled

# ---- group: residential diversity
num_194 = Number(replace_2)  # disabled

# ---- group: living working diversity
num_195 = Number(replace_4)  # disabled

# ----
addition_35 = Addition(A=num_194, B=num_193)  # disabled
addition_36 = Addition(A=addition_35, B=num_195)  # disabled
division_45 = Division(A=addition_36, B=3)  # disabled

# ---- group: final pop. diversity
num_196 = Number(num_192)

# ----
gradient_15 = Gradient(LowerLimit=0, UpperLimit=1, Parameter=num_196, stops=[0: RGB(0, 0, 0), 1: RGB(255, 255, 255)])
gradient_16 = Gradient(LowerLimit=0, UpperLimit=1, Parameter=num_196, stops=[0: RGB(255, 0, 0), 0.5: RGB(222, 222, 0), 1: RGB(0, 128, 0)])
argb_7 = SplitARGB(Colour=gradient_16)  # -> Alpha, Red, Green, Blue
frgb_26 = ColourRGBF(Alpha=num_95, Red=argb_7.Red, Green=argb_7.Green, Blue=argb_7.Blue)

# ---- group: viz color
col_50 = Colour(frgb_26)

# ---- group: population density score normalized
num_197 = Number(remap_13.Mapped)

# ----
gradient_17 = Gradient(LowerLimit=0, UpperLimit=1, Parameter=num_197, stops=[0: RGB(0, 0, 0), 1: RGB(255, 255, 255)])
gradient_18 = Gradient(LowerLimit=0, UpperLimit=1, Parameter=num_197, stops=[0: RGB(255, 0, 0), 0.5: RGB(222, 222, 0), 1: RGB(0, 128, 0)])
argb_8 = SplitARGB(Colour=gradient_18)  # -> Alpha, Red, Green, Blue
frgb_27 = ColourRGBF(Alpha=num_95, Red=argb_8.Red, Green=argb_8.Green, Blue=argb_8.Blue)

# ---- group: viz color
col_51 = Colour(frgb_27)

# ---- group: population density viz
preview_26 = CustomPreview(Geometry=mesh_77, Shader=col_51)

preview_27 = CustomPreview(Geometry=mesh_76, Shader=col_50)

# ---- group: viz ctrl - AI override
int_194 = Integer(int_162)

# ----
number_slider_42 = Slider(7, range=0..9)
panel_172 = Panel(int_194)
int_195 = Integer(int_194)

# ---- group: distance index
index_2 = Slider(300, range=1..1500)

# ----
# Work Prox - Tuo
panel_173 = Panel("5")
run_module = GhPythonScript(need=panel_173, actual=int_195)  # -> out, run; inputs need: Int32, actual: Int32
# ---------- run_module: Python ----------
__author__ = "sunt"
__version__ = "2018.06.03"

import rhinoscriptsyntax as rs

run = ( need == actual)
# ---------- end run_module ----------

run_module_2 = GhPythonScript(need="6", actual=int_195)  # -> out, run; inputs need: Int32, actual: Int32; same code as run_module

# ----
# Park Prox - Tuo
panel_174 = Panel("7")
run_module_3 = GhPythonScript(need=panel_174, actual=int_195)  # -> out, run; inputs need: Int32, actual: Int32; same code as run_module

# ----
# Solar - Tuo
panel_175 = Panel("10")
run_module_4 = GhPythonScript(need=panel_175, actual=int_195)  # -> out, run; inputs need: Int32, actual: Int32; same code as run_module

# ---- group: Ratio
# Living Prox - Tuo
num_198 = Number(division_8)

# ----
# Make python data tree/list- Tuo
make_grid_list = GhPythonScript(x=int_38, y=int_39, ids=int_40)  # -> out, outL; inputs ids: list
# ---------- make_grid_list: Python ----------
__author__ = "sunt"
__version__ = "2018.06.03"

import rhinoscriptsyntax as rs

print(x,y)
print(ids)
outL = []

for newY in range(y):
    row = []
    for newX in range(x):
        row.append(ids[newX+newY*16])
    outL.append(row)
    
print(outL)
# ---------- end make_grid_list ----------
floor_height = Number(panel_30)
floor_replace = PythonScript(inL=make_grid_list.outL, floorDict=int_50)  # -> out, outL; inputs floorDict: list
# ---------- floor_replace: Python ----------
outL = inL[:]
print(outL)

replaceDict ={x: floorDict[x] for x in range(5)}
if len(floorDict)==7:
    replaceDict[8]=floorDict[6]
#print(replaceDict)

for item in range(len(outL)):
    outL[item] = int(replaceDict.get(int(outL[item]),0))

print(outL)
# ---------- end floor_replace ----------
iron2panel = GhPythonScript(ironList=make_grid_list.outL)  # -> out, panelOut
# ---------- iron2panel: Python ----------
"""Provides a scripting component.
    Inputs:
        centroid: Building's centroid point (area)
        floors: the number of floor
        grid: The gird
        cellSize: the size of the grid cell
        
    Output:
        a: The a output variable"""

__author__ = "sunt"
__version__ = "2018.05.28"

import rhinoscriptsyntax as rs

panelOut = ironList
# ---------- end iron2panel ----------
panel_176 = Panel(floor_replace.outL)

panel_177 = Panel(make_grid_list.outL)

# ---- group: control on/off
# Traffic - Tuo
panel_178 = Panel("9")
run_module_5 = GhPythonScript(need=panel_178, actual=int_195)  # -> out, run; inputs need: Int32, actual: Int32; same code as run_module

# ----
python_19 = PythonScript(x=index, y=num_106)  # -> out, a
# ---------- python_19: Python ----------
a = float(x)-2*float(y)
# ---------- end python_19 ----------

# ---- group: control on/off
# Live/work balance- Tuo
panel_179 = Panel("8")
run_module_6 = GhPythonScript(need=panel_179, actual=int_195)  # -> out, run; inputs need: Int32, actual: Int32; same code as run_module

# ----
multiplication_53 = Multiplication(A=python_19.a, B=num_198)
division_46 = Division(A=python_19.a, B=num_198)

k = Slider(3, range=3..30)
grid_x_extent = Number(int_115)
grid_y_extent = Number(int_116)

k_2 = Slider(3, range=3..30)
grid_x_extent_2 = Number(int_115)
grid_y_extent_2 = Number(int_116)

k_3 = Slider(1, range=1..30)
grid_x_extent_3 = Number(int_115)
grid_y_extent_3 = Number(int_116)

index_3 = Slider(100, range=1..500)
cell_size_2 = Number(cell_size)
grid_x_extent_4 = Number(int_115)
grid_y_extent_4 = Number(int_116)
height_by_id = GhPythonScript(inL=floor_replace.outL, h=floor_height)  # -> out, outL; inputs inL: list
# ---------- height_by_id: Python ----------
__author__ = "sunt"
__version__ = "2018.06.01"

import rhinoscriptsyntax as rs

outL = [h*x for x in inL]
# ---------- end height_by_id ----------
solar_by_id = GhPythonScript(inL=height_by_id.outL, xExt=grid_x_extent_4, yExt=grid_y_extent_4, index=index_3, cellSize=cell_size_2)  # -> out, outL, avg; inputs inL: tree, xExt: Int32
# ---------- solar_by_id: Python ----------
"""Provides a scripting component.
    Inputs:
        centroid: Building's centroid point (area)
        floors: the number of floor
        grid: The gird
        cellSize: the size of the grid cell
        
    Output:
        a: The a output variable"""

__author__ = "sunt"
__version__ = "2018.05.28"

import rhinoscriptsyntax as rs
import math
import Grasshopper as gh

xExt = int(xExt)
yExt = int(yExt)
cellSize = int(cellSize)

outL = [[0 for x in range(xExt)] for y in range(yExt)]
shadows = [0.5,1,0.5,0.25,0.5,1,0.5,0.25,0.125,0.25,0.5,1,0.5,0.25,0.125]

#print(outL)
#print(inL.Branch(0)[0])

score,count = 0,0

for bldgY in range(yExt):
    for bldgX in range(xExt):
        solInd = 0
        shadowInd = 0
        h = float(inL.Branch(bldgY)[bldgX])
        row1 = [(bldgY+1,bldgX+i) for i in range(-1,2)]
        row2 = [(bldgY+2,bldgX+i) for i in range(-2,3)]
        row3 = [(bldgY+3,bldgX+i) for i in range(-3,4)]
        rows_raw = [row1,row2,row3]
#        print(int(30*3.5/cellSize))
        rows = rows_raw[:max(1,int(30*3.5/cellSize))]
        for r in range(len(rows)):
            for (newY,newX) in rows[r]:
                if 0<=newX and newX<xExt and 0<=newY and newY<yExt:
                    solInd += max((float(inL.Branch(newY)[newX])-h-cellSize*r)*shadows[shadowInd],0)
                shadowInd+=1
#        print(solInd)
        outL[bldgY][bldgX] = solInd/index
        if h > 0:
            
            score += max(1-solInd/index,0)
            count += 1
#            print("add score: ",score)
            
avg = score/count
#print(count)
#print(outL)
# ---------- end solar_by_id ----------
iron2panel_2 = GhPythonScript(run=run_module_4.run, ironList=solar_by_id.outL)  # -> out, panelOut
# ---------- iron2panel_2: Python ----------
"""Provides a scripting component.
    Inputs:
        centroid: Building's centroid point (area)
        floors: the number of floor
        grid: The gird
        cellSize: the size of the grid cell
        
    Output:
        a: The a output variable"""

__author__ = "sunt"
__version__ = "2018.05.28"

import rhinoscriptsyntax as rs

panelOut = ironList if run else None
# ---------- end iron2panel_2 ----------

# ---- group: building extrusion
byheight = PythonScript(inPanelList=floor_replace.outL, heights=floor_height)  # -> out, outPanelList; inputs inPanelList: list
# ---------- byheight: Python ----------
import Grasshopper as gh

outPanelList = inPanelList[:]


for item in range(len(outPanelList)):
    outPanelList[item] = int(outPanelList[item])*heights

    
print(outPanelList)
# ---------- end byheight ----------
panel_180 = Panel(byheight.outPanelList)
grid_x_extent_5 = Number(int_115)
grid_y_extent_5 = Number(int_116)
sqgrid = Square(Plane=PlaneXY(0, 0, 0), Size=num_76, ExtentX=grid_x_extent_5, ExtentY=grid_y_extent_5)  # -> Cells, Points
rev_3 = ReverseList(List=sqgrid.Cells)
Z_8 = UnitZ(Factor=1)
flip = FlipMatrix(Data=rev_3)
amp_2 = Amplitude(Vector=Z_8, Amplitude=flatten(panel_180))
boundary_2 = BoundarySurfaces(Edges=flatten(flip))
extr_3 = Extrude(Base=boundary_2, Direction=amp_2)
getgridcorners = GhPythonScript(cells=rev_3, x=grid_x_extent_5, y=grid_y_extent_5)  # -> out, corners; inputs cells: list
# ---------- getgridcorners: Python ----------
__author__ = "sunt"
__version__ = "2018.05.28"

import rhinoscriptsyntax as rs

print(cells[0])
print(cells[-1])

a= rs.CurvePoints(cells[0])[3]
b= rs.CurvePoints(cells[int(x)-1])[0]
d= rs.CurvePoints(cells[-int(x)])[2]
c= rs.CurvePoints(cells[-1])[1]

corners = [b,a,d,c]
# ---------- end getgridcorners ----------

# ----
area_2 = Area(Geometry=boundary_2)  # -> Area, Centroid

run = GhPythonScript(i=area_2.Centroid, run=run_module_2.run)  # -> out, o
# ---------- run: Python ----------
__author__ = "sunt"
__version__ = "2018.06.03"

import rhinoscriptsyntax as rs

o = i if run else []
# ---------- end run ----------
panel_181 = Panel("""3
4
5
8""")
panel_182 = Panel("""0
1
2""")
filter_elements = GhPythonScript(E=flatten(area_2.Centroid), ids=flatten(iron2panel.panelOut), f1=panel_181, f2=panel_182)  # -> out, ind1, outE1, outE2; inputs E: list, ids: list of Int32, f1: list of Int32, f2: list of Int32
# ---------- filter_elements: Python ----------
__author__ = "sunt"
__version__ = "2018.06.03"

import rhinoscriptsyntax as rs

outE1,outE2,ind1 = [],[],[]
print(f1,f2)

for e in range(len(ids)):
    if ids[e] in f1:
        outE1.append(E[e])
        ind1.append(e)
    elif ids[e] in f2:
        outE2.append(E[e])
# ---------- end filter_elements ----------
pt_129 = Point(flatten(filter_elements.outE1))
pt_130 = Point(filter_elements.outE2)
cps_5 = ClosestPoints(Point=pt_129, Cloud=pt_130, Count=k)  # -> ClosestPoint, CPIndex, Distance
avr = Average(Input=cps_5.Distance)  # -> flatten(ArithmeticMean)
panel_183 = Panel(avr)

run_2 = GhPythonScript(i=area_2.Centroid, run=run_module.run)  # -> out, o; same code as run
panel_184 = Panel("""3
4
5
8""")
panel_185 = Panel("""0
1
2""")
filter_elements_2 = GhPythonScript(E=flatten(area_2.Centroid), ids=flatten(iron2panel.panelOut), f1=panel_185, f2=panel_184)  # -> out, ind1, outE1, outE2; inputs E: list, ids: list of Int32, f1: list of Int32, f2: list of Int32; same code as filter_elements
pt_131 = Point(flatten(filter_elements_2.outE1))
pt_132 = Point(filter_elements_2.outE2)
cps_6 = ClosestPoints(Point=pt_131, Cloud=pt_132, Count=k_2)  # -> ClosestPoint, CPIndex, Distance
avr_2 = Average(Input=cps_6.Distance)  # -> flatten(ArithmeticMean)
panel_186 = Panel(avr_2)

run_3 = GhPythonScript(i=area_2.Centroid, run=run_module_3.run)  # -> out, o; same code as run
panel_187 = Panel("""0
1
2
3
4
5
8""")
filter_elements_3 = GhPythonScript(E=flatten(area_2.Centroid), ids=flatten(iron2panel.panelOut), f1=panel_187, f2="7")  # -> out, ind1, outE1, outE2; inputs E: list, ids: list of Int32, f1: list of Int32, f2: list of Int32; same code as filter_elements
pt_133 = Point(flatten(filter_elements_3.outE1))
pt_134 = Point(filter_elements_3.outE2)
cps_7 = ClosestPoints(Point=pt_133, Cloud=pt_134, Count=k_3)  # -> ClosestPoint, CPIndex, Distance
avr_3 = Average(Input=cps_7.Distance)  # -> flatten(ArithmeticMean)
panel_188 = Panel(avr_3)

# ---- group: colorize
gradient_19 = Gradient(LowerLimit=0, UpperLimit=1, Parameter=panel_180, stops=[0: RGB(102, 102, 102), 1: RGB(255, 255, 255)])  # disabled
number_slider_43 = Slider(1, range=0..1)  # disabled
argb_9 = SplitARGB(Colour=gradient_19)  # -> Alpha, Red, Green, Blue; disabled
frgb_28 = ColourRGBF(Alpha=number_slider_43, Red=argb_9.Red, Green=argb_9.Green, Blue=argb_9.Blue)  # disabled
col_52 = Colour(frgb_28)  # disabled
preview_28 = CustomPreview(Geometry=extr_3, Material=flatten(col_52))  # disabled

# ----
panel_189 = Panel(iron2panel_2.panelOut)
panel_190 = Panel(cps_7.Distance)
new_col_trans = GhPythonScript(x=grid_x_extent_2, y=grid_y_extent_2, ids=filter_elements_2.ind1, knn=panel_186, index=division_46)  # -> out, value, score; inputs x: Int32, y: Int32, ids: list, knn: list of Int32
# ---------- new_col_trans: Python ----------
__author__ = "sunt"
__version__ = "2018.06.04"

import rhinoscriptsyntax as rs

value= []
print(ids)
print(knn)
k = 0
for i in range(int(x*y)):
    if i != ids[k]:
        value.append(0)
    else:
        value.append(1-(knn[k]-100)/index)
        if k < len(ids)-1:
            k+=1
            
value_n0= [v for v in value if v>0]
score = sum(value_n0)/max(1,len(value_n0))
#print(score)
#print(value)
# ---------- end new_col_trans ----------
new_col_trans_2 = GhPythonScript(x=grid_x_extent, y=grid_y_extent, ids=filter_elements.ind1, knn=panel_183, index=division_46)  # -> out, value, score; inputs x: Int32, y: Int32, ids: list, knn: list of Int32
# ---------- new_col_trans_2: Python ----------
__author__ = "sunt"
__version__ = "2018.06.04"

import rhinoscriptsyntax as rs

value= []
print(ids)
print(knn)
k = 0
for i in range(int(x*y)):
    if i != ids[k]:
        value.append(0)
    else:
        value.append(1-(knn[k]-100)/index)
        if k < len(ids)-1:
            k+=1
            
value_n0= [v for v in value if v>0]
score = sum(value_n0)/max(1,len(value_n0))
#print(value_n0)
#print(score)
# ---------- end new_col_trans_2 ----------
new_col_trans_3 = GhPythonScript(x=grid_x_extent_3, y=grid_y_extent_3, ids=filter_elements_3.ind1, knn=panel_188, index=division_46)  # -> out, value, score; inputs x: Int32, y: Int32, ids: list, knn: list of Int32
# ---------- new_col_trans_3: Python ----------
__author__ = "sunt"
__version__ = "2018.06.04"

import rhinoscriptsyntax as rs

value= []
print(index)
#print(ids)
#print(knn)
k = 0
for i in range(int(x*y)):
    if i != ids[k]:
        value.append(0)
    else:
        value.append(1-(knn[k]-62.5)/int(index))
        if k < len(ids)-1:
            k+=1
            
value_n0= [v for v in value if v>0]
score = sum(value_n0)/max(1,len(value_n0))
#print(score)
# ---------- end new_col_trans_3 ----------
iron2panel_3 = GhPythonScript(run=run_module_2.run, ironList=new_col_trans_2.value)  # -> out, panelOut; same code as iron2panel_2
iron2panel_4 = GhPythonScript(run=run_module_3.run, ironList=new_col_trans_3.value)  # -> out, panelOut; same code as iron2panel_2
iron2panel_5 = GhPythonScript(run=run_module.run, ironList=new_col_trans.value)  # -> out, panelOut; same code as iron2panel_2

gradient_20 = Gradient(LowerLimit=0, UpperLimit=1, Parameter=panel_189, stops=[0: RGB(255, 255, 0), 1: RGB(0, 50, 199)])
panel_191 = Panel("""0
1
2
3
4
5
6
7
8
9""")
nonetype = GhPythonScript(i=gradient_20)  # -> out, run, o
# ---------- nonetype: Python ----------
__author__ = "sunt"
__version__ = "2018.06.03"

import rhinoscriptsyntax as rs
print(type(i))
if type(i)==type(None):
    o = []
    run = False
else:
    o = i
    run = True
# ---------- end nonetype ----------
run_4 = GhPythonScript(i=panel_191, run=nonetype.run)  # -> out, o; inputs run: tree
# ---------- run_4: Python ----------
__author__ = "sunt"
__version__ = "2018.06.03"

import rhinoscriptsyntax as rs

o = i if run.BranchCount >= 2 and run.Branch(0) else []
# ---------- end run_4 ----------

gradient_21 = Gradient(
    LowerLimit=0,
    UpperLimit=1,
    Parameter=iron2panel_3.panelOut,
    stops=[0: RGB(255, 0, 0), 0.5: RGB(255, 255, 0), 1: RGB(0, 128, 0)])
nonetype_2 = GhPythonScript(i=gradient_21)  # -> out, run, o; same code as nonetype
run_5 = GhPythonScript(i=panel_181, run=nonetype_2.run)  # -> out, o; inputs run: list
# ---------- run_5: Python ----------
__author__ = "sunt"
__version__ = "2018.06.03"

import rhinoscriptsyntax as rs

o = i if len(run) >= 2 and run[0] else []
# ---------- end run_5 ----------

gradient_22 = Gradient(
    LowerLimit=0,
    UpperLimit=1,
    Parameter=iron2panel_4.panelOut,
    stops=[0: RGB(255, 0, 0), 0.5: RGB(255, 255, 0), 1: RGB(0, 128, 0)])
nonetype_3 = GhPythonScript(i=gradient_22)  # -> out, run, o; same code as nonetype
run_6 = GhPythonScript(i=panel_187, run=nonetype_3.run)  # -> out, o; inputs run: list; same code as run_5

gradient_23 = Gradient(
    LowerLimit=0,
    UpperLimit=1,
    Parameter=iron2panel_5.panelOut,
    stops=[0: RGB(255, 0, 0), 0.5: RGB(255, 255, 0), 1: RGB(0, 128, 0)])
nonetype_4 = GhPythonScript(i=gradient_23)  # -> out, run, o; same code as nonetype
run_7 = GhPythonScript(i=panel_185, run=nonetype_4.run)  # -> out, o; inputs run: list; same code as run_5

# ---- group: color calibration dock
# Color Space Viz / Sliders and Toggles
number_slider_44 = Slider(300, range=0..1000)  # disabled
mjoin_5 = MeshJoin(Meshes=crv_2)  # disabled
popgeo = PopulateGeometry(Geometry=mjoin_5, Count=number_slider_44, Seed=1)  # disabled
sample_7 = BitmapSampler(BitmapToModify=bmp_4, PointToSample=popgeo, BitmapToModify_2=bmp_4, PointToSample_2=popgeo, bitmap_filter=0)  # -> SampledImageData, SampledImageData_2; disabled
argb_10 = SplitARGB(Colour=col_27)  # -> Alpha, Red, Green, Blue; disabled
ahsv = SplitAHSV(Colour=col_27)  # -> Alpha, Hue, Saturation, Value; disabled
pt_135 = ConstructPoint(XCoordinate=argb_10.Red, YCoordinate=argb_10.Green, ZCoordinate=argb_10.Blue)  # disabled
pt_136 = ConstructPoint(XCoordinate=ahsv.Hue, YCoordinate=ahsv.Saturation, ZCoordinate=ahsv.Value)  # disabled
pt_137 = Point(col_27)  # disabled
sph = Sphere(Base=pt_136, Radius=0.05)  # disabled
sph_2 = Sphere(Base=pt_135, Radius=0.05)  # disabled
preview_29 = CustomPreview(Geometry=sph, Shader=col_27)  # disabled
preview_30 = CustomPreview(Geometry=sph_2, Shader=col_27)  # disabled
box = Box2Pt(PointA=Point(0, 0, 0), PointB=Point(1, 1, 1), Plane=PlaneXY(0, 0, 0))  # disabled
box_2 = Box2Pt(PointA=Point(0, 0, 0), PointB=Point(1, 1, 1), Plane=PlaneXY(0, 0, 0))  # disabled
voronoi³ = Voronoi3D(Points=pt_136, Box=box)  # -> Cells, Boundary; disabled
voronoi³_2 = Voronoi3D(Points=pt_135, Box=box_2)  # -> Cells, Boundary; disabled
brep = Brep(voronoi³.Cells)  # disabled
brep_2 = Brep(voronoi³_2.Cells)  # disabled
range_2 = Range(Domain=Domain(0, 1), Steps=10)  # disabled
graft_4 = GraftTree(Tree=range_2, IncludeEmptyLists=True, IncludeNullItems=True)  # disabled
pt_138 = ConstructPoint(XCoordinate=range_2, YCoordinate=graft_4, ZCoordinate=0)  # disabled
Z_9 = UnitZ(Factor=range_2)  # disabled
pshift_70 = ShiftPaths(Data=pt_138, Offset=-1)  # disabled
graft_5 = GraftTree(Tree=Z_9, IncludeEmptyLists=True, IncludeNullItems=True)  # disabled
number_slider_45 = Slider(5, range=0..10)  # disabled
move_39 = Move(Geometry=pshift_70, Motion=graft_5)  # -> Geometry, Transform; disabled
flip_2 = FlipMatrix(Data=move_39.Geometry)  # disabled
item_63 = ListItem(List=flip_2, Index=number_slider_45, Wrap=False)  # disabled

# ---- group: color calibration dock / ref sample colors
col_53 = Colour(sample_7.SampledImageData_2)  # disabled

# ---- group: color calibration dock / all sample color
col_54 = Colour(col_53)  # disabled

col_55 = Colour(col_54)  # disabled

# ---- group: color calibration dock / color space pts - one plan
pt_139 = Point(item_63)  # disabled

# ---- group: color calibration dock / color space pts
pt_140 = Point(flip_2)  # disabled

# ---- group: color calibration dock / color space pts - showing
pt_141 = Point(pt_140)  # disabled

# ---- group: color calibration dock (continued)
argb_11 = SplitARGB(Colour=col_55)  # -> Alpha, Red, Green, Blue; disabled
ahsv_2 = SplitAHSV(Colour=col_55)  # -> Alpha, Hue, Saturation, Value; disabled
pt_142 = ConstructPoint(XCoordinate=argb_11.Red, YCoordinate=argb_11.Green, ZCoordinate=argb_11.Blue)  # disabled
pt_143 = ConstructPoint(XCoordinate=ahsv_2.Hue, YCoordinate=ahsv_2.Saturation, ZCoordinate=ahsv_2.Value)  # disabled
pt_144 = Point(col_55)  # disabled
preview_31 = CustomPreview(Geometry=pt_143, Shader=col_55)  # disabled
preview_32 = CustomPreview(Geometry=pt_142, Shader=col_55)  # disabled
pdecon_32 = Deconstruct(Point=pt_141)  # -> XComponent, YComponent, ZComponent; disabled
hsl = ColourHSL(Alpha=1, Hue=pdecon_32.XComponent, Saturation=pdecon_32.YComponent, Luminance=pdecon_32.ZComponent)  # disabled
frgb_29 = ColourRGBF(Alpha=1, Red=pdecon_32.XComponent, Green=pdecon_32.YComponent, Blue=pdecon_32.ZComponent)  # disabled
preview_33 = CustomPreview(Geometry=pt_141, Shader=hsl)  # disabled
pt_145 = Point(frgb_29)  # disabled
preview_34 = CustomPreview(Geometry=pt_141, Shader=frgb_29)  # disabled

# ---- group: color calibration dock / connecting sample pt and its color space pt
number_slider_46 = Slider(237, range=0..300)  # disabled
ln_9 = Line(StartPoint=popgeo, EndPoint=pt_142)  # disabled
item_64 = ListItem(List=ln_9, Index=number_slider_46, Wrap=True)  # disabled
crv_22 = Curve(item_64)  # disabled

# ---- group: Color Space Calibration sliders
# Color Space Viz / Sliders and Toggles
number_slider_47 = Slider(300, range=0..1000)  # disabled
number_slider_48 = Slider(300, range=0..1000)  # disabled
number_slider_49 = Slider(300, range=0..1000)  # disabled
number_slider_50 = Slider(300, range=0..1000)  # disabled
mjoin_6 = MeshJoin(Meshes=crv)  # disabled
mjoin_7 = MeshJoin(Meshes=crv_5)  # disabled
mjoin_8 = MeshJoin(Meshes=crv_6)  # disabled
mjoin_9 = MeshJoin(Meshes=crv_7)  # disabled
popgeo_2 = PopulateGeometry(Geometry=mjoin_6, Count=number_slider_47, Seed=1)  # disabled
popgeo_3 = PopulateGeometry(Geometry=mjoin_7, Count=number_slider_48, Seed=1)  # disabled
popgeo_4 = PopulateGeometry(Geometry=mjoin_8, Count=number_slider_49, Seed=1)  # disabled
popgeo_5 = PopulateGeometry(Geometry=mjoin_9, Count=number_slider_50, Seed=1)  # disabled
sample_8 = BitmapSampler(BitmapToModify=bmp_2, PointToSample=popgeo_2, BitmapToModify_2=bmp_2, PointToSample_2=popgeo_2, bitmap_filter=0)  # -> SampledImageData, SampledImageData_2; disabled
sample_9 = BitmapSampler(BitmapToModify=bmp_3, PointToSample=popgeo_3, BitmapToModify_2=bmp_3, PointToSample_2=popgeo_3, bitmap_filter=0)  # -> SampledImageData, SampledImageData_2; disabled
sample_10 = BitmapSampler(BitmapToModify=bmp_4, PointToSample=popgeo_4, BitmapToModify_2=bmp_4, PointToSample_2=popgeo_4, bitmap_filter=0)  # -> SampledImageData, SampledImageData_2; disabled
sample_11 = BitmapSampler(BitmapToModify=bmp_5, PointToSample=popgeo_5, BitmapToModify_2=bmp_5, PointToSample_2=popgeo_5, bitmap_filter=0)  # -> SampledImageData, SampledImageData_2; disabled
argb_12 = SplitARGB(Colour=col_26)  # -> Alpha, Red, Green, Blue; disabled
ahsv_3 = SplitAHSV(Colour=col_26)  # -> Alpha, Hue, Saturation, Value; disabled
pt_146 = ConstructPoint(XCoordinate=argb_12.Red, YCoordinate=argb_12.Green, ZCoordinate=argb_12.Blue)  # disabled
pt_147 = ConstructPoint(XCoordinate=ahsv_3.Hue, YCoordinate=ahsv_3.Saturation, ZCoordinate=ahsv_3.Value)  # disabled
pt_148 = Point(col_26)  # disabled
sph_3 = Sphere(Base=pt_147, Radius=0.05)  # disabled
sph_4 = Sphere(Base=pt_146, Radius=0.05)  # disabled
preview_35 = CustomPreview(Geometry=sph_3, Shader=col_26)  # disabled
preview_36 = CustomPreview(Geometry=sph_4, Shader=col_26)  # disabled
box_3 = Box2Pt(PointA=Point(0, 0, 0), PointB=Point(1, 1, 1), Plane=PlaneXY(0, 0, 0))  # disabled
box_4 = Box2Pt(PointA=Point(0, 0, 0), PointB=Point(1, 1, 1), Plane=PlaneXY(0, 0, 0))  # disabled
voronoi³_3 = Voronoi3D(Points=pt_147, Box=box_3)  # -> Cells, Boundary; disabled
voronoi³_4 = Voronoi3D(Points=pt_146, Box=box_4)  # -> Cells, Boundary; disabled
brep_3 = Brep(voronoi³_3.Cells)  # disabled
brep_4 = Brep(voronoi³_4.Cells)  # disabled
range_3 = Range(Domain=Domain(0, 1), Steps=10)  # disabled
graft_6 = GraftTree(Tree=range_3, IncludeEmptyLists=True, IncludeNullItems=True)  # disabled
pt_149 = ConstructPoint(XCoordinate=range_3, YCoordinate=graft_6, ZCoordinate=0)  # disabled
Z_10 = UnitZ(Factor=range_3)  # disabled
pshift_71 = ShiftPaths(Data=pt_149, Offset=-1)  # disabled
graft_7 = GraftTree(Tree=Z_10, IncludeEmptyLists=True, IncludeNullItems=True)  # disabled
number_slider_51 = Slider(5, range=0..10)  # disabled
move_40 = Move(Geometry=pshift_71, Motion=graft_7)  # -> Geometry, Transform; disabled
flip_3 = FlipMatrix(Data=move_40.Geometry)  # disabled
item_65 = ListItem(List=flip_3, Index=number_slider_51, Wrap=False)  # disabled

# ---- group: Color Space Calibration sliders / ref sample colors
col_56 = Colour(sample_8.SampledImageData_2)  # disabled

col_57 = Colour(sample_9.SampledImageData_2)  # disabled

col_58 = Colour(sample_10.SampledImageData_2)  # disabled

col_59 = Colour(sample_11.SampledImageData_2)  # disabled

# ---- group: Color Space Calibration sliders / all sample color
col_60 = Colour(col_59)  # disabled

col_61 = Colour(col_56)  # disabled

col_62 = Colour(col_58)  # disabled

col_63 = Colour(col_57)  # disabled

col_64 = Colour(col_62)  # disabled

# ---- group: Color Space Calibration sliders / color space pts - one plan
pt_150 = Point(item_65)  # disabled

# ---- group: Color Space Calibration sliders / color space pts
pt_151 = Point(flip_3)  # disabled

# ---- group: Color Space Calibration sliders / color space pts - showing
pt_152 = Point(pt_151)  # disabled

# ---- group: Color Space Calibration sliders (continued)
argb_13 = SplitARGB(Colour=col_64)  # -> Alpha, Red, Green, Blue; disabled
ahsv_4 = SplitAHSV(Colour=col_64)  # -> Alpha, Hue, Saturation, Value; disabled
pt_153 = ConstructPoint(XCoordinate=argb_13.Red, YCoordinate=argb_13.Green, ZCoordinate=argb_13.Blue)  # disabled
pt_154 = ConstructPoint(XCoordinate=ahsv_4.Hue, YCoordinate=ahsv_4.Saturation, ZCoordinate=ahsv_4.Value)  # disabled
pt_155 = Point(col_64)  # disabled
preview_37 = CustomPreview(Geometry=pt_154, Shader=col_64)  # disabled
preview_38 = CustomPreview(Geometry=pt_153, Shader=col_64)  # disabled
pdecon_33 = Deconstruct(Point=pt_152)  # -> XComponent, YComponent, ZComponent; disabled
hsl_2 = ColourHSL(Alpha=1, Hue=pdecon_33.XComponent, Saturation=pdecon_33.YComponent, Luminance=pdecon_33.ZComponent)  # disabled
frgb_30 = ColourRGBF(Alpha=1, Red=pdecon_33.XComponent, Green=pdecon_33.YComponent, Blue=pdecon_33.ZComponent)  # disabled
preview_39 = CustomPreview(Geometry=pt_152, Shader=hsl_2)  # disabled
pt_156 = Point(frgb_30)  # disabled
preview_40 = CustomPreview(Geometry=pt_152, Shader=frgb_30)  # disabled

# ---- group: Position Calibration / disable when not calibrating CV
box_5 = CenterBox(Base=pt_9, X=0.003, Y=0.003, Z=0.003)  # disabled
item_66 = ListItem(List=col_2, Index=item, Wrap=False)  # disabled

# ---- group: Position Calibration / disable when not calibrating CV / all sample boxes
box_6 = Box(box_5)  # disabled

# ---- group: Position Calibration / disable when not calibrating CV (continued)
preview_41 = CustomPreview(Geometry=box_6, Shader=item_66)  # disabled

# ---- group: Position Calibration
move_41 = Move(Geometry=mesh_9, Motion=Vector(0, 0, -0.1))  # -> Geometry, Transform; disabled
addition_37 = Addition(A=item_12, B=item_13)  # disabled
division_47 = Division(A=addition_37, B=2)  # disabled

# ---- group: Position Calibration / moved down 0.1
mesh_78 = Mesh(move_41.Geometry)  # disabled

# ---- group: Position Calibration / quart mid pts
pt_157 = Point(division_47)  # disabled

# ---- group: Position Calibration (continued)
tag_29 = TextTag3D(Location=pt_157, Text=int_28, Size=0.01, Justification=5)  # disabled

# ---- group: Position Calibration / disable when not calibrating CV
box_7 = CenterBox(Base=pt_31, X=0.003, Y=0.003, Z=0.003)  # disabled
item_67 = ListItem(List=col_18, Index=cp_6.CPIndex, Wrap=False)  # disabled

# ---- group: Position Calibration / disable when not calibrating CV / all sample boxes
box_8 = Box(box_7)  # disabled

# ---- group: Position Calibration / disable when not calibrating CV (continued)
# Closest Color Code
preview_42 = CustomPreview(Geometry=box_8, Shader=item_67)  # disabled

# ----
# Color Space Viz / Grid
argb_14 = SplitARGB(Colour=col_22)  # -> Alpha, Red, Green, Blue; disabled
ahsv_5 = SplitAHSV(Colour=col_22)  # -> Alpha, Hue, Saturation, Value; disabled
argb_15 = SplitARGB(Colour=col_23)  # -> Alpha, Red, Green, Blue; disabled
ahsv_6 = SplitAHSV(Colour=col_23)  # -> Alpha, Hue, Saturation, Value; disabled
pt_158 = ConstructPoint(XCoordinate=argb_14.Red, YCoordinate=argb_14.Green, ZCoordinate=argb_14.Blue)  # disabled
pt_159 = ConstructPoint(XCoordinate=ahsv_5.Hue, YCoordinate=ahsv_5.Saturation, ZCoordinate=ahsv_5.Value)  # disabled
pt_160 = ConstructPoint(XCoordinate=argb_15.Red, YCoordinate=argb_15.Green, ZCoordinate=argb_15.Blue)  # disabled
pt_161 = ConstructPoint(XCoordinate=ahsv_6.Hue, YCoordinate=ahsv_6.Saturation, ZCoordinate=ahsv_6.Value)  # disabled
pt_162 = Point(col_22)  # disabled
pt_163 = Point(col_23)  # disabled
sph_5 = Sphere(Base=pt_161, Radius=0.05)  # disabled
sph_6 = Sphere(Base=pt_160, Radius=0.05)  # disabled
preview_43 = CustomPreview(Geometry=pt_159, Shader=col_22)  # disabled
preview_44 = CustomPreview(Geometry=pt_158, Shader=col_22)  # disabled
preview_45 = CustomPreview(Geometry=sph_5, Shader=col_23)  # disabled
preview_46 = CustomPreview(Geometry=sph_6, Shader=col_23)  # disabled
box_9 = Box2Pt(PointA=Point(0, 0, 0), PointB=Point(1, 1, 1), Plane=PlaneXY(0, 0, 0))  # disabled
box_10 = Box2Pt(PointA=Point(0, 0, 0), PointB=Point(1, 1, 1), Plane=PlaneXY(0, 0, 0))  # disabled
voronoi³_5 = Voronoi3D(Points=pt_161, Box=box_9)  # -> Cells, Boundary; disabled
voronoi³_6 = Voronoi3D(Points=pt_160, Box=box_10)  # -> Cells, Boundary; disabled
brep_5 = Brep(voronoi³_5.Cells)  # disabled
brep_6 = Brep(voronoi³_6.Cells)  # disabled
range_4 = Range(Domain=Domain(0, 1), Steps=10)  # disabled
graft_8 = GraftTree(Tree=range_4, IncludeEmptyLists=True, IncludeNullItems=True)  # disabled
pt_164 = ConstructPoint(XCoordinate=range_4, YCoordinate=graft_8, ZCoordinate=0)  # disabled
Z_11 = UnitZ(Factor=range_4)  # disabled
pshift_72 = ShiftPaths(Data=pt_164, Offset=-1)  # disabled
graft_9 = GraftTree(Tree=Z_11, IncludeEmptyLists=True, IncludeNullItems=True)  # disabled
number_slider_52 = Slider(5, range=0..10)  # disabled
move_42 = Move(Geometry=pshift_72, Motion=graft_9)  # -> Geometry, Transform; disabled
flip_4 = FlipMatrix(Data=move_42.Geometry)  # disabled
item_68 = ListItem(List=flip_4, Index=number_slider_52, Wrap=False)  # disabled

# ---- group: color space pts - one plan
pt_165 = Point(item_68)  # disabled

# ---- group: color space pts
pt_166 = Point(flip_4)  # disabled

# ---- group: color space pts - showing
pt_167 = Point(pt_166)  # disabled

# ----
pdecon_34 = Deconstruct(Point=pt_167)  # -> XComponent, YComponent, ZComponent; disabled
hsl_3 = ColourHSL(Alpha=1, Hue=pdecon_34.XComponent, Saturation=pdecon_34.YComponent, Luminance=pdecon_34.ZComponent)  # disabled
frgb_31 = ColourRGBF(Alpha=1, Red=pdecon_34.XComponent, Green=pdecon_34.YComponent, Blue=pdecon_34.ZComponent)  # disabled
preview_47 = CustomPreview(Geometry=pt_167, Shader=hsl_3)  # disabled
pt_168 = Point(frgb_31)  # disabled
preview_48 = CustomPreview(Geometry=pt_167, Shader=frgb_31)  # disabled

# ---- group: total ppl bound
panel_192 = Panel("700")  # disabled

# ----
multiplication_54 = Multiplication(A=panel_192, B=number_slider_26)  # disabled
dom_10 = ConstructDomain(DomainStart=multiplication_54, DomainEnd=multiplication_32)  # disabled

# ---- group: total ppl bound (continued)
domain_2 = Domain(dom_10)  # disabled

# ----
remap_14 = RemapNumbers(Value=int_102, Source=domain_2, Target=Domain(0, 0.5))  # -> Mapped, Clipped; disabled
remap_15 = RemapNumbers(Value=int_102, Source=domain_2, Target=Domain(0.3, 1))  # -> Mapped, Clipped; disabled
multiplication_55 = Multiplication(A=graph_4, B=remap_15.Mapped)  # disabled
addition_38 = Addition(A=remap_14.Mapped, B=multiplication_55)  # disabled
addition_39 = Addition(A=addition_38, B=multiplication_34)  # disabled
gradient_24 = Gradient(
    LowerLimit=0,
    UpperLimit=1,
    Parameter=addition_39,
    stops=[0: RGB(0, 128, 0), 0.422: RGB(255, 255, 0), 0.919: RGB(255, 0, 0)])  # disabled
argb_16 = SplitARGB(Colour=gradient_24, IntegerChannels=True)  # -> Alpha, Red, Green, Blue; disabled
vec_11 = VectorXYZ(XComponent=argb_16.Red, YComponent=argb_16.Green, ZComponent=argb_16.Blue)  # -> Vector, Length; disabled
multiplication_56 = Multiplication(A=vec_11.Vector, B=number_slider_28)  # disabled
addition_40 = Addition(A=multiplication_56, B=multiplication_35)  # disabled
devec = DeconstructVector(Vector=addition_40)  # -> XComponent, YComponent, ZComponent; disabled
rgb = ColourRGB(Alpha=255, Red=devec.XComponent, Green=devec.YComponent, Blue=devec.ZComponent)  # disabled
col_65 = Colour(rgb)  # disabled
mspray_3 = MeshSpray(Mesh=graft(pshift_54), Points=graft(pshift_55), Colours=graft(col_65), SprayMode=0)  # disabled
mjoin_10 = MeshJoin(Meshes=flatten(mspray_3))  # disabled
filter_60 = StreamFilter(Gate=show_google_map, Stream0=mjoin_10)  # disabled

# ---- group: road traffic lego
mesh_79 = Mesh(filter_60)  # disabled

# ---- group: 3D City
# 3D City Grid System
number_slider_53 = Slider(10, range=10..100)
Z_12 = UnitZ(Factor=number_slider_53)
msphereex = MeshSphereEx(Base=Z_12, Radius=number_slider_53, Count=Slider(5, range=0..10))
Z_13 = UnitZ(Factor=Slider(6, range=0..10))
move_43 = Move(Geometry=msphereex, Motion=Z_13)  # -> Geometry, Transform
com = ColourSwatch(SwatchColor=RGB(77, 166, 255))
com_2 = ColourSwatch(SwatchColor=RGB(71, 71, 71))
res = ColourSwatch(SwatchColor=RGB(255, 201, 77))
res_2 = ColourSwatch(SwatchColor=RGB(76, 76, 76))
larger_8 = LargerThan(FirstNumber=int_155, SecondNumber="0")  # -> LargerThan, OrEqualTo
smaller_10 = SmallerThan(FirstNumber=int_155, SecondNumber="5")  # -> SmallerThan, OrEqualTo
vec_12 = Vector(X_3)
mcol_5 = MeshColours(Mesh=move_43.Geometry, Colours=park)
tree_scale = Slider(0.81, range=0.5..2)
merge_18 = Merge(Data1=res, Data2=res, Data3=res, Data4=com, Data5=com, Data6=com)
merge_19 = Merge(Data1=res_2, Data2=res_2, Data3=res_2, Data4=com_2, Data5=com_2, Data6=com_2)
and_21 = GateAnd(A=larger_8.OrEqualTo, B=smaller_10.OrEqualTo)
merge_20 = Merge(Data1=merge_18, Data2=merge_19)
dom_11 = ConstructDomain(DomainStart=neg_7, DomainEnd=division_18)
move_44 = Move(Geometry=pt_113, Motion=vec_3)  # -> Geometry, Transform
tree = Slider(2.13, range=0..5)
division_48 = Division(A=num_106, B=2)
move_45 = Move(Geometry=mesh_63, Motion=vec_12)  # -> Geometry, Transform
move_46 = Move(Geometry=mesh_62, Motion=vec_12)  # -> Geometry, Transform
move_47 = Move(Geometry=mesh_61, Motion=vec_12)  # -> Geometry, Transform
multiplication_57 = Multiplication(A=division_48, B=Slider(0.95, range=0..1))
neg_15 = Negative(Value=multiplication_57)
multiplication_58 = Multiplication(A="3", B=tree)
division_49 = Division(A=num_108, B=division_8)
multiplication_59 = Multiplication(A="3", B=tree)
dom_12 = ConstructDomain(DomainStart=multiplication_58, DomainEnd=multiplication_59)
move_48 = Move(Geometry=mesh_66, Motion=vec_3)  # -> Geometry, Transform
dom_13 = ConstructDomain(DomainStart=neg_15, DomainEnd=multiplication_57)
panel_193 = Panel(division_49)

# ---- group: 3D City / meshes 3D ref: Tree
mesh_80 = Mesh(mcol_5)

# ---- group: 3D City / is building or not
bool_26 = Boolean(and_21)

# ---- group: 3D City / color for each type
col_66 = Colour(merge_20)

# ---- group: 3D City / park center 3D
pt_169 = Point(move_44.Geometry)

# ----
move_49 = Move(Geometry=mesh_65, Motion=vec_12)  # -> Geometry, Transform

# ---- group: 3D City / sidewalk
mesh_81 = Mesh(move_46.Geometry)

# ---- group: 3D City / road
mesh_82 = Mesh(move_45.Geometry)

# ---- group: 3D City / park 3D
mesh_83 = Mesh(move_48.Geometry)

# ---- group: 3D City / blank
mesh_84 = Mesh(move_47.Geometry)

# ---- group: parking
movetoorgin_5 = MoveToOrgin(G=mesh_57, num=num_62)  # disabled
vec2pt_12 = Vector2Pt(PointA=Point(0, 0, 0), PointB=pt_112, Unitize=False)  # -> Vector, Length; disabled

# ---- group: parking / module meshes lego at orgin
mesh_85 = Mesh(movetoorgin_5)  # disabled

# ---- group: 3D City (continued)
dispatch_34 = Dispatch(List=pt_111, DispatchPattern=bool_26)  # -> ListA, ListB
dispatch_35 = Dispatch(List=int_155, DispatchPattern=bool_26)  # -> ListA, ListB
planesrf_7 = PlaneSurface(Plane=pt_169, XSize=dom_11, YSize=dom_11)
lng_11 = ListLength(List=pt_169)
random_13 = Random(Range="0.8 to 1.4", Number=lng_11, Seed=Slider(72, range=0..100))
multiplication_60 = Multiplication(A=random_13, B=tree_scale)
scale_2 = Scale(Geometry=mesh_80, Center=Point(0, 0, 0), Factor=multiplication_60)  # -> Geometry, Transform
random_14 = Random(Range=dom_12, Number=lng_11, Seed=Slider(17, range=0..100))
random_15 = Random(Range=Domain(0, 1000), Number=lng_11, Seed=Slider(35, range=0..100))
popgeo_6 = PopulateGeometry(Geometry=flatten(planesrf_7), Count=flatten(random_14), Seed=flatten(random_15))

# ---- group: 3D City / building center
pt_170 = Point(dispatch_34.ListA)

# ---- group: 3D City / building id
int_196 = Integer(dispatch_35.ListA)

# ---- group: 3D City / tree center
pt_171 = Point(flatten(popgeo_6))

# ---- group: 3D City (continued)
equals_27 = Equality(FirstNumber=int_196, SecondNumber=int_159)  # -> Equality, Inequality
multiplication_61 = Multiplication(A=equals_27.Inequality, B=6)
addition_41 = Addition(A=int_196, B=multiplication_61)
vec2pt_13 = Vector2Pt(PointA=Point(0, 0, 0), PointB=pt_171, Unitize=False)  # -> Vector, Length
filter_61 = StreamFilter(Gate=equals_10.Equality, Stream0=addition_41, Stream1=int_196)
item_69 = ListItem(List=col_66, Index=graft(filter_61), Wrap=False)
pshift_73 = ShiftPaths(Data=item_69, Offset=-1)
move_50 = Move(Geometry=scale_2.Geometry, Motion=vec2pt_13.Vector)  # -> Geometry, Transform
item_70 = ListItem(List=panel_193, Index=graft(int_196), Wrap=False)
pshift_74 = ShiftPaths(Data=item_70, Offset=-1)
multiplication_62 = Multiplication(A=pshift_74, B=number_slider_38)

# ---- group: 3D City / color for each building
col_67 = Colour(pshift_73)

# ---- group: 3D City / building height of each building
num_199 = Number(multiplication_62)

# ---- group: 3D City (continued)
addition_42 = Addition(A=num_199, B=panel_150)
dom_14 = ConstructDomain(DomainStart=0, DomainEnd=addition_42)
box_11 = DomainBox(Base=pt_170, X=dom_13, Y=dom_13, Z=dom_14)
move_51 = Move(Geometry=box_11, Motion=vec_12)  # -> Geometry, Transform

# ---- group: 3D City / building geo
box_12 = Box(move_51.Geometry)

# ---- group: textured buildings
panel_194 = Panel("C:\Users\RYAN\Documents\GitHub\CityMatrix\Map\PEV_PSG AND PKG_300DPI.png")
boxmap = BoxMapping(Mesh=box_12, Box=box_12)
previewmat_3 = CustomPreviewMaterials(Geometry=boxmap, DiffuseColor=ColourSwatch(SwatchColor=RGB(255, 255, 255)), Transparency="0.01", DiffuseBitmap=panel_194)

# ----
addition_43 = Addition(A=num_199, B=Slider(5, range=0..100))
vec_13 = VectorXYZ(XComponent=0, YComponent=0, ZComponent=addition_43)  # -> Vector, Length
move_52 = Move(Geometry=move_49.Geometry, Motion=vec_13.Vector)  # -> Geometry, Transform
wires = BrepWireframe(Brep=graft(box_12), Density=-1)

# ---- group: Position Calibration / trees 3D
mesh_86 = Mesh(move_50.Geometry)

# ---- group: 3D City / 3D Buldings
preview_49 = CustomPreview(Geometry=box_12, Shader=col_67)

# ----
previewmat_4 = CustomPreviewMaterials(Geometry=box_12, DiffuseColor=col_67, Transparency=Slider(0.7, range=0..1))
partition = PartitionList(List=wires, Size=12)
preview_50 = CustomPreview(
    Geometry=move_52.Geometry,
    Shader={ambient=RGB(0, 0, 0), diffuse=RGB(255, 105, 180), emission=RGB(76, 32, 54), shine=0.5, specular=RGB(255, 255, 255), transparency=0})

# ---- group: parking (continued)
move_53 = Move(Geometry=mesh_85, Motion=vec2pt_12.Vector)  # -> Geometry, Transform; disabled

# ---- group: parking / parking lego
mesh_87 = Mesh(move_53.Geometry)  # disabled

# ---- group: parking (continued)
move_54 = Move(Geometry=mesh_87, Motion=vec_3)  # -> Geometry, Transform; disabled
filter_62 = StreamFilter(Gate=show_google_map, Stream0=mesh_87)  # disabled

# ---- group: parking / parking 3D
mesh_88 = Mesh(move_54.Geometry)  # disabled

# ---- group: parking / parking lego
mesh_89 = Mesh(filter_62)  # disabled

# ----
index_4 = Slider(30000, range=1000..100000)
cell_size_3 = Number(cell_size)
grid_x_extent_6 = Number(int_115)
grid_y_extent_6 = Number(int_116)
ppl_by_id = GhPythonScript(
    run=run_module_5.run,
    inL=iron2panel.panelOut,
    id0=int_85,
    id1=int_86,
    id2=int_84,
    id3=int_82,
    id4=int_81,
    id5=int_83,
    id8=int_83)  # -> out, outL; inputs inL: list
# ---------- ppl_by_id: Python ----------
__author__ = "sunt"
__version__ = "2018.06.01"

import rhinoscriptsyntax as rs
run =True
if run:
    
    outL = inL[:]
    
    replaceDict ={0:id0,1:id1,2:id2,3:id3,4:id4,5:id5,8:id8}
    
    for item in range(len(outL)):
        outL[item] = int(replaceDict.get(outL[item],0))
    
        
    print(outL)
# ---------- end ppl_by_id ----------
traffic_by_id = GhPythonScript(inL=ppl_by_id.outL, xExt=grid_x_extent_6, yExt=grid_y_extent_6, cellSize=cell_size_3)  # -> out, outL; inputs inL: tree, xExt: Int32; disabled
# ---------- traffic_by_id: Python ----------
"""Provides a scripting component.
    Inputs:
        centroid: Building's centroid point (area)
        floors: the number of floor
        grid: The gird
        cellSize: the size of the grid cell
        
    Output:
        a: The a output variable"""

__author__ = "sunt"
__version__ = "2018.05.28"

import rhinoscriptsyntax as rs
import math
import Grasshopper as gh

xExt = int(xExt)
yExt = int(yExt)

midL = [[0 for x in range(xExt)] for y in range(yExt)]
outL = [[0 for x in range(xExt)] for y in range(yExt)]

print(outL)
print(inL.Branch(0)[0])




for bldgY in range(yExt):
    for bldgX in range(xExt):
        if float(inL.Branch(bldgY)[bldgX]) == 0:
            trafInd = 0
            for y in range(int(bldgY-2), int(bldgY+3)):
                for x in range(int(bldgX-2), int(bldgX+3)):
                    if 0<=x and x<xExt and 0<=y and y<yExt:
                        if bldgY-y == 2 or bldgY-y == -2 or bldgX-x == 2 or bldgX-x == -2:
                            trafInd += 0.5* float(inL.Branch(y)[x])
                        else:
                            trafInd += float(inL.Branch(y)[x])
            midL[bldgY][bldgX] = trafInd

for bldgY in range(yExt):
    for bldgX in range(xExt):
        if float(inL.Branch(bldgY)[bldgX]) == 0:
            accInd = midL[bldgY][bldgX]
            for (newY,newX) in [(bldgY-1,bldgX),(bldgY+1,bldgX),(bldgY,bldgX-1),(bldgY,bldgX+1)]:
                if 0<=newX and newX<xExt and 0<=newY and newY<yExt:
                    accInd += midL[newY][newX]*0.5
            outL[bldgY][bldgX] = accInd/10000

print(outL)
# ---------- end traffic_by_id ----------

tag_30 = TextTag3D(Location=area_2.Centroid, Text=flatten(ppl_by_id.outL), Size=Slider(9.3, range=0..100), Colour=swatch_7, Justification=4)  # disabled
panel_195 = Panel(ppl_by_id.outL)

balance_by_id = GhPythonScript(ids=iron2panel.panelOut, inL=ppl_by_id.outL, xExt=grid_x_extent_6, yExt=grid_y_extent_6)  # -> out, outL, avg; inputs ids: tree, inL: tree, xExt: Int32
# ---------- balance_by_id: Python ----------
"""Provides a scripting component.
    Inputs:
        centroid: Building's centroid point (area)
        floors: the number of floor
        grid: The gird
        cellSize: the size of the grid cell
        
    Output:
        a: The a output variable"""

__author__ = "sunt"
__version__ = "2018.05.28"

import rhinoscriptsyntax as rs
import math
import Grasshopper as gh

xExt = int(xExt)
yExt = int(yExt)

print(ids.Branch(0)[0])
print(inL.Branch(0)[0])

midL = [[0 for x in range(xExt)] for y in range(yExt)]
outL = [[0 for x in range(xExt)] for y in range(yExt)]
#
##print(outL)
##print(inL.Branch(0)[0])
#
score,count = 0,0


for bldgY in range(yExt):
    for bldgX in range(xExt):
        if int(ids.Branch(bldgY)[bldgX])in [0,1,2,3,4,5,6,8]:
            res, emp = 0,0
            for newY in range(bldgY-3,bldgY+4):
                for newX in range(bldgX-3,bldgX+4):
                    if 0<=newX and newX<xExt and 0<=newY and newY<yExt:
                        if int(ids.Branch(newY)[newX])<3:
                            res += int(inL.Branch(newY)[newX])
                        elif int(ids.Branch(newY)[newX])>=3:
                            emp += int(inL.Branch(newY)[newX])
            s = 1-max(0.5-res/(res+emp),res/(res+emp)-0.5)*2
            outL[bldgY][bldgX] = s
            score += s
            count += 1
            
avg = score/count
print(avg)
#
#for bldgY in range(yExt):
#    for bldgX in range(xExt):
#        if float(inL.Branch(bldgY)[bldgX]) == 0:
#            accInd = midL[bldgY][bldgX]
#            for (newY,newX) in [(bldgY-1,bldgX),(bldgY+1,bldgX),(bldgY,bldgX-1),(bldgY,bldgX+1)]:
#                if 0<=newX and newX<xExt and 0<=newY and newY<yExt:
#                    accInd += midL[newY][newX]*0.5
#            for (newY,newX) in [(bldgY-2,bldgX),(bldgY+2,bldgX),(bldgY,bldgX-2),(bldgY,bldgX+2)]:
#                if 0<=newX and newX<xExt and 0<=newY and newY<yExt:
#                    accInd += midL[newY][newX]*0.5
#            outL[bldgY][bldgX] = accInd/index
#            score += max(0,1-accInd/index)
#            count += 1
#avg = score/max(count,1)

#print(outL)
# ---------- end balance_by_id ----------
iron2panel_6 = GhPythonScript(run=run_module_6.run, ironList=balance_by_id.outL)  # -> out, panelOut; same code as iron2panel_2

traffic_by_id_2 = GhPythonScript(
    ids=iron2panel.panelOut,
    inL=ppl_by_id.outL,
    xExt=grid_x_extent_6,
    yExt=grid_y_extent_6,
    index=index_4,
    balance=balance_by_id.avg)  # -> out, midL, outL, avg; inputs ids: tree, inL: tree, xExt: Int32
# ---------- traffic_by_id_2: Python ----------
"""Provides a scripting component.
    Inputs:
        centroid: Building's centroid point (area)
        floors: the number of floor
        grid: The gird
        cellSize: the size of the grid cell
        
    Output:
        a: The a output variable"""

__author__ = "sunt"
__version__ = "2018.05.28"

import rhinoscriptsyntax as rs
import math
import Grasshopper as gh

xExt = int(xExt)
yExt = int(yExt)

midL = [[0 for x in range(xExt)] for y in range(yExt)]
outL = [[0 for x in range(xExt)] for y in range(yExt)]

#print(outL)
#print(inL.Branch(0)[0])

score,count = 0,0


for bldgY in range(yExt):
    for bldgX in range(xExt):
        if float(ids.Branch(bldgY)[bldgX]) in [6,9]:
            trafInd = 0
            for (newY,newX) in [(bldgY-1,bldgX),(bldgY+1,bldgX),(bldgY,bldgX-1),(bldgY,bldgX+1)]:
                if 0<=newX and newX<xExt and 0<=newY and newY<yExt:
                    trafInd += inL.Branch(newY)[newX]
            midL[bldgY][bldgX] = trafInd

for bldgY in range(yExt):
    for bldgX in range(xExt):
        if float(ids.Branch(bldgY)[bldgX]) in [6,9]:
            accInd = midL[bldgY][bldgX]
            for (newY,newX) in [(bldgY-1,bldgX),(bldgY+1,bldgX),(bldgY,bldgX-1),(bldgY,bldgX+1)]:
                if 0<=newX and newX<xExt and 0<=newY and newY<yExt:
                    accInd += midL[newY][newX]*0.5
            for (newY,newX) in [(bldgY-2,bldgX),(bldgY+2,bldgX),(bldgY,bldgX-2),(bldgY,bldgX+2)]:
                if 0<=newX and newX<xExt and 0<=newY and newY<yExt:
                    accInd += midL[newY][newX]*0.5
            outL[bldgY][bldgX] = accInd/index * (1-balance)
            score += max(0,1-accInd/index * (1-balance))
            count += 1
avg = score/max(count,1)

#print(outL)
# ---------- end traffic_by_id_2 ----------
iron2panel_7 = GhPythonScript(run=run_module_5.run, ironList=traffic_by_id_2.outL)  # -> out, panelOut; same code as iron2panel_2

panel_196 = Panel(iron2panel_7.panelOut)
panel_197 = Panel(iron2panel_6.panelOut)

gradient_25 = Gradient(
    LowerLimit=0.01,
    UpperLimit=1,
    Parameter=panel_196,
    stops=[1e-06: RGB(255, 255, 240), 0.5: RGB(255, 255, 0), 1: RGB(255, 0, 0)])
panel_198 = Panel("""6
9""")
nonetype_5 = GhPythonScript(i=gradient_25)  # -> out, run, o; same code as nonetype
run_8 = GhPythonScript(i=panel_198, run=nonetype_5.run)  # -> out, o; inputs run: tree; same code as run_4

gradient_26 = Gradient(LowerLimit=0, UpperLimit=1, Parameter=panel_197, stops=[0: RGB(255, 0, 0), 0.5: RGB(255, 255, 0), 1: RGB(0, 128, 0)])

panel_199 = Panel("""0
1
2
3
4
5""")
nonetype_6 = GhPythonScript(i=gradient_26)  # -> out, run, o; same code as nonetype
run_9 = GhPythonScript(i=panel_199, run=nonetype_6.run)  # -> out, o; inputs run: tree; same code as run_4

filter_elements_4 = GhPythonScript(t=num, ids=flatten(iron2panel.panelOut), filter=flatten([run_4.o, run_8.o, run_7.o, run_5.o, run_6.o, run_9.o]))  # -> out, outE; inputs ids: list, filter: list of Int32
# ---------- filter_elements_4: Python ----------
__author__ = "sunt"
__version__ = "2018.06.03"

import rhinoscriptsyntax as rs

#print(E)
print(filter)
outE = []

for e in range(len(ids)):
    if ids[e] in filter:
        outE.append(t)
    else:
        outE.append(1)
# ---------- end filter_elements_4 ----------
# HeatMap display - Tuo
move_55 = Move(Geometry=boundary_2, Motion=Vector(0, 0, 8))  # -> Geometry, Transform
previewmat_5 = CustomPreviewMaterials(
    Geometry=move_55.Geometry,
    DiffuseColor=flatten([nonetype.o, nonetype_5.o, nonetype_4.o, nonetype_2.o, nonetype_3.o, nonetype_6.o]),
    Transparency=filter_elements_4.outE)

panel_200 = Panel(filter_elements_4.outE)

rings = GhPythonScript()  # -> out, a
# ---------- rings: Python ----------
__author__ = "sunt"
__version__ = "2018.06.04"

import rhinoscriptsyntax as rs

a = [0.2*(i+1) for i in range(4)]
# ---------- end rings ----------
# Radar Chart - Tuo
circle = Circle({Plane=Plane(origin=(1813.714054, -922.0555175, 0), x=(0.9138115486, -0.4061384661, 0), y=(0.4061384661, 0.9138115486, 0)), Radius=293.866235})
area_3 = Area(Geometry=circle)  # -> Area, Centroid
scale_3 = Scale(Geometry=circle, Center=area_3.Centroid, Factor=rings.a)  # -> Geometry, Transform

swatch_10 = ColourSwatch(SwatchColor=RGBA(150, 150, 150, 194))
argb_17 = SplitARGB(Colour=swatch_10)  # -> Alpha, Red, Green, Blue
frgb_32 = ColourRGBF(Alpha=Slider(1, range=0..1), Red=argb_17.Red, Green=argb_17.Green, Blue=argb_17.Blue)
previewlw_5 = CustomPreviewLineweights(Geometry=circle, Shader=frgb_32, Thickness=Slider(5, range=0..10), Absolute=False)

number_slider_54 = Slider(7, range=4..10)
panel_201 = Panel("""Pop. Density
Experience Diversity
Energy Effic.
Working Prox.
Living Prox.
Park Prox.
Live-work Balance
Solar Access
Mobility Perform.""")
python_20 = PythonScript(x=number_slider_54, scale=division_8, inL=panel_201)  # -> out, out_2; inputs inL: list; same code as python_17
radar_chart_data_list = PythonScript(
    solar=solar_by_id.avg,
    work=new_col_trans.score,
    live=new_col_trans_2.score,
    park=new_col_trans_3.score,
    tra=traffic_by_id_2.avg,
    lwb=balance_by_id.avg)  # -> out, L
# ---------- radar_chart_data_list: Python ----------
ds = [popden,expdiv,enEff,work,live,park,lwb,solar,tra]
L = [0.5]*len(ds)
for d in range(len(ds)):
    if ds[d]>0:
        L[d] = ds[d]
# ---------- end radar_chart_data_list ----------
panel_202 = Panel(python_20.out_2)
python_21 = PythonScript(x=number_slider_54, scale=division_8, inL=radar_chart_data_list.L)  # -> out, out_2; inputs inL: list; same code as python_17
number_slider_55 = Slider(18, range=0..100)
neg_16 = Negative(Value=Slider(42, range=0..100))
panel_203 = Panel(python_21.out_2)
vec_14 = VectorXYZ(XComponent=0, YComponent=neg_16, ZComponent=0)  # -> Vector, Length
python_22 = PythonScript(x=panel_203)  # -> out, a
# ---------- python_22: Python ----------
a = str(int(float(x) * 100))
# ---------- end python_22 ----------
multiplication_63 = Multiplication(A=number_slider_55, B=Slider(2, range=0..100))
swatch_11 = ColourSwatch(SwatchColor=RGB(255, 255, 255))

lng_12 = ListLength(List=panel_202)
divide_6 = DivideCurve(Curve=circle, Count=lng_12, Kinks=False)  # -> Points, Tangents, Parameters
ln_10 = Line(StartPoint=area_3.Centroid, EndPoint=divide_6.Points)
eval_5 = EvaluateCurve(Curve=ln_10, Parameter=Slider(1, range=0..1))  # -> Point, Tangent, Angle
eval_6 = EvaluateCurve(Curve=ln_10, Parameter=Slider(1.4, range=0..2))  # -> Point, Tangent, Angle
ln_11 = Line(StartPoint=area_3.Centroid, EndPoint=eval_5.Point)
eval_7 = EvaluateCurve(Curve=ln_11, Parameter=panel_203)  # -> Point, Tangent, Angle
pline_4 = PolyLine(Vertices=eval_7.Point, Closed=True)
fillet_2 = Fillet(Curve=pline_4, Radius=Slider(7.5, range=3..10))
boundary_3 = BoundarySurfaces(Edges=fillet_2)
move_56 = Move(Geometry=fillet_2, Motion=Vector(0, 0, 10))  # -> Geometry, Transform
move_57 = Move(Geometry=boundary_3, Motion=Vector(0, 0, 10))  # -> Geometry, Transform

pt_172 = Point(eval_6.Point)
move_58 = Move(Geometry=pt_172, Motion=vec_14.Vector)  # -> Geometry, Transform
tag_31 = TextTag3D(Location=move_58.Geometry, Text=python_22.a, Size=multiplication_63, Colour=swatch_11, Justification=5)
tag_32 = TextTag3D(Location=pt_172, Text=panel_202, Size=number_slider_55, Colour=swatch_11, Justification=5)

swatch_12 = ColourSwatch(SwatchColor=RGBA(20, 106, 255, 194))
argb_18 = SplitARGB(Colour=swatch_12)  # -> Alpha, Red, Green, Blue
frgb_33 = ColourRGBF(Alpha=Slider(0.575, range=0..1), Red=argb_18.Red, Green=argb_18.Green, Blue=argb_18.Blue)
previewlw_6 = CustomPreviewLineweights(Geometry=move_56.Geometry, Shader=frgb_33, Thickness=Slider(8, range=0..10), Absolute=False)
previewmat_6 = CustomPreviewMaterials(Geometry=move_57.Geometry, DiffuseColor=swatch_12, Transparency=Slider(0.5, range=0..1))

swatch_13 = ColourSwatch(SwatchColor=RGBA(255, 255, 255, 194))
argb_19 = SplitARGB(Colour=swatch_10)  # -> Alpha, Red, Green, Blue
frgb_34 = ColourRGBF(Alpha=Slider(1, range=0..1), Red=argb_19.Red, Green=argb_19.Green, Blue=argb_19.Blue)
previewlw_7 = CustomPreviewLineweights(Geometry=flatten([ln_10, scale_3.Geometry]), Shader=frgb_34, Thickness=Slider(1, range=0..10), Absolute=False)

# ==== cluster ModuleCenter
pt = ClusterInput()
int = ClusterInput()
num = ClusterInput()
int_2 = ClusterInput()

# ---- group: y
int_3 = Integer(int)

# ---- group: cell size
num_2 = Number(num)

# ---- group: x
int_4 = Integer(int_2)

# ---- group: center
pt_2 = Point(pt)

# ----
pt_3 = ConstructPoint(XCoordinate=0, YCoordinate=0, ZCoordinate=0)  # disabled
addition = Addition(A=int_4, B=0.5)
vec2pt = Vector2Pt(PointA=pt_3, PointB=pt_2, Unitize=False)  # -> Vector, Length; disabled
addition_2 = Addition(A=int_3, B=0.5)
multiplication = Multiplication(A=addition, B=num_2)
move = Move(Motion=vec2pt.Vector)  # -> Geometry, Transform; disabled
lng = ListLength(List=int_4)  # disabled
multiplication_2 = Multiplication(A=addition_2, B=num_2)
X = UnitX(Factor=multiplication)
repeat = RepeatData(Data=move.Transform, Length=lng)  # disabled
neg = Negative(Value=multiplication_2)
move_2 = Move(Geometry=pt_2, Motion=X)  # -> Geometry, Transform
graft = GraftTree(Tree=move_2.Transform, IncludeEmptyLists=True, IncludeNullItems=True)  # disabled
Y = UnitY(Factor=neg)
pshift = ShiftPaths(Data=repeat, Offset=-1)  # disabled
move_3 = Move(Geometry=move_2.Geometry, Motion=Y)  # -> Geometry, Transform
graft_2 = GraftTree(Tree=move_3.Transform, IncludeEmptyLists=True, IncludeNullItems=True)  # disabled
comp = Compound(Transforms=[graft, graft_2])  # disabled
graft_3 = GraftTree(Tree=pshift, IncludeEmptyLists=True, IncludeNullItems=True)  # disabled
comp_2 = Compound(Transforms=[comp, graft_3])  # disabled

# ---- group: module center
pt_4 = Point(move_3.Geometry)

# ----
pshift_2 = ShiftPaths(Data=comp_2, Offset=-1)  # disabled
transform = Transform(pshift_2)  # disabled
pt_5 = ClusterOutput(pt_4)
transform_2 = ClusterOutput(transform)  # disabled

# ==== cluster MoveToOrgin
num = ClusterInput()
G = ClusterInput()
num_2 = Number(num)
geobottomcenter = GeoBottomCenter(geo=G)
vec2pt = Vector2Pt(PointA=geobottomcenter, PointB=Point(0, 0, 0), Unitize=False)  # -> Vector, Length
move = Move(Geometry=G, Motion=vec2pt.Vector)  # -> Geometry, Transform
scale_nu = ScaleNU(Geometry=move.Geometry, Plane=PlaneXY(0, 0, 0), ScaleX=num_2, ScaleY=num_2, ScaleZ=1)  # -> Geometry, Transform
G_2 = ClusterOutput(scale_nu.Geometry)

# ==== cluster GeoBottomCenter_2
geo = ClusterInput()
geo_2 = Geometry(geo)
bbox = BoundingBox(Content=geo_2, Plane=PlaneXY(0, 0, 0))  # -> Box, Box_2
box_corners = BoxCorners(Box=bbox.Box)  # -> CornerA, CornerB, CornerC, CornerD, CornerE, CornerF, CornerG, CornerH
pdecon = Deconstruct(Point=box_corners.CornerA)  # -> XComponent, YComponent, ZComponent
pdecon_2 = Deconstruct(Point=box_corners.CornerC)  # -> XComponent, YComponent, ZComponent
addition = Addition(A=pdecon.XComponent, B=pdecon_2.XComponent)
addition_2 = Addition(A=pdecon.YComponent, B=pdecon_2.YComponent)
division = Division(A=addition, B=2)
division_2 = Division(A=addition_2, B=2)
pt = ConstructPoint(XCoordinate=division, YCoordinate=division_2, ZCoordinate=pdecon.ZComponent)
pshift = ShiftPaths(Data=pt, Offset=-1)
pt_2 = Point(pshift)
pt_3 = ClusterOutput(pt_2)

# ==== cluster EasterEggs
panel = Panel("79")  # disabled
panel_2 = Panel("30")  # disabled
subtraction = Subtraction(A=panel, B=1)  # disabled
subtraction_2 = Subtraction(A=panel_2, B=1)  # disabled
sqgrid = Square(Plane=PlaneXY(0, 0, 0), Size=1, ExtentX=subtraction, ExtentY=subtraction_2)  # -> Cells, Points; disabled
pdecon = Deconstruct(Point=sqgrid.Points)  # -> XComponent, YComponent, ZComponent; disabled
division = Division(A=pdecon.XComponent, B=panel)  # disabled
division_2 = Division(A=pdecon.YComponent, B=panel_2)  # disabled
pt = ConstructPoint(XCoordinate=division, YCoordinate=division_2, ZCoordinate=0)  # disabled
ahsv = SplitAHSV()  # -> Alpha, Hue, Saturation, Value; disabled
smaller = SmallerThan(FirstNumber=ahsv.Alpha, SecondNumber=1)  # -> SmallerThan, OrEqualTo; disabled
dispatch = Dispatch(List=sqgrid.Points, DispatchPattern=smaller.SmallerThan)  # -> ListA, ListB; disabled
dispatch_2 = Dispatch(DispatchPattern=smaller.SmallerThan)  # -> ListA, ListB; disabled
vec = VectorXYZ(XComponent=2, YComponent=-2, ZComponent=-10)  # -> Vector, Length; disabled
planesrf = PlaneSurface(Plane=dispatch.ListB, XSize=Domain(-0.5, 0.5), YSize=Domain(-0.5, 0.5))  # disabled
mesh = Mesh(flatten(planesrf))  # disabled
col = Colour(flatten(dispatch_2.ListB))  # disabled
mspray = MeshSpray(Mesh=graft(mesh), Points=Point(0, 0, 0), Colours=graft(col), SprayMode=0)  # disabled
mjoin = MeshJoin(Meshes=flatten(mspray))  # disabled
move = Move(Geometry=mjoin, Motion=vec.Vector)  # -> Geometry, Transform; disabled
mcol = MeshColours(Mesh=move.Geometry, Colours=RGB(0, 0, 0))  # disabled
preview = CustomPreview(Geometry=planesrf, Shader=dispatch_2.ListB)  # disabled
mjoin_2 = MeshJoin(Meshes=flatten([mjoin, mcol]))  # disabled
toggle = BooleanToggle(False)  # disabled
toggle_2 = BooleanToggle(False)  # disabled
panel_3 = Panel("7")  # disabled
swatch = ColourSwatch(SwatchColor=RGB(0, 0, 0))  # disabled
swatch_2 = ColourSwatch(SwatchColor=RGB(255, 115, 0))  # disabled

# ---- group: module meshes lego ref: 7 - J
mesh_2 = Mesh(<mesh referenced from the Rhino model>)  # disabled

# ---- group: on screen mesh ref: 8 - X
mesh_3 = Mesh(<mesh referenced from the Rhino model>)  # disabled

# ---- group: module meshes lego ref: 8 - X
mesh_4 = Mesh(<mesh referenced from the Rhino model>)  # disabled

# ----
panel_4 = Panel("7")  # disabled
mesh_5 = Mesh(<mesh referenced from the Rhino model>)  # disabled

# ---- group: on screen mesh ref: 7 - J
mesh_6 = Mesh(mjoin_2)  # disabled

# ----
mcol_2 = MeshColours(Mesh=mesh_3, Colours=swatch_2)  # disabled
mcol_3 = MeshColours(Mesh=mesh_5, Colours=swatch)  # disabled
shrink = ClusterInput()
shrink_2 = ClusterInput()
movetoorgin = MoveToOrgin(G=mesh_2, num=shrink)  # disabled
movetoorgin_2 = MoveToOrgin(G=mesh_4, num=shrink_2)  # disabled
mjoin_3 = MeshJoin(Meshes=[mcol_2, mcol_3])  # disabled

# ---- group: module meshes lego at orgin
mesh_7 = Mesh(movetoorgin)  # disabled

mesh_8 = Mesh(movetoorgin_2)  # disabled

# ----
A = ClusterInput()
A_2 = ClusterInput()
equals = Equality(FirstNumber=A, SecondNumber=panel_4)  # -> Equality, Inequality; disabled
int = Integer(equals.Equality)  # disabled
ma = MassAddition(Input=int)  # -> Result, PartialResults; disabled
larger = LargerThan(FirstNumber=ma.Result, SecondNumber=0)  # -> LargerThan, OrEqualTo; disabled
equals_2 = Equality(FirstNumber=A_2, SecondNumber=panel_3)  # -> Equality, Inequality; disabled
L = ClusterInput()
int_2 = Integer(equals_2.Equality)  # disabled
ma_2 = MassAddition(Input=int_2)  # -> Result, PartialResults; disabled
larger_2 = LargerThan(FirstNumber=ma_2.Result, SecondNumber=0)  # -> LargerThan, OrEqualTo; disabled
L_2 = ClusterInput()
dispatch_3 = Dispatch(List=L, DispatchPattern=equals_2.Equality)  # -> ListA, ListB; disabled

# ---- group: if has this special id
bool = Boolean(larger.LargerThan)  # disabled

bool_2 = Boolean(bool)  # disabled

# ----
getcamera = GetCamera(GetCamera=bool_2)  # -> Location, Target, LensLength, UpDirection; disabled
ln = Line(StartPoint=getcamera.Location, EndPoint=getcamera.Target)  # disabled
getplanefrom2pts = GetPlaneFrom2pts(pt_2=getcamera.Location, pt=getcamera.Target)  # disabled
dispatch_4 = Dispatch(List=L_2, DispatchPattern=equals.Equality)  # -> ListA, ListB; disabled
number_slider = Slider(6.4, range=0..10)  # disabled
number_slider_2 = Slider(14.4, range=0..100)  # disabled
pt_2 = ConstructPoint(XCoordinate=500, YCoordinate=500, ZCoordinate=20)  # disabled

# ---- group: if has this special id
bool_3 = Boolean(larger_2.LargerThan)  # disabled

bool_4 = Boolean(bool_3)  # disabled

# ----
getcamera_2 = GetCamera(GetCamera=bool_4)  # -> Location, Target, LensLength, UpDirection; disabled
ln_2 = Line(StartPoint=getcamera_2.Location, EndPoint=getcamera_2.Target)  # disabled
getplanefrom2pts_2 = GetPlaneFrom2pts(pt_2=getcamera_2.Location, pt=getcamera_2.Target)  # disabled
vec2pt = Vector2Pt(PointA=Point(0, 0, 0), PointB=dispatch_3.ListA, Unitize=False)  # -> Vector, Length; disabled
vec2pt_2 = Vector2Pt(PointA=Point(0, 0, 0), PointB=dispatch_4.ListA, Unitize=False)  # -> Vector, Length; disabled
move_2 = Move(Geometry=mesh_7, Motion=vec2pt.Vector)  # -> Geometry, Transform; disabled
pt_3 = Point(pt_2)  # disabled
move_3 = Move(Geometry=mesh_8, Motion=vec2pt_2.Vector)  # -> Geometry, Transform; disabled

# ---- group: current cam canvas pln
pln = Plane(getplanefrom2pts)  # disabled

pln_2 = Plane(getplanefrom2pts_2)  # disabled

# ----
xy = XYPlane(Origin=pt_3)  # disabled
number_slider_3 = Slider(0.01, range=0.001..1)  # disabled
number_slider_4 = Slider(0.01, range=0.001..1)  # disabled
number_slider_5 = Slider(0.81, range=0.001..101)  # disabled
movetoorgin_3 = MoveToOrgin(G=mjoin_3, num=number_slider)  # disabled
movetoorgin_4 = MoveToOrgin(G=mesh_6, num=number_slider_2)  # disabled
orient = Orient(Geometry=movetoorgin_4, Source=PlaneXY(0, 0, 0), Target=xy)  # -> Geometry, Transform; disabled
orient_2 = Orient(Geometry=movetoorgin_3, Source=PlaneXY(0, 0, 0), Target=pln)  # -> Geometry, Transform; disabled
orient_3 = Orient(Geometry=movetoorgin_4, Source=PlaneXY(0, 0, 0), Target=pln_2)  # -> Geometry, Transform; disabled
scale = Scale(Geometry=orient_2.Geometry, Center=getcamera.Location, Factor=number_slider_3)  # -> Geometry, Transform; disabled
scale_2 = Scale(Geometry=orient_3.Geometry, Center=getcamera_2.Location, Factor=number_slider_4)  # -> Geometry, Transform; disabled
scale_3 = Scale(Geometry=orient.Geometry, Center=pt_3, Factor=number_slider_5)  # -> Geometry, Transform; disabled
filter = StreamFilter(Gate=bool_2, Stream1=scale.Geometry)  # disabled
filter_2 = StreamFilter(Gate=bool_4, Stream1=scale_2.Geometry)  # disabled
filter_3 = StreamFilter(Gate=bool_4, Stream1=scale_3.Geometry)  # disabled

# ---- group: special JR
mesh_9 = Mesh(move_2.Geometry)  # disabled

# ---- group: on 3d view
mesh_10 = Mesh(filter)  # disabled

# ---- group: special Xin
mesh_11 = Mesh(move_3.Geometry)  # disabled

# ---- group: on 3d view
mesh_12 = Mesh(filter_2)  # disabled

# ---- group: on lego
mesh_13 = Mesh(filter_3)  # disabled

# ==== cluster RndReduceByRatio
L = ClusterInput()
B = ClusterInput()
lng = ListLength(List=L)
S = ClusterInput()
multiplication = Multiplication(A=lng, B=B)
reduce = RandomReduce(List=L, Reduction=multiplication, Seed=S)
L_2 = ClusterOutput(reduce)

# ==== cluster DashLine20
num = ClusterInput()
crv = ClusterInput()
crv_2 = Curve(reparameterize(graft(crv)))
num_2 = Number(num)
explode = Explode(Curve=crv_2, Recursive=True)  # -> Segments, Vertices
crv_3 = Curve(reparameterize(graft(explode.Segments)))
len = Length(Curve=crv_3)
division = Division(A=len, B=num_2)

# ---- group: make sure it's odd number
int = Integer(division)
mod = Modulus(A=int, B=Slider(2, range=0..10))
subtraction = Subtraction(A=Slider(1, range=0..1), B=mod)
addition = Addition(A=int, B=subtraction)

# ----
int_2 = Integer(addition)
dom = Domain(DomainStart=0, DomainEnd=expr("1-1/x", int_2))
dom_2 = Domain(DomainStart=expr("1/x", int_2), DomainEnd=1)
range = Range(Domain=dom_2, Steps=expr("x-1", int_2))
range_2 = Range(Domain=dom, Steps=expr("x-1", int_2))
series = Series(Start=0, Step=2, Count=expr("(x+1)/2", int_2))
dom_3 = Domain(DomainStart=range_2, DomainEnd=range)
item = ListItem(List=dom_3, Index=series, Wrap=False)
subcrv = SubCurve(BaseCurve=crv_3, Domain=item)
C = ClusterOutput(subcrv)

# ==== cluster Perspective
int = ClusterInput()
int_2 = ClusterInput()
pt = ClusterInput()

# ---- group: grid extent y
int_3 = Integer(int)

# ---- group: grid extent x
int_4 = Integer(int_2)

# ---- group: Pts Sample Grid Corner
pt_2 = Point(pt)

# ----
subtraction = Subtraction(A=int_4, B=1)
subtraction_2 = Subtraction(A=int_3, B=1)
item = ListItem(List=pt_2, Index=0, Wrap=False)
item_2 = ListItem(List=pt_2, Index=1, Wrap=False)
item_3 = ListItem(List=pt_2, Index=2, Wrap=False)
item_4 = ListItem(List=pt_2, Index=3, Wrap=False)
pt_3 = Point(item_4)
pt_4 = Point(item)
ln = Line(StartPoint=pt_3, EndPoint=pt_4)
pt_5 = Point(item_2)
ln_2 = Line(StartPoint=pt_4, EndPoint=pt_5)
pt_6 = Point(item_3)
ln_3 = Line(StartPoint=pt_6, EndPoint=pt_3)
ln_4 = Line(StartPoint=pt_5, EndPoint=pt_6)
llx = LineLine(Line1=ln, Line2=ln_4)  # -> ParamA, ParamB, PointA, PointB
pt_7 = Point(llx.PointA)
llx_2 = LineLine(Line1=ln_2, Line2=ln_3)  # -> ParamA, ParamB, PointA, PointB
pt_8 = Point(llx_2.PointA)
vec2pt = Vector2Pt(PointA=pt_8, PointB=pt_7, Unitize=False)  # -> Vector, Length
line = LineSDL(Start=pt_3, Direction=vec2pt.Vector, Length=1)
llx_3 = LineLine(Line1=ln_2, Line2=line)  # -> ParamA, ParamB, PointA, PointB
pt_9 = Point(llx_3.PointA)
ln_5 = Line(StartPoint=pt_3, EndPoint=pt_9)
divide = DivideCurve(Curve=ln_5, Count=subtraction_2, Kinks=False)  # -> Points, Tangents, Parameters
ln_6 = Line(StartPoint=pt_8, EndPoint=divide.Points)
llx_4 = LineLine(Line1=ln_4, Line2=line)  # -> ParamA, ParamB, PointA, PointB
pt_10 = Point(llx_4.PointA)
ln_7 = Line(StartPoint=pt_3, EndPoint=pt_10)
divide_2 = DivideCurve(Curve=ln_7, Count=subtraction, Kinks=False)  # -> Points, Tangents, Parameters
ln_8 = Line(StartPoint=pt_7, EndPoint=divide_2.Points)
ln_9 = Line(StartPoint=pt_8, EndPoint=pt_7)

# ---- group: x
line_2 = Line(ln_8)

# ---- group: y
line_3 = Line(ln_6)

# ----
graft = GraftTree(Tree=ln_6, IncludeEmptyLists=True, IncludeNullItems=True)
llx_5 = LineLine(Line1=line_2, Line2=graft)  # -> ParamA, ParamB, PointA, PointB

# ---- group: keystoned grid pts
pt_11 = Point(llx_5.PointA)

# ----
pt_12 = ClusterOutput(pt_11)

# ==== cluster RecordDensitySliderSet
num = ClusterInput()
int = ClusterInput()
set1 = ClusterInput()
integer = ClusterInput()
set2 = ClusterInput()

# ---- group: slider1
num_2 = Number(num)

# ---- group: dockID
int_2 = Integer(int)

# ---- group: set number
integer_2 = Integer(integer)

# ----
set1_2 = Integer(set1)
remap = RemapNumbers(Value=set1_2, Source="1 to 30", Target=Domain(0, 1))  # -> Mapped, Clipped
panel = Panel(remap.Mapped)
set2_2 = Integer(set2)
remap_2 = RemapNumbers(Value=set2_2, Source="1 to 30", Target=Domain(0, 1))  # -> Mapped, Clipped
panel_2 = Panel(remap_2.Mapped)
equals = Equality(FirstNumber=int_2, SecondNumber="5")  # -> Equality, Inequality
equals_2 = Equality(FirstNumber=int_2, SecondNumber="2")  # -> Equality, Inequality
equals_3 = Equality(FirstNumber=int_2, SecondNumber="3")  # -> Equality, Inequality
equals_4 = Equality(FirstNumber=int_2, SecondNumber="4")  # -> Equality, Inequality
equals_5 = Equality(FirstNumber=int_2, SecondNumber="0")  # -> Equality, Inequality
equals_6 = Equality(FirstNumber=int_2, SecondNumber="1")  # -> Equality, Inequality

# ---- group: density set 1
item = ListItem(List=panel, Index=0, Wrap=False)
item_2 = ListItem(List=panel, Index=2, Wrap=False)
item_3 = ListItem(List=panel, Index=1, Wrap=False)
item_4 = ListItem(List=panel, Index=3, Wrap=False)
item_5 = ListItem(List=panel, Index=4, Wrap=False)
item_6 = ListItem(List=panel, Index=5, Wrap=False)
panel_3 = Panel(item)
panel_4 = Panel(item_3)
panel_5 = Panel(item_2)
panel_6 = Panel(item_4)
panel_7 = Panel(item_5)
panel_8 = Panel(item_6)

# ---- group: density set 2
item_7 = ListItem(List=panel_2, Index=0, Wrap=False)
item_8 = ListItem(List=panel_2, Index=2, Wrap=False)
item_9 = ListItem(List=panel_2, Index=1, Wrap=False)
item_10 = ListItem(List=panel_2, Index=3, Wrap=False)
item_11 = ListItem(List=panel_2, Index=4, Wrap=False)
item_12 = ListItem(List=panel_2, Index=5, Wrap=False)
panel_9 = Panel(item_7)
panel_10 = Panel(item_9)
panel_11 = Panel(item_8)
panel_12 = Panel(item_10)
panel_13 = Panel(item_11)
panel_14 = Panel(item_12)

# ----
panel_15 = Panel(integer_2)
filter = StreamFilter(Gate=equals.Equality, Stream1=num_2)
filter_2 = StreamFilter(Gate=equals_2.Equality, Stream1=num_2)
filter_3 = StreamFilter(Gate=equals_3.Equality, Stream1=num_2)
filter_4 = StreamFilter(Gate=equals_4.Equality, Stream1=num_2)
filter_5 = StreamFilter(Gate=equals_5.Equality, Stream1=num_2)
filter_6 = StreamFilter(Gate=equals_6.Equality, Stream1=num_2)
filter_7 = StreamFilter(Gate=panel_15, Stream0=filter_5, Stream1=panel_3, Stream2=panel_9)
filter_8 = StreamFilter(Gate=panel_15, Stream0=filter, Stream1=panel_8, Stream2=panel_14)
filter_9 = StreamFilter(Gate=panel_15, Stream0=filter_2, Stream1=panel_5, Stream2=panel_11)
filter_10 = StreamFilter(Gate=panel_15, Stream0=filter_3, Stream1=panel_6, Stream2=panel_12)
filter_11 = StreamFilter(Gate=panel_15, Stream0=filter_4, Stream1=panel_7, Stream2=panel_13)
filter_12 = StreamFilter(Gate=panel_15, Stream0=filter_6, Stream1=panel_4, Stream2=panel_10)
rec = DataRecorder(filter_9, DataLimit=1, RecordData=True)
panel_16 = Panel(rec)
rec_2 = DataRecorder(filter_8, DataLimit=1, RecordData=True)
panel_17 = Panel(rec_2)
rec_3 = DataRecorder(filter_12, DataLimit=1, RecordData=True)
panel_18 = Panel(rec_3)
rec_4 = DataRecorder(filter_10, DataLimit=1, RecordData=True)
panel_19 = Panel(rec_4)
rec_5 = DataRecorder(filter_11, DataLimit=1, RecordData=True)
panel_20 = Panel(rec_5)
rec_6 = DataRecorder(filter_7, DataLimit=1, RecordData=True)
panel_21 = Panel(rec_6)
null = NullItem(Item=rec_2)  # -> NullFlags, InvalidFlags, Description
null_2 = NullItem(Item=rec)  # -> NullFlags, InvalidFlags, Description
null_3 = NullItem(Item=rec_4)  # -> NullFlags, InvalidFlags, Description
null_4 = NullItem(Item=rec_5)  # -> NullFlags, InvalidFlags, Description
null_5 = NullItem(Item=rec_6)  # -> NullFlags, InvalidFlags, Description
null_6 = NullItem(Item=rec_3)  # -> NullFlags, InvalidFlags, Description
filter_13 = StreamFilter(Gate=null.NullFlags, Stream0=rec_2, Stream1="0")
filter_14 = StreamFilter(Gate=null_2.NullFlags, Stream0=rec, Stream1="0")
filter_15 = StreamFilter(Gate=null_3.NullFlags, Stream0=rec_4, Stream1="0")
filter_16 = StreamFilter(Gate=null_4.NullFlags, Stream0=rec_5, Stream1="0")
filter_17 = StreamFilter(Gate=null_5.NullFlags, Stream0=rec_6, Stream1="0")
filter_18 = StreamFilter(Gate=null_6.NullFlags, Stream0=rec_3, Stream1="0")
merge = Merge(Data1=filter_17, Data2=filter_18, Data3=filter_14, Data4=filter_15, Data5=filter_16, Data6=filter_13)
remap_3 = RemapNumbers(Value=merge, Source=Domain(0, 1), Target="1 to 30")  # -> Mapped, Clipped

# ---- group: floor num for each type
int_3 = Integer(remap_3.Mapped)

# ----
panel_22 = Panel(int_3)

int_4 = ClusterOutput(int_3)

# ==== cluster LimitMaxID
int = ClusterInput()
int_2 = ClusterInput()

# ---- group: max id
int_3 = Integer(int)

# ---- group: all piece ids raw
int_4 = Integer(int_2)

# ----
lng = ListLength(List=int_4)
larger = LargerThan(FirstNumber=int_4, SecondNumber=int_3)  # -> LargerThan, OrEqualTo
repeat = RepeatData(Data="-1", Length=lng)
pshift = ShiftPaths(Data=repeat, Offset=-1)
merge = Merge(Data1=graft(int_4), Data2=graft(pshift))
item = ListItem(List=merge, Index=graft(larger.LargerThan), Wrap=False)
pshift_2 = ShiftPaths(Data=item, Offset=-1)

# ---- group: all piece ids
int_5 = Integer(pshift_2)

# ----
int_6 = ClusterOutput(int_5)

# ==== cluster GeoBottomCenter
geo = ClusterInput()
geo_2 = Geometry(geo)
bbox = BoundingBox(Content=geo_2, Plane=PlaneXY(0, 0, 0))  # -> Box, Box_2
box_corners = BoxCorners(Box=bbox.Box)  # -> CornerA, CornerB, CornerC, CornerD, CornerE, CornerF, CornerG, CornerH
pdecon = Deconstruct(Point=box_corners.CornerA)  # -> XComponent, YComponent, ZComponent
pdecon_2 = Deconstruct(Point=box_corners.CornerC)  # -> XComponent, YComponent, ZComponent
addition = Addition(A=pdecon.XComponent, B=pdecon_2.XComponent)
addition_2 = Addition(A=pdecon.YComponent, B=pdecon_2.YComponent)
division = Division(A=addition, B=2)
division_2 = Division(A=addition_2, B=2)
pt = ConstructPoint(XCoordinate=division, YCoordinate=division_2, ZCoordinate=pdecon.ZComponent)
pt_2 = Point(pt)
pt_3 = ClusterOutput(pt_2)

# ==== cluster GetPlaneFrom2pts
pt = ClusterInput()
pt_2 = ClusterInput()

# ---- group: current cam tgt pos
pt_3 = Point(pt)

# ---- group: current cam pos
pt_4 = Point(pt_2)

# ----
Z = UnitZ(Factor=100)
move = Move(Geometry=pt_3, Motion=Z)  # -> Geometry, Transform
pl_3pt = Plane3Pt(PointA=pt_3, PointB=pt_4, PointC=move.Geometry)
pt_5 = PointOriented(BasePlane=pl_3pt, UComponent=0, VComponent=0, WComponent=-100)
pt_6 = PointOriented(BasePlane=pl_3pt, UComponent=0, VComponent=100, WComponent=0)
pl_3pt_2 = Plane3Pt(PointA=pt_3, PointB=pt_5, PointC=pt_6)
pln = Plane(pl_3pt_2)
pln_2 = ClusterOutput(pln)
